# Grasshopper definition 大斗.gh (Grasshopper 0.9.76)
# plug-ins: Python Interpreter

panel = Panel("单才万拱")  # disabled
panel_2 = Panel("撑头木")  # disabled
panel_3 = Panel("""正心枋
拽枋""")  # disabled
panel_5 = Panel("厢拱")  # disabled
panel_6 = Panel("蚂蚱头")  # disabled
panel_7 = Panel("三才升")  # disabled
panel_8 = Panel("昂")  # disabled
panel_9 = Panel("麻叶云")  # disabled
panel_10 = Panel("正心万拱")  # disabled
panel_11 = Panel("大斗定位点")  # disabled
panel_12 = Panel("单才瓜拱")  # disabled
panel_13 = Panel("翘")  # disabled
panel_14 = Panel("正心瓜拱")  # disabled
panel_15 = Panel("十八斗")  # disabled
panel_16 = Panel("槽升")  # disabled
panel_17 = Panel("大斗")  # disabled
panel_18 = Panel("斗口")  # disabled
panel_19 = Panel("一拽架")  # disabled
pt = ConstructPoint(XCoordinate=0, YCoordinate=0, ZCoordinate=0)  # disabled
xz = XZPlane(Origin=pt)  # disabled
panel_20 = Panel("""9.2
1
1.4""")
yz = YZPlane(Origin=pt)  # disabled
panel_21 = Panel("""12
1
3""")
panel_22 = Panel("""15.54
1
2""")
panel_23 = Panel("""9.6
1
2""")
panel_24 = Panel("""7.2
1
1.4""")
panel_25 = Panel("""15.6
1
2""")
panel_26 = Panel("""1.3
1.48
1""")
panel_27 = Panel("""15.3
1
3
2""")
panel_28 = Panel("""7.08
1
2""")
panel_29 = Panel("""9.2
1.24
2""")
panel_30 = Panel("""6.2
1
1.4""")
panel_31 = Panel("""7.08
1
2""")
panel_32 = Panel("""6.2
1.24
2""")
panel_33 = Panel("""1.8
1.48
1""")
panel_34 = Panel("""1.3
1.72
1""")
panel_35 = Panel("""3
3
2""")
number_slider = Slider(1, range=0..10)
multiplication = Multiplication(A=number_slider, B=3)
一拽架 = Number(multiplication)  # disabled
Y = UnitY(Factor=expr("-x", 一拽架))  # disabled
multiplication_2 = Multiplication(A=panel_27, B=number_slider)
multiplication_3 = Multiplication(A=panel_20, B=number_slider)
multiplication_4 = Multiplication(A=panel_21, B=number_slider)
multiplication_5 = Multiplication(A=panel_22, B=number_slider)
multiplication_6 = Multiplication(A=panel_23, B=number_slider)
multiplication_7 = Multiplication(A=panel_31, B=number_slider)
multiplication_8 = Multiplication(A=panel_24, B=number_slider)
multiplication_9 = Multiplication(A=panel_25, B=number_slider)
multiplication_10 = Multiplication(A=panel_26, B=number_slider)
panel_36 = Panel("十八斗定位点")  # disabled
multiplication_11 = Multiplication(A=panel_28, B=number_slider)
multiplication_12 = Multiplication(A=panel_29, B=number_slider)
panel_37 = Panel("槽升定位点")  # disabled
panel_38 = Panel("正心瓜拱定位点，翘定位点")  # disabled
multiplication_13 = Multiplication(A=panel_30, B=number_slider)
multiplication_14 = Multiplication(A=panel_32, B=number_slider)
multiplication_15 = Multiplication(A=panel_33, B=number_slider)
multiplication_16 = Multiplication(A=panel_34, B=number_slider)
multiplication_17 = Multiplication(A=panel_35, B=number_slider)
panel_39 = Panel("七檩箭楼")  # disabled
panel_41 = Panel("""进深
5攒斗科""")  # disabled
item = ListItem(List=multiplication_3, Index=0, Wrap=True)  # -> Item, Item1, Item2
panel_42 = Panel("""一攒斗科
12斗口""")  # disabled
item_2 = ListItem(List=multiplication_4, Index=0, Wrap=True)  # -> Item, Item1, Item2
item_3 = ListItem(List=multiplication_2, Index=0, Wrap=True)  # -> Item, Item1, Item2, Item3
item_4 = ListItem(List=multiplication_5, Index=0, Wrap=True)  # -> Item, Item1, Item2
item_5 = ListItem(List=multiplication_6, Index=0, Wrap=True)  # -> Item, Item1, Item2
item_6 = ListItem(List=multiplication_8, Index=0, Wrap=True)  # -> Item, Item1, Item2
item_7 = ListItem(List=multiplication_9, Index=0, Wrap=True)  # -> Item, Item1, Item2
panel_43 = Panel("""面阔
2攒斗科
稍间收半攒""")  # disabled
item_8 = ListItem(List=multiplication_10, Index=0, Wrap=True)  # -> Item, Item1, Item2
三才升高 = Number(item_8.Item2)  # disabled
multiplication_18 = Multiplication(A=三才升高, B=0.2)  # disabled
multiplication_19 = Multiplication(A=multiplication_18, B=2)  # disabled
三才升长 = Number(item_8.Item)  # disabled
subtraction = Subtraction(A=三才升长, B=multiplication_19)  # disabled
item_9 = ListItem(List=multiplication_7, Index=0, Wrap=True)  # -> Item, Item1, Item2
panel_44 = Panel("二檩雨搭")  # disabled
item_10 = ListItem(List=multiplication_11, Index=0, Wrap=True)  # -> Item, Item1, Item2
item_11 = ListItem(List=multiplication_12, Index=0, Wrap=True)  # -> Item, Item1, Item2
正心拱长 = Number(item_11.Item)  # disabled
panel_45 = Panel("四檩庑座")  # disabled
item_12 = ListItem(List=multiplication_13, Index=0, Wrap=True)  # -> Item, Item1, Item2; disabled
单才瓜拱长 = Number(item_12.Item)  # disabled
expression = Expression(x=单才瓜拱长, y=subtraction, Expression="(x-y)/2")  # disabled
item_13 = ListItem(List=multiplication_14, Index=0, Wrap=True)  # -> Item, Item1, Item2; disabled
正心拱长_2 = Number(item_13.Item)  # disabled
item_14 = ListItem(List=multiplication_15, Index=0, Wrap=True)  # -> Item, Item1, Item2; disabled
item_15 = ListItem(List=multiplication_16, Index=0, Wrap=True)  # -> Item, Item1, Item2; disabled
槽升高 = Number(item_15.Item2)  # disabled
multiplication_20 = Multiplication(A=槽升高, B=0.2)  # disabled
multiplication_21 = Multiplication(A=multiplication_20, B=2)  # disabled
槽升长 = Number(item_15.Item)  # disabled
subtraction_2 = Subtraction(A=槽升长, B=multiplication_21)  # disabled
expression_2 = Expression(x=正心拱长_2, y=subtraction_2, Expression="(x-y)/2")  # disabled
槽升高_2 = Number(item_15.Item2)  # disabled
multiplication_22 = Multiplication(A=槽升高_2, B=0.2)  # disabled
multiplication_23 = Multiplication(A=multiplication_22, B=2)  # disabled
槽升长_2 = Number(item_15.Item)  # disabled
subtraction_3 = Subtraction(A=槽升长_2, B=multiplication_23)  # disabled
X = UnitX(Factor=expression_2)  # disabled
expression_3 = Expression(x=正心拱长, y=subtraction_3, Expression="(x-y)/2")  # disabled
item_16 = ListItem(List=multiplication_17, Index=0, Wrap=True)  # -> Item, Item1, Item2; disabled
expression_4 = Expression(x=item_16.Item2, y=item_15.Item2, Expression="x-y*(1-2/5)")  # disabled
expression_5 = Expression(x=item_16.Item2, Expression="x*(1-2/5)")  # disabled
Z = UnitZ(Factor=expression_5)  # disabled
expression_6 = Expression(x=item_16.Item2, y=item_15.Item2, Expression="x-y*(1-2/5)")  # disabled
Z_2 = UnitZ(Factor=expression_4)  # disabled
move = Move(Geometry=pt, Motion=Z)  # -> Geometry, Transform; disabled
move_2 = Move(Geometry=move.Geometry, Motion=Z_2)  # -> Geometry, Transform; disabled
move_3 = Move(Geometry=move_2.Geometry, Motion=Y)  # -> Geometry, Transform; disabled
move_4 = Move(Geometry=move_2.Geometry, Motion=X)  # -> Geometry, Transform; disabled
multiplication_24 = Multiplication(A=一拽架, B=2)  # disabled
panel_46 = Panel("桁椀")  # disabled
panel_47 = Panel("""3
2.5""")
num = Number("2")
num_2 = Number("4")
panel_48 = Panel("""四檩三步架再去掉
下檐柱一步架""")  # disabled
subtraction_4 = Subtraction(A=num_2, B=2)
Y_2 = UnitY(Factor=expr("-x", 一拽架))  # disabled
Y_3 = UnitY(Factor=expr("-x", multiplication_24))  # disabled
num_3 = Number("7")
X_2 = UnitX(Factor=expression_3)  # disabled
X_3 = UnitX(Factor=expression)  # disabled
num_4 = Number("5")
Z_3 = UnitZ(Factor=expression_6)  # disabled
num_5 = Number(panel_47)
Z_4 = UnitZ(Factor=item_13.Item2)  # disabled
num_6 = Number("12")
num_7 = Number("4")
Z_5 = UnitZ(Factor=expression_6)  # disabled
Y_4 = UnitY(Factor=一拽架)  # disabled
三才升高_2 = Number(item_8.Item2)  # disabled
三才升高_3 = Number(item_8.Item2)  # disabled
subtraction_5 = Subtraction(A=num_3, B=1)
addition = Addition(A=num, B=subtraction_4)
panel_49 = Panel("正心万拱定位点，昂定位点")  # disabled
panel_50 = Panel("单才瓜拱定位点")  # disabled
panel_51 = Panel("麻叶云定位点")  # disabled
panel_54 = Panel("三才升定位点")  # disabled
multiplication_25 = Multiplication(A=三才升高_2, B=0.2)  # disabled
multiplication_26 = Multiplication(A=三才升高_3, B=0.2)  # disabled
move_5 = Move(Geometry=move.Geometry, Motion=Z_4)  # -> Geometry, Transform; disabled
move_6 = Move(Geometry=move_5.Geometry, Motion=Z_3)  # -> Geometry, Transform; disabled
move_7 = Move(Geometry=move_5.Geometry, Motion=Y_2)  # -> Geometry, Transform; disabled
move_8 = Move(Geometry=move_7.Geometry, Motion=Z_5)  # -> Geometry, Transform; disabled
move_9 = Move(Geometry=move_6.Geometry, Motion=Y_3)  # -> Geometry, Transform; disabled
move_10 = Move(Geometry=move_6.Geometry, Motion=X_2)  # -> Geometry, Transform; disabled
move_11 = Move(Geometry=move_8.Geometry, Motion=X_3)  # -> Geometry, Transform; disabled
move_12 = Move(Geometry=move_5.Geometry, Motion=Y_4)  # -> Geometry, Transform; disabled
panel_55 = Panel("庑座步架")  # disabled
panel_56 = Panel("博脊分位")  # disabled
panel_57 = Panel("箭楼步架")  # disabled
拱 = 拱(
    定位点=move.Geometry,
    长=item_13.Item,
    宽=item_13.Item1,
    高=item_13.Item2,
    中槽宽=item_9.Item1,
    斗口=number_slider,
    槽升长=item_15.Item,
    槽升高=item_15.Item2,
    万三_瓜四_厢五=4,
    拱瓣长=1.3)  # disabled
panel_58 = Panel("一攒斗科")  # disabled
panel_60 = Panel("进深")  # disabled
panel_62 = Panel("正心枋")  # disabled
panel_64 = Panel("""面阔
稍间面阔""")  # disabled
昂 = 昂(
    定位点=move_5.Geometry,
    长=item_3.Item,
    宽=item_3.Item1,
    前高=item_3.Item2,
    中高=item_3.Item3,
    正心拱宽=item_13.Item1,
    斗口=number_slider,
    十八斗宽=item_14.Item1,
    十八斗高=item_14.Item2,
    单才拱高=item_12.Item2,
    单才拱宽=item_12.Item1)  # disabled
麻叶云 = 麻叶云(
    定位点=move_12.Geometry,
    长=item_10.Item,
    宽=item_10.Item1,
    高=item_10.Item2,
    单才拱高=item_12.Item2,
    中槽宽=item_3.Item1,
    斗口=number_slider)  # disabled
panel_66 = Panel("槽升（瓜拱）")  # disabled
升 = 升(定位点=move_4.Geometry, 长=item_15.Item, 宽=item_15.Item1, 高=item_15.Item2, 拱宽=item_13.Item1, 斗口=number_slider, 拱榫位置=3)  # disabled
翘 = 翘(
    定位点=move.Geometry,
    长=item_9.Item,
    宽=item_9.Item1,
    高=item_9.Item2,
    正心拱宽=item_13.Item1,
    大斗高=item_16.Item2,
    斗口=number_slider,
    十八斗宽=item_14.Item1,
    十八斗高=item_14.Item2)  # disabled
multiplication_27 = Multiplication(A=num_6, B=num_7)
multiplication_28 = Multiplication(A=multiplication_27, B=num_4)
division = Division(A=multiplication_28, B=subtraction_5)
multiplication_29 = Multiplication(A=multiplication_27, B=num_5)
大斗 = 大斗(定位点=pt, 长=item_16.Item, 宽=item_16.Item1, 高=item_16.Item2, 正心拱宽=item_13.Item1, 翘宽=item_9.Item1)  # disabled
multiplication_30 = Multiplication(A=multiplication_25, B=2)  # disabled
multiplication_31 = Multiplication(A=multiplication_26, B=2)  # disabled
三才升长_2 = Number(item_8.Item)  # disabled
三才升长_3 = Number(item_8.Item)  # disabled
subtraction_6 = Subtraction(A=三才升长_2, B=multiplication_30)  # disabled
subtraction_7 = Subtraction(A=三才升长_3, B=multiplication_31)  # disabled
厢拱长 = Number(item_6.Item)  # disabled
单才万拱长 = Number(item.Item)  # disabled
panel_70 = Panel(multiplication_27)
panel_71 = Panel(division)
num_8 = Number("47.5")
panel_72 = Panel(multiplication_28)
num_9 = Number("15")
item_17 = ListItem(List=multiplication_29, Index=0, Wrap=True)  # -> Item, Item1
panel_73 = Panel(multiplication_29)
mirror = Mirror(Geometry=升, Plane=yz)  # -> Geometry, Transform; disabled
multiplication_32 = Multiplication(A=num_8, B=addition)
addition_2 = Addition(A=multiplication_32, B=num_9)
expression_7 = Expression(x=厢拱长, y=subtraction_6, Expression="(x-y)/2")  # disabled
expression_8 = Expression(x=单才万拱长, y=subtraction_7, Expression="(x-y)/2")  # disabled
panel_75 = Panel("十八斗（翘）")  # disabled
number_slider_2 = Slider(80, range=0..1000)
number_slider_3 = Slider(144, range=0..1000)
升_2 = 升(定位点=move_3.Geometry, 长=item_14.Item, 宽=item_14.Item1, 高=item_14.Item2, 拱宽=number_slider, 斗口=number_slider, 拱榫位置=2)  # disabled
拱_2 = 拱(
    定位点=move_5.Geometry,
    长=item_11.Item,
    宽=item_11.Item1,
    高=item_11.Item2,
    中槽宽=item_3.Item1,
    斗口=number_slider,
    槽升长=item_15.Item,
    槽升高=item_15.Item2,
    万三_瓜四_厢五=3,
    拱瓣长=1.3)  # disabled
multiplication_33 = Multiplication(A=一拽架, B=2)  # disabled
multiplication_34 = Multiplication(A=一拽架, B=2)  # disabled
mirror_2 = Mirror(Geometry=升_2, Plane=xz)  # -> Geometry, Transform; disabled
panel_77 = Panel("拽枋")  # disabled
num_10 = Number(num_8)
三才升高_4 = Number(item_8.Item2)  # disabled
multiplication_35 = Multiplication(A=number_slider_3, B=1.5)
number_slider_4 = Slider(1, range=1..10)
num_11 = Number(division)
panel_78 = Panel("明间数")  # disabled
Y_5 = UnitY(Factor=expr("-x", multiplication_33))  # disabled
X_4 = UnitX(Factor=expression_7)  # disabled
Y_6 = UnitY(Factor=expr("-x", 一拽架))  # disabled
X_5 = UnitX(Factor=expression_8)  # disabled
multiplication_36 = Multiplication(A=三才升高_4, B=0.2)  # disabled
Y_7 = UnitY(Factor=multiplication_34)  # disabled
Z_6 = UnitZ(Factor=item_3.Item3)  # disabled
panel_79 = Panel("槽升（万拱）")  # disabled
升_3 = 升(定位点=move_10.Geometry, 长=item_15.Item, 宽=item_15.Item1, 高=item_15.Item2, 拱宽=item_11.Item1, 斗口=number_slider, 拱榫位置=3)  # disabled
series = Series(Start=0, Step=multiplication_28, Count=2)
expression_9 = Expression(x=number_slider_3, y=number_slider_4, Expression="x*(y+3)")
expression_10 = Expression(x=multiplication_28, y=number_slider_2, Expression="x+(y*2)")
Z_7 = UnitZ(Factor=expression_6)  # disabled
Z_8 = UnitZ(Factor=expression_6)  # disabled
num_12 = Number(division)
num_13 = Number(division)
Y_8 = UnitY(Factor=1)
X_6 = UnitX(Factor=1)
num_14 = Number(division)
Z_9 = UnitZ(Factor=expression_6)  # disabled
num_15 = Number(item_17.Item1)
拱_3 = 拱(
    定位点=move_7.Geometry,
    长=item_12.Item,
    宽=item_12.Item1,
    高=item_12.Item2,
    中槽宽=item_3.Item1,
    斗口=number_slider,
    万三_瓜四_厢五=4,
    拱瓣长=1.3)  # disabled
series_2 = Series(Start=0, Step=division, Count=num_3)
panel_80 = Panel("厢拱定位点")  # disabled
panel_81 = Panel("单才万拱定位点")  # disabled
panel_82 = Panel("""蚂蚱头定位
正心枋定位""")  # disabled
series_3 = Series(Start=num_10, Step=num_10, Count=num)
series_4 = Series(Start=num_10, Step=num_10, Count=subtraction_4)
panel_87 = Panel("定位点")
multiplication_37 = Multiplication(A=multiplication_36, B=2)  # disabled
三才升长_4 = Number(item_8.Item)  # disabled
pt_2 = ConstructPoint(XCoordinate=0, YCoordinate=0, ZCoordinate=0)
move_13 = Move(Geometry=move_5.Geometry, Motion=Z_6)  # -> Geometry, Transform; disabled
枋 = 枋(定位点=move_13.Geometry, 长=item_5.Item, 宽=item_5.Item1, 高=item_5.Item2, 中槽宽=item_7.Item1, 斗口=number_slider, 燕尾榫位置=2)  # disabled
蚂蚱头 = 蚂蚱头(
    定位点=move_13.Geometry,
    长=item_7.Item,
    宽=item_7.Item1,
    高=item_7.Item2,
    正心枋宽=item_5.Item1,
    斗口=number_slider,
    十八斗宽=item_14.Item1,
    十八斗高=item_14.Item2,
    单才拱高=item.Item2)  # disabled
move_14 = Move(Geometry=move_13.Geometry, Motion=Y_5)  # -> Geometry, Transform; disabled
move_15 = Move(Geometry=move_14.Geometry, Motion=Z_8)  # -> Geometry, Transform; disabled
move_16 = Move(Geometry=move_15.Geometry, Motion=X_4)  # -> Geometry, Transform; disabled
move_17 = Move(Geometry=move_13.Geometry, Motion=Y_6)  # -> Geometry, Transform; disabled
move_18 = Move(Geometry=move_17.Geometry, Motion=Z_7)  # -> Geometry, Transform; disabled
move_19 = Move(Geometry=move_18.Geometry, Motion=X_5)  # -> Geometry, Transform; disabled
series_5 = Series(Start=0, Step=item_17.Item, Count=expr("x+1", number_slider_4))
move_20 = Move(Geometry=move_13.Geometry, Motion=Z_9)  # -> Geometry, Transform; disabled
move_21 = Move(Geometry=move_20.Geometry, Motion=Y_7)  # -> Geometry, Transform; disabled
vec = Vector(expr("-x", X_6))
multiplication_38 = Multiplication(A=vec, B=multiplication_35)
move_22 = Move(Geometry=pt_2, Motion=multiplication_38)  # -> Geometry, Transform
multiplication_39 = Multiplication(A=vec, B=num_13)
vec_2 = Vector(expr("-x", Y_8))
multiplication_40 = Multiplication(A=vec_2, B=number_slider_2)
move_23 = Move(Geometry=pt_2, Motion=multiplication_40)  # -> Geometry, Transform
multiplication_41 = Multiplication(A=vec, B=num_15)
multiplication_42 = Multiplication(A=vec, B=num_14)
multiplication_43 = Multiplication(A=vec_2, B=num_12)
vec_3 = Vector(X_6)
multiplication_44 = Multiplication(A=vec_3, B=num_13)
multiplication_45 = Multiplication(A=vec_3, B=num_15)
multiplication_46 = Multiplication(A=vec_3, B=num_14)
multiplication_47 = Multiplication(A=vec_3, B=series_5)
vec_4 = Vector(Y_8)
multiplication_48 = Multiplication(A=vec_4, B=multiplication_28)
multiplication_49 = Multiplication(A=vec_4, B=series)
multiplication_50 = Multiplication(A=vec_4, B=num_12)
multiplication_51 = Multiplication(A=vec_4, B=series_2)
mirror_3 = Mirror(Geometry=升_3, Plane=yz)  # -> Geometry, Transform; disabled
multiplication_52 = Multiplication(A=vec_4, B=series_3)
multiplication_53 = Multiplication(A=vec_4, B=num_9)
multiplication_54 = Multiplication(A=vec_4, B=series_4)
subtraction_8 = Subtraction(A=三才升长_4, B=multiplication_37)  # disabled
厢拱长_2 = Number(item_6.Item)  # disabled
multiplication_55 = Multiplication(A=vec_4, B=num_11)
panel_88 = Panel("挑檐枋")  # disabled
line = LineSDL(Start=move_22.Geometry, Direction=vec_3, Length=expression_9)
move_24 = Move(Geometry=line, Motion=multiplication_49)  # -> Geometry, Transform
item_18 = ListItem(List=move_24.Geometry, Index=1, Wrap=True)
item_19 = ListItem(List=move_24.Geometry, Index=0, Wrap=True)  # -> Item1, Item
line_2 = LineSDL(Start=move_23.Geometry, Direction=vec_4, Length=expression_10)
move_25 = Move(Geometry=line_2, Motion=multiplication_48)  # -> Geometry, Transform
move_26 = Move(Geometry=move_25.Geometry, Motion=multiplication_47)  # -> Geometry, Transform
item_20 = ListItem(List=move_26.Geometry, Index=0, Wrap=True)  # -> Item1, Item
move_27 = Move(Geometry=item_20.Item, Motion=multiplication_39)  # -> Geometry, Transform
move_28 = Move(Geometry=item_20.Item1, Motion=multiplication_44)  # -> Geometry, Transform
move_29 = Move(Geometry=line_2, Motion=multiplication_47)  # -> Geometry, Transform
item_21 = ListItem(List=move_29.Geometry, Index=0, Wrap=True)  # -> Item1, Item
move_30 = Move(Geometry=item_21.Item, Motion=multiplication_41)  # -> Geometry, Transform
move_31 = Move(Geometry=move_30.Geometry, Motion=multiplication_42)  # -> Geometry, Transform
move_32 = Move(Geometry=item_21.Item1, Motion=multiplication_45)  # -> Geometry, Transform
move_33 = Move(Geometry=move_32.Geometry, Motion=multiplication_46)  # -> Geometry, Transform
move_34 = Move(Geometry=item_19.Item, Motion=multiplication_43)  # -> Geometry, Transform
move_35 = Move(Geometry=item_19.Item1, Motion=multiplication_50)  # -> Geometry, Transform
move_36 = Move(Geometry=item_18, Motion=multiplication_52)  # -> Geometry, Transform
item_22 = ListItem(List=move_36.Geometry, Index=-1, Wrap=True)
move_37 = Move(Geometry=line, Motion=multiplication_51)  # -> Geometry, Transform
move_38 = Move(Geometry=item_22, Motion=multiplication_53)  # -> Geometry, Transform
move_39 = Move(Geometry=move_38.Geometry, Motion=multiplication_54)  # -> Geometry, Transform
item_23 = ListItem(List=move_39.Geometry, Index=-1, Wrap=True)
pt_3 = Point(pt_2)
move_40 = Move(Geometry=item_23, Motion=multiplication_55)  # -> Geometry, Transform
升_4 = 升(定位点=move_11.Geometry, 长=item_8.Item, 宽=item_8.Item1, 高=item_8.Item2, 拱宽=item_12.Item1, 斗口=number_slider, 拱榫位置=4)  # disabled
python = PythonScript(x=Slider(1, range=1..6), y=Slider(5, range=1..6), z=pt_3)  # -> out, a, 高度
#   port x: The number of circles. (integer)
# ---------- python: Python ----------
import rhinoscriptsyntax as rs

if x == 1:
    a = rs.VectorUnitize( [1,0,0] )
elif x == 2:
    a = rs.VectorUnitize( [0,1,0] )
elif x == 3:
    a = rs.VectorUnitize( [-1,0,0] )
elif x == 4:
    a = rs.VectorUnitize( [0,-1,0] )
elif x == 5:
    a = rs.VectorUnitize( [0,0,1] )
elif x == 6:
    a = rs.VectorUnitize( [0,0,-1] )

高度 = a * y

rs.MoveObject(z,高度)
# ---------- end python ----------
expression_11 = Expression(x=厢拱长_2, y=subtraction_8, Expression="(x-y)/2")  # disabled
拱_4 = 拱(定位点=move_17.Geometry, 长=item.Item, 宽=item.Item1, 高=item.Item2, 中槽宽=item_7.Item1, 斗口=number_slider, 万三_瓜四_厢五=3, 拱瓣长=1.3)  # disabled
shift = ShiftList(List=move_26.Geometry, Shift=-1, Wrap=True)
move_41 = Move(Motion=Vector(0, 0, 10))  # -> Geometry, Transform
pt_4 = Point(python.高度)
multiplication_56 = Multiplication(A=一拽架, B=2)  # disabled
panel_91 = Panel(python.a)
mirror_4 = Mirror(Geometry=升_4, Plane=yz)  # -> Geometry, Transform; disabled
merge = Merge(Data1=move_29.Geometry, Data2=move_32.Geometry, Data3=move_30.Geometry, Data4=move_37.Geometry)
merge_2 = Merge(
    Data1=move_33.Geometry,
    Data2=move_31.Geometry,
    Data3=move_35.Geometry,
    Data4=move_34.Geometry,
    Data5=move_28.Geometry,
    Data6=move_27.Geometry,
    Data7=move_40.Geometry)
merge_3 = Merge(Data1=move_26.Geometry, Data2=item_18, Data3=move_36.Geometry, Data4=move_38.Geometry, Data5=move_39.Geometry)
multiplication_57 = Multiplication(A=一拽架, B=2)  # disabled
python_2 = PythonScript()  # -> out, a
# ---------- python_2: Python ----------
import rhinoscriptsyntax as rs

plane = rs.WorldXYPlane()

a = rs.AddCircle( plane, 5.0 )
# ---------- end python_2 ----------
Y_9 = UnitY(Factor=expr("-x", multiplication_56))  # disabled
Y_10 = UnitY(Factor=expr("-x", 一拽架))  # disabled
X_7 = UnitX(Factor=expression_11)  # disabled
mirror_5 = Mirror(Geometry=拱_4, Plane=xz)  # -> Geometry, Transform; disabled
panel_93 = Panel("十八斗（昂）")  # disabled
Y_11 = UnitY(Factor=multiplication_57)  # disabled
升_5 = 升(定位点=move_9.Geometry, 长=item_14.Item, 宽=item_14.Item1, 高=item_14.Item2, 拱宽=number_slider, 斗口=number_slider, 拱榫位置=2)  # disabled
Z_10 = UnitZ(Factor=item_3.Item3)  # disabled
Z_11 = UnitZ(Factor=expression_6)  # disabled
panel_94 = Panel("挑檐枋定位点")  # disabled
panel_95 = Panel("拽枋定位点")  # disabled
entwine = Entwine(Branch00=move_24.Geometry, Branch01=move_29.Geometry, FlattenInputs=True)
panel_97 = Panel("""撑头木定位
正心枋定位""")  # disabled
split = SplitList(List=shift, Index=2)  # -> ListA, ListB
item_24 = ListItem(List=move_39.Geometry, Index=-1, Wrap=True)
merge_4 = Merge(Data1=move_33.Geometry, Data2=move_31.Geometry)
merge_5 = Merge(Data1=move_34.Geometry, Data2=move_35.Geometry)
multiplication_58 = Multiplication(A=python.a, B=Slider(10, range=0..10))
merge_6 = Merge(Data1=move_32.Geometry, Data2=move_30.Geometry)
拱_5 = 拱(
    定位点=move_14.Geometry,
    长=item_6.Item,
    宽=item_6.Item1,
    高=item_6.Item2,
    中槽宽=item_7.Item1,
    斗口=number_slider,
    万三_瓜四_厢五=5,
    拱瓣长=1.5)  # disabled
move_42 = Move(Geometry=move_13.Geometry, Motion=Z_10)  # -> Geometry, Transform; disabled
撑头木 = 撑头木(
    定位点=move_42.Geometry,
    长=item_4.Item,
    宽=item_4.Item1,
    高=item_4.Item2,
    正心枋宽=item_5.Item1,
    斗口=number_slider,
    十八斗宽=item_14.Item1,
    十八斗高=item_14.Item2,
    单才拱高=item.Item2)  # disabled
枋_2 = 枋(定位点=move_42.Geometry, 长=item_5.Item, 宽=item_5.Item1, 高=item_5.Item2, 中槽宽=item_7.Item1, 斗口=number_slider, 燕尾榫位置=2)  # disabled
move_43 = Move(Geometry=move_42.Geometry, Motion=Y_9)  # -> Geometry, Transform; disabled
枋_3 = 枋(定位点=move_43.Geometry, 长=item_5.Item, 宽=item_5.Item1, 高=item_5.Item2, 斗口=number_slider, 燕尾榫=item_5.Item1, 燕尾榫位置=2)  # disabled
move_44 = Move(Geometry=move_42.Geometry, Motion=Y_10)  # -> Geometry, Transform; disabled
枋_4 = 枋(定位点=move_44.Geometry, 长=item_5.Item, 宽=item_5.Item1, 高=item_5.Item2, 中槽宽=item_7.Item1, 斗口=number_slider, 燕尾榫位置=2)  # disabled
mirror_6 = Mirror(Geometry=枋_4, Plane=xz)  # -> Geometry, Transform; disabled
item_25 = ListItem(List=move_37.Geometry, Index=3, Wrap=True)
move_45 = Move(Geometry=move_42.Geometry, Motion=Y_11)  # -> Geometry, Transform; disabled
move_46 = Move(Geometry=move_45.Geometry, Motion=Z_11)  # -> Geometry, Transform; disabled
move_47 = Move(Geometry=move_46.Geometry, Motion=X_7)  # -> Geometry, Transform; disabled
panel_99 = Panel("井口枋")  # disabled
panel_100 = Panel("厢拱（外拽）")  # disabled
merge_7 = Merge(Data1=move_27.Geometry, Data2=move_28.Geometry)
merge_8 = Merge(Data1=move_35.Geometry, Data2=move_40.Geometry)
bang = ExplodeTree(Data=entwine)  # -> Branch0, Branch1
panel_101 = Panel("十八斗（蚂蚱头）")  # disabled
升_6 = 升(定位点=move_21.Geometry, 长=item_14.Item, 宽=item_14.Item1, 高=item_14.Item2, 拱宽=number_slider, 斗口=number_slider, 拱榫位置=0)  # disabled
panel_102 = Panel("中心轴线")  # disabled
panel_103 = Panel("檐柱轴线（进深）")  # disabled
panel_104 = Panel("檐柱轴线（面阔）")  # disabled
panel_105 = Panel("梁架轴线")  # disabled
panel_106 = Panel("山柱轴线")  # disabled
panel_107 = Panel("金柱轴线")  # disabled
crv = Curve(merge_6)
crv_2 = Curve(bang.Branch0)
crv_3 = Curve(merge_4)
crv_4 = Curve(bang.Branch1)
crv_5 = Curve(item_25)
crv_6 = Curve(merge_5)
crv_7 = Curve(move_38.Geometry)
crv_8 = Curve(split.ListA)
crv_9 = Curve(merge_7)
crv_10 = Curve(split.ListB)
crv_11 = Curve(merge_8)
multiplication_59 = Multiplication(A=一拽架, B=2)  # disabled
crv_12 = Curve(item_24)
item_26 = ListItem(List=crv_6, Index=0, Wrap=True)  # -> Item, Item1
拱_6 = 拱(
    定位点=move_14.Geometry,
    长=item_6.Item,
    宽=item_6.Item1,
    高=item_6.Item2,
    中槽宽=item_7.Item1,
    斗口=number_slider,
    万三_瓜四_厢五=5,
    拱瓣长=1.5)  # disabled
Y_12 = UnitY(Factor=multiplication_59)  # disabled
item_27 = ListItem(List=crv_11, Index=0, Wrap=True)  # -> Item, Item1
Z_12 = UnitZ(Factor=item_3.Item3)  # disabled
panel_115 = Panel("三才升（厢拱）")  # disabled
升_7 = 升(定位点=move_16.Geometry, 长=item_8.Item, 宽=item_8.Item1, 高=item_8.Item2, 拱宽=item_12.Item1, 斗口=number_slider, 拱榫位置=4)  # disabled
panel_116 = Panel("井口枋定位点")  # disabled
panel_117 = Panel("""桁椀定位
正心枋定位""")  # disabled
panel_118 = Panel("檐柱（角）")  # disabled
ccx = CurveCurve(CurveA=graft(crv_3), CurveB=crv_5)  # -> simplify(flatten(Points)), ParamsA, ParamsB
ccx_2 = CurveCurve(CurveA=graft(crv_2), CurveB=crv_3)  # -> simplify(flatten(Points)), ParamsA, ParamsB
ccx_3 = CurveCurve(CurveA=graft(crv_6), CurveB=crv)  # -> simplify(flatten(Points)), ParamsA, ParamsB
panel_119 = Panel("檐柱")  # disabled
panel_120 = Panel("金柱")  # disabled
ccx_4 = CurveCurve(CurveA=graft(crv_3), CurveB=crv_6)  # -> simplify(flatten(Points)), ParamsA, ParamsB
panel_121 = Panel("山柱")  # disabled
panel_122 = Panel("金柱（角）")  # disabled
ccx_5 = CurveCurve(CurveA=graft(crv_2), CurveB=crv)  # -> simplify(flatten(Points)), ParamsA, ParamsB
ccx_6 = CurveCurve(CurveA=graft(crv_2), CurveB=crv_4)  # -> simplify(flatten(Points)), ParamsA, ParamsB
ccx_7 = CurveCurve(CurveA=crv_4, CurveB=item_26.Item)  # -> simplify(flatten(Points)), ParamsA, ParamsB
ccx_8 = CurveCurve(CurveA=crv, CurveB=crv_5)  # -> simplify(flatten(Points)), ParamsA, ParamsB
move_48 = Move(Geometry=move_42.Geometry, Motion=Z_12)  # -> Geometry, Transform; disabled
桁椀 = 桁椀(
    定位点=move_48.Geometry,
    长=item_2.Item,
    宽=item_2.Item1,
    高=item_2.Item2,
    正心枋宽=item_5.Item1,
    大斗高=item_16.Item2,
    斗口=number_slider)  # disabled
枋_5 = 枋(定位点=move_48.Geometry, 长=item_5.Item, 宽=item_5.Item1, 高=item_5.Item2, 中槽宽=item_7.Item1, 斗口=number_slider, 燕尾榫位置=2)  # disabled
move_49 = Move(Geometry=move_48.Geometry, Motion=Y_12)  # -> Geometry, Transform; disabled
枋_6 = 枋(定位点=move_49.Geometry, 长=item_5.Item, 宽=item_5.Item1, 高=item_5.Item2, 斗口=number_slider, 燕尾榫=item_5.Item1, 燕尾榫位置=0)  # disabled
ccx_9 = CurveCurve(CurveA=crv_8, CurveB=crv_7)  # -> simplify(flatten(Points)), ParamsA, ParamsB
ccx_10 = CurveCurve(CurveA=crv_12, CurveB=crv_10)  # -> simplify(flatten(Points)), ParamsA, ParamsB
ccx_11 = CurveCurve(CurveA=item_27.Item, CurveB=crv_9)  # -> simplify(flatten(Points)), ParamsA, ParamsB
ccx_12 = CurveCurve(CurveA=item_27.Item1, CurveB=crv_9)  # -> simplify(flatten(Points)), ParamsA, ParamsB
ccx_13 = CurveCurve(CurveA=crv_12, CurveB=crv_8)  # -> simplify(flatten(Points)), ParamsA, ParamsB
ccx_14 = CurveCurve(CurveA=item_27.Item1, CurveB=crv_8)  # -> simplify(flatten(Points)), ParamsA, ParamsB
ccx_15 = CurveCurve(CurveA=crv_9, CurveB=crv_7)  # -> simplify(flatten(Points)), ParamsA, ParamsB
ccx_16 = CurveCurve(CurveA=crv_12, CurveB=crv_9)  # -> simplify(flatten(Points)), ParamsA, ParamsB
ccx_17 = CurveCurve(CurveA=item_27.Item1, CurveB=crv_10)  # -> simplify(flatten(Points)), ParamsA, ParamsB
mirror_7 = Mirror(Geometry=升_7, Plane=yz)  # -> Geometry, Transform; disabled
拱_7 = 拱(
    定位点=move_45.Geometry,
    长=item_6.Item,
    宽=item_6.Item1,
    高=item_6.Item2,
    中槽宽=item_7.Item1,
    斗口=number_slider,
    万三_瓜四_厢五=5,
    拱瓣长=1.5)  # disabled
panel_128 = Panel("厢拱（里拽）")  # disabled
item_28 = ListItem(List=ccx_6.Points, Index=0, Wrap=True)
item_29 = ListItem(List=ccx_6.Points, Index=2, Wrap=True)
panel_129 = Panel("三才升（万拱）")  # disabled
升_8 = 升(定位点=move_19.Geometry, 长=item_8.Item, 宽=item_8.Item1, 高=item_8.Item2, 拱宽=item_12.Item1, 斗口=number_slider, 拱榫位置=4)  # disabled
mirror_8 = Mirror(Geometry=升_8, Plane=yz)  # -> Geometry, Transform; disabled
pt_5 = Point(item_29)
pt_6 = Point(item_28)
mirror_9 = Mirror(Geometry=[升_8, mirror_8.Geometry], Plane=xz)  # -> Geometry, Transform; disabled
升_9 = 升(定位点=move_47.Geometry, 长=item_8.Item, 宽=item_8.Item1, 高=item_8.Item2, 拱宽=item_12.Item1, 斗口=number_slider, 拱榫位置=4)  # disabled
mirror_10 = Mirror(Geometry=升_9, Plane=yz)  # -> Geometry, Transform; disabled
python_3 = PythonScript()  # -> f, a, b, c, d, e, 定位点, 构件
# ---------- python_3: Python ----------
import Rhino as rh
import scriptcontext as sc
import rhinoscriptsyntax as rs
#from decimal import Decimal

def 方向(x):
    if x == '向右':
        return rs.VectorUnitize([1,0,0])
    elif x == '向后':
        return rs.VectorUnitize([0,1,0])
    elif x == '向左':
        return rs.VectorUnitize([-1,0,0])
    elif x == '向前':
        return rs.VectorUnitize([0,-1,0])
    elif x == '向上':
        return rs.VectorUnitize([0,0,1])
    elif x == '向下':
        return rs.VectorUnitize([0,0,-1])

def 线段(定位点,向,长度):
    if isinstance(向,str):
        aspect = 方向(向)
    elif type(向) is rh.Geometry.Vector3d:
        aspect = 向
    起点 = rh.Geometry.Point3d(定位点[0],定位点[1],定位点[2])
    线 = rh.Geometry.Line(起点,aspect,长度)
    return sc.doc.Objects.AddLine(线)

def linetovector(line,unit=False):
    line = rs.coercecurve(line)
    start_point = line.PointAtStart
    end_point = line.PointAtEnd
    vector = end_point-start_point
    if unit:
        vector = vector/vector.Length
    return vector
    
def show_pos(all_pos):
    p_list = []
    for p in all_pos:
        p_list.append(rs.AddPoint(p))
    return p_list

def movepoint(point,distance,向='向上',unit=False,reverse=False):
    起点 = rh.Geometry.Point3d(point[0],point[1],point[2])
    if isinstance(向,str):
        aspect = 方向(向)
    elif type(向) is rh.Geometry.Vector3d:
        aspect = 向
    else:
        aspect = linetovector(向,unit)
        if not unit:
            distance = 1
    if reverse:
        aspect = -aspect
    return 起点+distance*aspect

def MirrorObject(guid,point,面='xy',copy=True):
    if point:
        plane = 面域(point,面)
    form = rh.Geometry.Transform.Mirror(plane)
    return rs.TransformObject(guid, form, copy)

def SplitSurfaceWithCurves(srf, crvs): #this is a SplitSurfaceWithCurves implementation
    brepObj = rs.coercebrep(srf) # gets the RhinoCommon brep object
    face = brepObj.Faces[0]
    splitted = rh.Geometry.BrepFace.Split(face,
        [rs.coercecurve(crv) for crv in crvs],
        0.1) # increast the tolerance to make this faster
    return [face.DuplicateFace(False) for face in splitted.Faces]

def 面域(原点,面='xy'):
    origin = rh.Geometry.Point3d(原点[0],原点[1],原点[2])
    if 面[0] == 'x':
        x = rh.Geometry.Point3d(原点[0]+1,原点[1],原点[2])
    elif 面[0] == 'y':
        x = rh.Geometry.Point3d(原点[0],原点[1]+1,原点[2])
    if 面[1] == 'y':
        y = rh.Geometry.Point3d(原点[0],原点[1]+1,原点[2])
    elif 面[1] == 'z':
        y = rh.Geometry.Point3d(原点[0],原点[1],原点[2]+1)
    return rh.Geometry.Plane(origin,x,y)

def 生成面(原点,长,宽,mode='中心',面='xy',flip=False,reverse=False):
    if mode == '中心':
        x_interval = rh.Geometry.Interval(-长/2,长/2)
        y_interval = rh.Geometry.Interval(-宽/2,宽/2)
    elif mode == '向右':
        x_interval = rh.Geometry.Interval(0,长)
        y_interval = rh.Geometry.Interval(-宽/2,宽/2)
    elif mode == '向后':
        x_interval = rh.Geometry.Interval(-长/2,长/2)
        y_interval = rh.Geometry.Interval(0,宽)
    elif mode == '向左':
        x_interval = rh.Geometry.Interval(-长,0)
        y_interval = rh.Geometry.Interval(-宽/2,宽/2)
    elif mode == '向前':
        x_interval = rh.Geometry.Interval(-长/2,长/2)
        y_interval = rh.Geometry.Interval(-宽,0)
    面 = rh.Geometry.PlaneSurface(面域(原点,面),x_interval,y_interval)
    面 = sc.doc.Objects.AddSurface(面)
    rs.FlipSurface(面,flip)
    if reverse:
        面 = rs.RotateObject(面,原点,180)
    return 面

def 体块(定位点,长,宽,高=None,mode='中心',面='xy',形状='方块',flip=False,输入面=None):
    if 输入面:
        底面 = 输入面
    else:
        if 形状 == '方块':
            底面 = 生成面(定位点,长,宽,mode,面,flip)
        elif 形状 == '圆柱':
            底面 = rh.Geometry.Circle(面域(定位点,面),宽/2)
            底面轮廓 = rh.Geometry.Circle.ToNurbsCurve(底面)
            圆柱 = rh.Geometry.Extrusion.Create(底面轮廓,长,True)
            return sc.doc.Objects.AddExtrusion(圆柱)
    底面 = rs.coercesurface(底面)
    brep = rh.Geometry.Surface.ToBrep(底面)
    edges = rh.Geometry.Brep.DuplicateEdgeCurves(brep)
    底面轮廓 = rh.Geometry.Curve.JoinCurves(edges)[0]
    块 = rh.Geometry.Extrusion.Create(底面轮廓,高,True)
    return sc.doc.Objects.AddExtrusion(块)

def 馒头榫(定位点,榫长,榫径,榫方向='向上',flip=False):
    榫截面 = 生成面(定位点,榫径,榫径,'中心','xy',flip)
    return rs.ExtrudeSurface(榫截面,线段(定位点,榫方向,榫长))

def 直榫(定位点,榫长,榫宽,榫高,榫方向='向左',flip=False):
    榫截面 = 生成面(定位点,榫宽,榫长,榫方向,'xy',flip)
    return rs.ExtrudeSurface(榫截面,线段(定位点,'向上',榫高))

def 燕尾榫(定位点,榫长,榫宽,榫高,榫方向='向左',燕尾比例=9/10,flip=False,一半=None):
    榫头中点 = movepoint(定位点,榫长,榫方向)
    榫宽方向 = rs.VectorRotate(方向(榫方向),90,方向('向上'))
    榫头端点 = movepoint(榫头中点,榫宽/2,榫宽方向)
    榫尾端点 = movepoint(定位点,榫宽*燕尾比例/2,榫宽方向)
    榫头边 = 线段(榫头端点,-榫宽方向,榫宽)
    榫尾边 = 线段(榫尾端点,-榫宽方向,榫宽*燕尾比例)
    if flip:
        榫截面 = rs.AddLoftSrf([榫尾边,榫头边])
    else:
        榫截面 = rs.AddLoftSrf([榫头边,榫尾边])
    if 一半 == '下半':
        榫 = rs.ExtrudeSurface(榫截面,线段(定位点,'向上',榫高/2))
    elif 一半 == '上半':
        rs.MoveObject(榫截面,榫高/2*方向('向上'))
        榫 = rs.ExtrudeSurface(榫截面,线段(定位点,'向上',榫高/2))
    else:
        榫 = rs.ExtrudeSurface(榫截面,线段(定位点,'向上',榫高))
    return 榫

def 回肩(构件位置,操作点,柱径,构件高,构件厚,榫长,回肩长度='1/3',榫型='直榫',燕尾比例=9/10):
    榫宽 = 构件厚/3    
    if 操作点[0] - 构件位置[0] != 0:
        镜像面域 = 'yz'
        工作面长 = 榫长
        工作面宽 = 构件厚
        if 操作点[0] > 构件位置[0]: # 操作点x坐标大于构件中点x坐标，在右
            榫方向 = '向右'
            榫尾点 = movepoint(操作点,榫长,榫方向,reverse=True)
        else: # 操作点在左
            榫方向 = '向左'
            榫尾点 = movepoint(操作点,榫长,榫方向,reverse=True)
        if 榫型 == '直榫':
            榫头 = 直榫(榫尾点,榫宽,榫长,构件高,榫方向,True)
        elif 榫型 == '燕尾榫':
            榫头 = 燕尾榫(榫尾点,榫长,榫宽,构件高,榫方向,燕尾比例,True)
    elif 操作点[1] - 构件位置[1] != 0:
        镜像面域 = 'xz'
        工作面长 = 构件厚
        工作面宽 = 榫长
        if 操作点[1] > 构件位置[1]: # 操作点y坐标大于构件中点x坐标，在上
            榫方向 = '向后'
            榫尾点 = movepoint(操作点,榫长,榫方向,reverse=True)
        else: # 操作点在下
            榫方向 = '向前'
            榫尾点 = movepoint(操作点,榫长,榫方向,reverse=True)
        if 榫型 == '直榫':
            榫头 = 直榫(榫尾点,榫长,榫宽,构件高,榫方向,True)
        elif 榫型 == '燕尾榫':
            榫头 = 燕尾榫(榫尾点,榫长,榫宽,构件高,榫方向,燕尾比例,True)
    工作面 = 生成面(操作点,工作面长,工作面宽,榫方向,'xy',True,True)
    '''肩膀线'''
    柱心 = movepoint(榫尾点,柱径/2,榫方向)
    柱截面 = rs.AddCircle(柱心,柱径/2)
    镜像点 = movepoint(柱心,柱径/2*(1-回肩长度),榫方向,reverse=True)
    肩膀线 = MirrorObject(柱截面,镜像点,镜像面域)
    '''切割'''
    榫截面 = SplitSurfaceWithCurves(工作面,[肩膀线])[1]
    榫截面 = SplitSurfaceWithCurves(榫截面,[柱截面])[1:3]
    榫截面 = [sc.doc.Objects.AddBrep(i) for i in 榫截面]
    削去截面 = rs.BooleanDifference(工作面,榫截面,delete_input=False)
    削去 = rs.ExtrudeSurface(削去截面,rs.AddLine(构件位置,[构件位置[0],构件位置[1],构件位置[2]+构件高]))
    削去 = rs.BooleanDifference(削去,榫头,delete_input=False)
    return 削去

def 不回肩(构件位置,操作点,构件高,构件厚,榫长,榫型='直榫',一半=False,燕尾比例=9/10):
    榫宽 = 构件厚/3
    if 操作点[0] - 构件位置[0] != 0:
        镜像面域 = 'yz'
        工作面长 = 榫长
        工作面宽 = 构件厚
        if 操作点[0] > 构件位置[0]: # 操作点x坐标大于构件中点x坐标，在右
            榫方向 = '向右'
            榫尾点 = movepoint(操作点,榫长,榫方向,reverse=True)
        else: # 操作点在左
            榫方向 = '向左'
            榫尾点 = movepoint(操作点,榫长,榫方向,reverse=True)
        if 榫型 == '直榫':
            榫头 = 直榫(榫尾点,榫宽,榫长,构件高,榫方向,True)
        elif 榫型 == '燕尾榫':
            榫头 = 燕尾榫(榫尾点,榫长,榫宽,构件高,榫方向,燕尾比例,True,一半)
    elif 操作点[1] - 构件位置[1] != 0:
        镜像面域 = 'xz'
        工作面长 = 构件厚
        工作面宽 = 榫长
        if 操作点[1] > 构件位置[1]: # 操作点y坐标大于构件中点x坐标，在上
            榫方向 = '向后'
            榫尾点 = movepoint(操作点,榫长,榫方向,reverse=True)
        else: # 操作点在下
            榫方向 = '向前'
            榫尾点 = movepoint(操作点,榫长,榫方向,reverse=True)
        if 榫型 == '直榫':
            榫头 = 直榫(榫尾点,榫长,榫宽,构件高,榫方向,True)
        elif 榫型 == '燕尾榫':
            榫头 = 燕尾榫(榫尾点,榫长,榫宽,构件高,榫方向,燕尾比例,True,一半)
    工作面 = 生成面(操作点,工作面长,工作面宽,榫方向,'xy',True,True)
    削去 = rs.ExtrudeSurface(工作面,rs.AddLine(构件位置,[构件位置[0],构件位置[1],构件位置[2]+构件高]))
    削去 = rs.BooleanDifference(削去,榫头,delete_input=False)
    return 削去

def 卯(构件位置,操作点,构件高,构件厚,榫长,榫型='直榫',一半=None,燕尾比例=9/10):
    榫宽 = 构件厚/3
    if 操作点[0] - 构件位置[0] != 0:
        镜像面域 = 'yz'
        工作面长 = 榫长
        工作面宽 = 构件厚
        if 操作点[0] > 构件位置[0]: # 操作点x坐标大于构件中点x坐标，在右
            卯方向 = '向左'
        else: # 操作点在左
            卯方向 = '向右'
        if 榫型 == '直榫':
            榫头 = 直榫(操作点,榫宽,榫长,构件高,卯方向,True)
        elif 榫型 == '燕尾榫':
            榫头 = 燕尾榫(操作点,榫长,榫宽,构件高,卯方向,燕尾比例,True,一半)
    elif 操作点[1] - 构件位置[1] != 0:
        镜像面域 = 'xz'
        工作面长 = 构件厚
        工作面宽 = 榫长
        if 操作点[1] > 构件位置[1]: # 操作点y坐标大于构件中点x坐标，在上
            卯方向 = '向前'
        else: # 操作点在下
            卯方向 = '向后'
        if 榫型 == '直榫':
            榫头 = 直榫(操作点,榫长,榫宽,构件高,卯方向,True)
        elif 榫型 == '燕尾榫':
            榫头 = 燕尾榫(操作点,榫长,榫宽,构件高,卯方向,燕尾比例,True,一半)
    return 榫头

def 柱(位置,柱径,柱长,榫长,上榫=True,下榫=True):
    总长 = 柱长
    if 上榫:
        总长 = 总长+榫长
    if 下榫:
        总长 = 总长+榫长
        位置 = movepoint(位置,榫长,'向下')
    柱身 = 体块(位置,总长,柱径,形状='圆柱')
    '''馒头榫'''
    榫径 = 柱径/3
    柱顶面 = rs.ExtractSurface(柱身,2,copy=True)
    柱底面 = rs.ExtractSurface(柱身,1,copy=True)
    if 上榫:
        顶中心 = rs.SurfaceAreaCentroid(柱顶面)[0]
        上榫 = 馒头榫(顶中心,榫长,榫径,'向下')
        上榫部分 = rs.ExtrudeSurface(柱顶面,线段(顶中心,'向下',榫长))
        上榫削去 = rs.BooleanDifference(上榫部分,上榫,delete_input=False)
        柱身 = rs.BooleanDifference(柱身,上榫削去,delete_input=False)
    if 下榫:
        底中心 = rs.SurfaceAreaCentroid(柱底面)[0]
        下榫 = 馒头榫(底中心,榫长,榫径,'向上',True)
        下榫部分 = rs.ExtrudeSurface(柱底面,线段(底中心,'向上',榫长))
        下榫削去 = rs.BooleanDifference(下榫部分,下榫,delete_input=False)
        柱身 = rs.BooleanDifference(柱身,下榫削去,delete_input=False)
    return 柱身

def 枋(位置,长,高,厚,左端=None,右端=None,方向='面阔'):
    枋身 = 体块(位置,长,厚,高)
    if 方向 == '进深':
        rs.RotateObject(枋身,位置,90)
    '''直榫'''
    左面 = rs.ExtractSurface(枋身,3,copy=True)
    右面 = rs.ExtractSurface(枋身,1,copy=True)
    if 左端:
        左边 = rs.DuplicateEdgeCurves(左面)[2]
        左点 = rs.CurveMidPoint(左边)
        if 左端['榫型'] == '直榫':
            左榫削去 = 回肩(位置,左点,左端['柱径'],高,厚,左端['榫长'],左端['回肩'],'直榫')
            枋身 = rs.BooleanDifference(枋身,左榫削去,delete_input=False)
        elif 左端['榫型'] == '燕尾榫':
            if 左端.has_key('柱径'):
                左榫削去 = 回肩(位置,左点,左端['柱径'],高,厚,左端['榫长'],左端['回肩'],'燕尾榫')
            else:
                if not 左端.has_key('一半'):
                    左榫削去 = 不回肩(位置,左点,高,厚,左端['榫长'],'燕尾榫')
                else:
                    左榫削去 = 不回肩(位置,左点,高,厚,左端['榫长'],'燕尾榫',左端['一半'])
        elif 左端['榫型'] == '燕尾卯':
            if 左端.has_key('一半'):
                左榫削去 = 卯(位置,左点,高,厚,左端['榫长'],'燕尾榫',左端['一半'])
            else:
                左榫削去 = 卯(位置,左点,高,厚,左端['榫长'],'燕尾榫')
        枋身 = rs.BooleanDifference(枋身,左榫削去,delete_input=False)
    if 右端:
        右边 = rs.DuplicateEdgeCurves(右面)[1]
        右点 = rs.CurveMidPoint(右边)
        if 右端['榫型'] == '直榫':
            右榫削去 = 回肩(位置,右点,右端['柱径'],高,厚,右端['榫长'],右端['回肩'],'直榫')
        elif 右端['榫型'] == '燕尾榫':
            if 右端.has_key('柱径'):
                右榫削去 = 回肩(位置,右点,右端['柱径'],高,厚,右端['榫长'],右端['回肩'],'燕尾榫')
            else:
                if not 右端.has_key('一半'):
                    右榫削去 = 不回肩(位置,右点,高,厚,右端['榫长'],'燕尾榫')
                else:
                    右榫削去 = 不回肩(位置,右点,高,厚,右端['榫长'],'燕尾榫',右端['一半'])
        elif 右端['榫型'] == '燕尾卯':
            if 右端.has_key('一半'):
                右榫削去 = 卯(位置,右点,高,厚,右端['榫长'],'燕尾榫',右端['一半'])
            else:
                右榫削去 = 卯(位置,右点,高,厚,右端['榫长'],'燕尾榫')
        枋身 = rs.BooleanDifference(枋身,右榫削去,delete_input=False)
    return 枋身

def 斗(位置,长,宽,高,面阔槽=None,进深槽=None,刻半=False):
    斗 = 体块(位置,长,宽,高)
    斗耳高 = 2/5*高
    斗腰高 = 1/5*高
    斗底高 = 2/5*高
    切割块 = []
    边 = rs.DuplicateEdgeCurves(斗)
    '''面阔槽'''
    切割块.append(体块(rs.CurveMidPoint(边[6]),面阔槽,斗耳高,-长,'向前','yz'))
    '''进深槽'''
    if 进深槽:
        if 刻半:
            切割块.append(体块(rs.CurveMidPoint(边[2]),进深槽,斗耳高/2,-宽,'向下','xz'))
            '''刻半'''
            切割块.append(体块(rs.CurveMidPoint(边[2]),进深槽,斗耳高,-(宽-正心拱宽)/4,'向下','xz'))
            切割块.append(体块(rs.CurveMidPoint(边[9]),进深槽,斗耳高,(宽-正心拱宽)/4,'向下','xz'))
        else:
            切割块.append(体块(rs.CurveMidPoint(边[2]),进深槽,斗耳高,-宽,'向下','xz'))
    '''斗底'''
    底边 = [边[0],边[4],边[7],边[10]]
    for c in range(4):
        if c == 3:
            nc = 0
        else:
            nc = c+1
        点 = rs.CurveEndPoint(底边[c])
        切割面 = rs.AddPolyline([点,movepoint(点,斗底高,'向上'),movepoint(点,斗腰高,底边[c],unit=True,reverse=True),点])
        切割面 = rs.AddPlanarSrf(切割面)
        切割面 = rs.ExtrudeSurface(切割面,底边[nc])
        切割块.append(切割面)
    return rs.BooleanDifference(斗,切割块,False)

def 拱(位置,长,宽,高):
    拱 = 体块(位置,长,宽,高)
    return 拱

def 昂(位置,长,宽,高):
    昂 = 体块(位置,宽,长,高)
    return 昂

def 加举(举数):
    dic = {'一':'1','二':'2','三':'3','四':'4','五':'5','六':'6','七':'7','八':'8','九':'9'}
    for k,v in dic.items():
        举数 = 举数.replace(k,v)
    举数 = '0.'+举数
#    举数 = Decimal(int(举数)/100).quantize(Decimal('0.00'))
    举数 = round(float(举数),2)
    return 举数

丈 = '*100'
尺 = '*10'
寸 = '*1'
厘 = '*0.1'
斗口 = 4
层高 = 80
檩数 = 7
攒斗科 = 12*斗口
面阔 = 3*攒斗科
稍间面阔 = 面阔-0.5*攒斗科
进深 = 5*攒斗科
步架 = 进深/(檩数-1)
拽架 = 3*斗口
斗拱层高 = 2*斗口
#print(攒斗科,面阔,稍间面阔,进深,步架)

'''斗科'''
柱头科大斗长 = 4*斗口
平身科大斗长 = 3*斗口
大斗宽 = 3*斗口
大斗高 = 斗拱层高

正心瓜拱长 = 6.2*斗口
正心万拱长 = 9.2*斗口
正心拱宽 = 1.24*斗口
正心拱高 = 斗拱层高

翘长 = 7.1*斗口
柱头科翘宽 = 2*斗口
翘高 = 斗拱层高

梁头厚 = 4*斗口
昂长 = 15.3*斗口
昂宽 = 柱头科翘宽
柱头科昂宽 = 昂宽+(梁头厚/2)/2
昂前高 = 3*斗口
昂中高 = 斗拱层高

升高 = 1/2*斗拱层高
升宽 = 1.48*斗口
升底宽 = 升宽-2*1/5*升高

'''下檐一斗三升'''
檐柱长 = 3*层高
檐柱径 = 4*斗口
檐柱榫长 = round(檐柱径/10*3,1)
#print(檐柱长, 檐柱径, 檐柱榫长)

坐斗枋长 = 面阔
坐斗枋宽 = 3*斗口
坐斗枋高 = 2*斗口
坐斗枋榫长 = round(坐斗枋宽/10*3,1)
#print(坐斗枋长, 坐斗枋宽, 坐斗枋高, 坐斗枋榫长)

后檐金柱长 = 檐柱长+坐斗枋高+3/5*大斗高
后檐金柱径 = 檐柱径
后檐金柱榫长 = round(后檐金柱径/10*3,1)
#print(后檐金柱长, 后檐金柱径, 后檐金柱榫长)

前檐金柱长 = 402.8 # 修改：见sketchup，总长不变
前檐金柱径 = 檐柱径+2+int(前檐金柱长/100*1)
前檐金柱榫长 = round(前檐金柱径/10*3,1)
#print(前檐金柱长, 前檐金柱径, 前檐金柱榫长)

承重长 = 进深
承重高 = 檐柱径
承重厚 = 承重高-2
#print(承重长,承重高,承重厚)

正心桁径 = 3.5*斗口
挑檐桁径 = 正心桁径-2

挑檐承重长 = 进深+步架+2*拽架+挑檐桁径 # 修改:一拽架 -> 两拽架，见庑座七架梁和sketchup
挑檐承重高 = 5*斗口 # 修改:承重高 -> 庑座七架梁高
挑檐承重厚 = 承重厚
挑檐承重桁椀高 = 2
#print(挑檐承重长,挑檐承重高,挑檐承重厚,挑檐承重桁椀高)

正心枋高 = 2*斗口
正心枋榫长 = 正心枋高/2
正心枋长 = 面阔-挑檐承重厚+2*正心枋榫长 
包掩 = 0.6
正心枋厚 = 1*斗口
平水 = 斗口 # 原文没有
#print(正心枋长,正心枋高,正心枋厚,正心枋榫长)

'''上檐斗口单昂'''
桐柱长 = 前檐金柱长-后檐金柱长-(挑檐承重高+挑檐承重桁椀高)
桐柱径 = 檐柱径
桐柱榫长 = round(桐柱径/10*3,1)
#print(桐柱长,桐柱径,桐柱榫长)

后檐金柱额枋榫长 = 桐柱径/4
后檐金柱额枋长 = 面阔-桐柱径+2*后檐金柱额枋榫长
前檐额枋榫长 = 前檐金柱径/4
前檐额枋长 = 面阔-前檐金柱径+2*前檐额枋榫长
后檐檐柱额枋榫长 = 檐柱径/4
后檐檐柱额枋长 = 面阔-檐柱径+2*后檐檐柱额枋榫长
额枋高 = 4.5*斗口
额枋厚 = 7/10*额枋高
#print(后檐金柱额枋长,额枋高,额枋厚,后檐金柱额枋榫长)
#print(前檐额枋长,额枋高,额枋厚,前檐额枋榫长)
#print(后檐檐柱额枋长,额枋高,额枋厚,后檐檐柱额枋榫长)

柁头 = 正心桁径 # 原文没有
七架梁长 = 进深+4*拽架+0.5*升底宽/2+2*柁头 # 修改：两头共出两拽架->四拽架（斗口单昂变成单翘单昂），原文无出头，原文斗底宽有误
七架梁高 = 7*斗口
七架梁厚 = 4.5*斗口
七架梁头厚 = 4*斗口
#print(七架梁长,七架梁高,七架梁厚)

五架梁高 = 七架梁头厚
五架梁厚 = 五架梁高*0.8

下金柁墩长 = 2*柁头
下金柁墩高 = (1*步架+2*拽架)*加举('五')-七架梁高 # 原文不用此构件（一拽架不够高）
下金柁墩厚 = 五架梁厚*0.8
#print(下金柁墩长,下金柁墩高,下金柁墩厚)

'''柱网定位点'''
前檐金柱位置 = [0,0,0]
后檐金柱位置 = [0,1*进深,0] # 原文没有此构件
后檐柱位置 = [0,1*(步架+进深),0]
下层承重位置 = [0,1/2*承重长,层高]
中层承重位置 = [0,1/2*承重长,2*层高]
后下檐坐斗枋位置 = [1/2*(坐斗枋长+坐斗枋榫长)-坐斗枋榫长,1*(步架+进深),檐柱长]
一斗三升柱头科位置 = [0,1*(步架+进深),檐柱长+坐斗枋高]
挑檐承重位置 = [0,1/2*挑檐承重长,后檐金柱长]
桐柱位置 = [0,1*进深,后檐金柱长+挑檐承重高+挑檐承重桁椀高]
后檐金柱额枋位置 = [1/2*面阔,1*进深,前檐金柱长-额枋高]
后檐檐柱额枋位置 = [1/2*面阔,1*(步架+进深),檐柱长-额枋高]
前檐额枋位置 = [1/2*面阔,0,前檐金柱长-额枋高]
后上檐坐斗枋位置 = [1/2*(坐斗枋长+坐斗枋榫长)-坐斗枋榫长,1*进深,前檐金柱长]
前上檐坐斗枋位置 = [1/2*(坐斗枋长+坐斗枋榫长)-坐斗枋榫长,0,前檐金柱长]
后檐檐柱正心枋位置 = [1/2*面阔,1*(步架+进深),檐柱长+坐斗枋高+3/5*大斗高+斗拱层高]
单翘单昂柱头科位置 = [0,0,前檐金柱长+坐斗枋高]
七架梁位置 = [0,进深/2,前檐金柱长+坐斗枋高+3/5*大斗高+2*斗拱层高]

#print(坐斗枋位置)
all_pos = [前檐金柱位置,后檐柱位置,下层承重位置,中层承重位置,挑檐承重位置,
           后下檐坐斗枋位置,一斗三升柱头科位置,桐柱位置,后上檐坐斗枋位置,
           前上檐坐斗枋位置,后檐檐柱正心枋位置,单翘单昂柱头科位置,七架梁位置]
定位点 = show_pos(all_pos)

'''下檐一斗三升'''
def 一斗三升柱头科(定位点):
    '''柱头科'''
    第二层定位点 = movepoint(定位点,3/5*大斗高,'向上')
    一斗三升柱头科 = []
    '''大斗'''
    柱头科大斗 = 斗(定位点,柱头科大斗长,大斗宽,大斗高,正心拱宽)
    '''正心瓜拱'''
    正心瓜拱 = 拱(第二层定位点,正心瓜拱长,正心拱宽,正心拱高)
    一斗三升柱头科 += 柱头科大斗
    一斗三升柱头科.append(正心瓜拱)
    return 一斗三升柱头科

'''上檐单翘单昂''' # 原文为斗口单昂,实物为单翘单昂
'''柱头科'''
斗拱定位点 = 单翘单昂柱头科位置
第二层定位点 = movepoint(斗拱定位点,3/5*大斗高,'向上')
第三层定位点 = movepoint(第二层定位点,2*斗口,'向上')
单翘单昂柱头科 = []
'''大斗'''
柱头科大斗 = 斗(斗拱定位点,柱头科大斗长,大斗宽,大斗高,正心拱宽)
'''正心瓜拱'''
正心瓜拱 = 拱(第二层定位点,正心瓜拱长,正心拱宽,正心拱高)
'''翘'''
翘 = 拱(第二层定位点,柱头科翘宽,翘长,翘高)
'''正心万拱'''
正心万拱 = 拱(第三层定位点,正心万拱长,正心拱宽,正心拱高)
'''昂'''
昂 = 昂(第三层定位点,昂长,柱头科昂宽,昂中高)

单翘单昂柱头科 += 柱头科大斗
单翘单昂柱头科.append(正心瓜拱)
单翘单昂柱头科.append(翘)
单翘单昂柱头科.append(正心万拱)
单翘单昂柱头科.append(昂)

单翘单昂柱头科后檐 = rs.RotateObjects(单翘单昂柱头科,七架梁位置,180,copy=True)
下檐斗拱柱头科 = 一斗三升柱头科(一斗三升柱头科位置)

'''制作构件'''
#'''檐柱'''
#檐柱 = 柱(后檐柱位置,檐柱径,檐柱长,檐柱榫长,上榫=False)
#'''后檐金柱'''
#后檐金柱 = 柱(后檐金柱位置,后檐金柱径,后檐金柱长,后檐金柱榫长)
#'''前檐金柱'''
#前檐金柱 = 柱(前檐金柱位置,前檐金柱径,前檐金柱长,前檐金柱榫长,上榫=False)
#'''下中两层承重'''
#下层承重 = 枋(下层承重位置,承重长,承重高,承重厚,方向='进深',
#              左端={'榫型':'直榫','榫长':前檐金柱径/2,'柱径':前檐金柱径,'回肩':1/8},  # 原文无榫长
#              右端={'榫型':'直榫','榫长':檐柱径/2,'柱径':檐柱径,'回肩':1/3})
#中层承重 = 枋(中层承重位置,承重长,承重高,承重厚,方向='进深',
#              左端={'榫型':'直榫','榫长':前檐金柱径/2,'柱径':前檐金柱径,'回肩':1/8},
#              右端={'榫型':'直榫','榫长':檐柱径/2,'柱径':檐柱径,'回肩':1/3})
#'''额枋'''
#额枋 = []
#额枋 += 枋(后檐金柱额枋位置,后檐金柱额枋长,额枋高,额枋厚,方向='面阔',
#           左端={'榫型':'燕尾榫','榫长':后檐金柱额枋榫长,'柱径':桐柱径,'回肩':1/5},
#           右端={'榫型':'燕尾榫','榫长':后檐金柱额枋榫长,'柱径':桐柱径,'回肩':1/5})
#额枋 += 枋(前檐额枋位置,前檐额枋长,额枋高,额枋厚,方向='面阔',
#           左端={'榫型':'燕尾榫','榫长':前檐额枋榫长,'柱径':前檐金柱径,'回肩':1/10},
#           右端={'榫型':'燕尾榫','榫长':前檐额枋榫长,'柱径':前檐金柱径,'回肩':1/10})
#额枋 += 枋(后檐檐柱额枋位置,后檐檐柱额枋长,额枋高,额枋厚,方向='面阔',
#           左端={'榫型':'燕尾榫','榫长':后檐檐柱额枋榫长,'柱径':檐柱径,'回肩':1/5},
#           右端={'榫型':'燕尾榫','榫长':后檐檐柱额枋榫长,'柱径':檐柱径,'回肩':1/5})
#'''坐斗枋'''
#坐斗枋 = []
#坐斗枋 += 枋(后下檐坐斗枋位置,坐斗枋长+坐斗枋榫长,坐斗枋高,坐斗枋宽,方向='面阔',
#                 左端={'榫型':'燕尾榫','榫长':坐斗枋榫长,'一半':'上半'},
#                 右端={'榫型':'燕尾卯','榫长':坐斗枋榫长,'一半':'上半'})
#坐斗枋 += 枋(后上檐坐斗枋位置,坐斗枋长+坐斗枋榫长,坐斗枋高,坐斗枋宽,方向='面阔',
#                 左端={'榫型':'燕尾榫','榫长':坐斗枋榫长,'一半':'上半'},
#                 右端={'榫型':'燕尾卯','榫长':坐斗枋榫长,'一半':'上半'})
#坐斗枋 += 枋(前上檐坐斗枋位置,坐斗枋长+坐斗枋榫长,坐斗枋高,坐斗枋宽,方向='面阔',
#                 左端={'榫型':'燕尾榫','榫长':坐斗枋榫长,'一半':'上半'},
#                 右端={'榫型':'燕尾卯','榫长':坐斗枋榫长,'一半':'上半'})
#'''正心枋'''
#正心枋 = []
#正心枋 += 枋(后檐檐柱正心枋位置,正心枋长,正心枋高+平水,正心枋厚,方向='面阔',
#                 左端={'榫型':'燕尾榫','榫长':正心枋榫长},
#                 右端={'榫型':'燕尾榫','榫长':正心枋榫长})
#
#'''上层挑檐承重梁'''
#挑檐承重 = 枋(挑檐承重位置,挑檐承重长,挑檐承重高+挑檐承重桁椀高,挑檐承重厚,
#              左端={'榫型':'直榫','柱径':前檐金柱径,'榫长':前檐金柱径/2,'回肩':1/8},方向='进深')
#'''上伏檐桐柱'''
#桐柱 = 柱(桐柱位置,桐柱径,桐柱长,桐柱榫长,上榫=False)
'''七架梁'''
七架梁 = [枋(七架梁位置,七架梁长,七架梁高,七架梁厚,方向='进深')]

一榀梁架 = []
#一榀梁架.append('檐柱')
#一榀梁架.append('后檐金柱')
#一榀梁架.append('前檐金柱')
#一榀梁架.append('下层承重')
#一榀梁架.append('中层承重')
#一榀梁架.append('挑檐承重')
#一榀梁架.append('额枋')
#一榀梁架.append('坐斗枋')
#一榀梁架.append('正心枋')
#一榀梁架.append('下檐斗拱柱头科')
#一榀梁架.append('桐柱')
一榀梁架.append('单翘单昂柱头科')
一榀梁架.append('单翘单昂柱头科后檐')
一榀梁架.append('七架梁')

构件 = eval('+'.join(一榀梁架))
#a = rs.CopyObject(挑檐承重,面阔*方向('向右'))
# ---------- end python_3 ----------
crv_13 = Curve(python_3.c)
panel_131 = Panel("布尔运算的问题")
python_4 = PythonScript()  # -> out, a, b, c, d, e, f
# ---------- python_4: Python ----------
import Rhino as rh
import scriptcontext as sc
import rhinoscriptsyntax as rs

def 方向(x):
    if x == '右':
        return rs.VectorUnitize([1,0,0])
    elif x == '后':
        return rs.VectorUnitize([0,1,0])
    elif x == '左':
        return rs.VectorUnitize([-1,0,0])
    elif x == '前':
        return rs.VectorUnitize([0,-1,0])
    elif x == '上':
        return rs.VectorUnitize([0,0,1])
    elif x == '下':
        return rs.VectorUnitize([0,0,-1])

def 线段(定位点,向,长度):
    起点 = rh.Geometry.Point3d(定位点[0],定位点[1],定位点[2])
    线 = rh.Geometry.Line(起点,方向(向),长度)
    return sc.doc.Objects.AddLine(线)
    
def 面域(原点,面='xy'):
    origin = rh.Geometry.Point3d(原点[0],原点[1],原点[2])
    if 面[0] == 'x':
        x = rh.Geometry.Point3d(原点[0]+1,原点[1],原点[2])
    elif 面[0] == 'y':
        x = rh.Geometry.Point3d(原点[0],原点[1]+1,原点[2])
    if 面[1] == 'y':
        y = rh.Geometry.Point3d(原点[0],原点[1]+1,原点[2])
    elif 面[1] == 'z':
        y = rh.Geometry.Point3d(原点[0],原点[1],原点[2]+1)
    return rh.Geometry.Plane(origin,x,y)

def 生成面(原点,长,宽,mode='中心',面='xy'):
    if mode == '中心':
        x_interval = rh.Geometry.Interval(-长/2,长/2)
        y_interval = rh.Geometry.Interval(-宽/2,宽/2)
    elif mode == '向右':
        x_interval = rh.Geometry.Interval(0,长)
        y_interval = rh.Geometry.Interval(-宽/2,宽/2)
    elif mode == '向上':
        x_interval = rh.Geometry.Interval(-长/2,长/2)
        y_interval = rh.Geometry.Interval(0,宽)
    elif mode == '向左':
        x_interval = rh.Geometry.Interval(-长,0)
        y_interval = rh.Geometry.Interval(-宽/2,宽/2)
    elif mode == '向下':
        x_interval = rh.Geometry.Interval(-长/2,长/2)
        y_interval = rh.Geometry.Interval(-宽,0)
    return rh.Geometry.PlaneSurface(面域(原点,面),x_interval,y_interval)

def 方块(定位点,榫长,榫径,向='下'):
    榫截面 = 生成面(定位点,榫径,榫径,'中心')
    榫截面 = sc.doc.Objects.AddSurface(榫截面)
    return rs.ExtrudeSurface(榫截面,线段(定位点,向,榫长))

#movepoint
def movepoint(point,distance,向='上'):
    起点 = rh.Geometry.Point3d(point[0],point[1],point[2])
    return 起点+distance*方向(向)

#原点 = [0,0,0]
##c = movepoint(原点,10)
#a = 馒头榫(原点,10,10,'下')
#b = 馒头榫(原点,10,5,'下')
#print(a)
#print(b)
#a = rs.coercebrep(a)
#b = rs.coercebrep(b)
#print(a)
#print(b)
#to = sc.doc.ModelAbsoluteTolerance
#print(to)
##c = rh.Geometry.Brep.CreateBooleanDifference(a,b,to)
#c = rs.BooleanDifference(a,b,delete_input=False)
#print(c)


#c = movepoint(原点,10)

#print(a)
#print(b)
a = rs.coercebrep(a)
b = rs.coercebrep(b)
#print(a)
#print(b)
#d = b.Faces
#f = [face for face in d]
#print(d)
#d = rs.ExtractSurface(b,[0,1,2,3,4,5],True)
#print(d)
#for face in d: rs.FlipSurface(face,True)
#e = [rs.coercebrep(face) for face in d]
#print(e)
#f = rh.Geometry.Brep.MergeBreps(e,to)
#print(f)
#a = rs.coercebrep(a)
#b = rs.coercebrep(b)
tol = sc.doc.ModelAbsoluteTolerance
#c = rh.Geometry.Brep.CreateBooleanDifference(a,b,tol)











a = 方块([0,0,0],10,10,'下')
b = 方块([0,0,0],10,5,'下')
d = 方块([10,0,0],10,10,'上')
e = 方块([10,0,0],10,5,'上')
c = rs.BooleanDifference(a,b,delete_input=False)
f = rs.BooleanDifference(e,d,delete_input=False)
print(c)
print(f)
# ---------- end python_4 ----------
geo = Geometry(python_4.a)
geo_2 = Geometry(python_4.b)
geo_3 = Geometry(python_4.c)
geo_4 = Geometry(python_4.d)
geo_5 = Geometry(python_4.f)
geo_6 = Geometry(python_4.e)
python_5 = PythonScript()  # -> out, a
# ---------- python_5: Python ----------
import Rhino as rh
import scriptcontext as sc
import rhinoscriptsyntax as rs

def 方向(x):
    if x == '右':
        return rs.VectorUnitize([1,0,0])
    elif x == '后':
        return rs.VectorUnitize([0,1,0])
    elif x == '左':
        return rs.VectorUnitize([-1,0,0])
    elif x == '前':
        return rs.VectorUnitize([0,-1,0])
    elif x == '上':
        return rs.VectorUnitize([0,0,1])
    elif x == '下':
        return rs.VectorUnitize([0,0,-1])

def 线段(定位点,向,长度):
    起点 = rh.Geometry.Point3d(定位点[0],定位点[1],定位点[2])
    线 = rh.Geometry.Line(起点,方向(向),长度)
    return sc.doc.Objects.AddLine(线)

def show_pos(all_pos):
    p_list = []
    for p in all_pos:
        p_list.append(rs.AddPoint(p))
    return p_list

def movepoint(point,distance,向='上'):
    起点 = rh.Geometry.Point3d(point[0],point[1],point[2])
    return 起点+distance*方向(向)

def linetovector(line,unit=False):
    line = rs.coercecurve(line)
    start_point = line.PointAtStart
    end_point = line.PointAtEnd
    vector = end_point-start_point
    if unit:
        vector = vector/vector.Length
    return vector

a = rs.AddLine([0,0,0],[0,0,10])
#a = rs.coerceline(a)
#rs.VectorCreate(
#b = rs.VectorUnitize(a)
a = linetovector(a,True)
#a = 方向('上')
print(a)



#line = 线段(定位点,向,长度)
# ---------- end python_5 ----------
五举 = Panel("0.5")  # disabled
斗口尺寸 = Panel("1")  # disabled

# ---- group: 正心枋宽
multiplication_60 = Multiplication(A=斗口尺寸, B=1)  # disabled

# ---- group: 正心枋高
multiplication_61 = Multiplication(A=斗口尺寸, B=2)  # disabled

# ---- group: 七架梁高
multiplication_62 = Multiplication(A=斗口尺寸, B=7.5)  # disabled

# ---- group: 正心桁径
multiplication_63 = Multiplication(A=斗口尺寸, B=3.5)  # disabled

# ---- group: 挑檐桁径
subtraction_9 = Subtraction(A=multiplication_63, B=0.2)  # disabled

# ---- group: 一拽架
multiplication_64 = Multiplication(A=斗口尺寸, B=3)  # disabled

# ---- group: 后尾压科枋厚
multiplication_65 = Multiplication(A=斗口尺寸, B=2)  # disabled

# ---- group: 宽
multiplication_66 = Multiplication(A=斗口尺寸, B=1)  # disabled

# ---- group: 包掩
multiplication_67 = Multiplication(A=斗口尺寸, B=0.2)  # disabled

# ----
division_2 = Division(A=multiplication_61, B=2)  # disabled
multiplication_68 = Multiplication(A=multiplication_61, B=2)  # disabled
division_3 = Division(A=multiplication_66, B=2)  # disabled
multiplication_69 = Multiplication(A=multiplication_64, B=2)  # disabled

# ---- group: 升五举
multiplication_70 = Multiplication(A=multiplication_69, B=0.5)  # disabled

# ---- group: 高
multiplication_71 = Multiplication(A=multiplication_69, B=五举)  # disabled

# ----
division_4 = Division(A=multiplication_67, B=2)  # disabled
division_5 = Division(A=multiplication_65, B=2)  # disabled

# ---- group: 正心枋宽 / 包掩
addition_3 = Addition(A=multiplication_60, B=0.06)  # disabled

# ----
division_6 = Division(A=subtraction_9, B=2)  # disabled
division_7 = Division(A=multiplication_63, B=2)  # disabled
subtraction_10 = Subtraction(A=multiplication_69, B=division_5)  # disabled
subtraction_11 = Subtraction(A=multiplication_62, B=multiplication_68)  # disabled
expression_12 = Expression(x=division_7, Expression="x-sqrt(x²-(0.3*x)²)")  # disabled
进一法 = 进一法(num=expression_12, 保留位数=2)  # disabled
定位点 = Point(move_48.Geometry)  # disabled
yz_2 = YZPlane(Origin=定位点)  # disabled
dom = ConstructDomain(DomainStart=expr("-x", multiplication_69), DomainEnd=subtraction_10)  # disabled
subtraction_12 = Subtraction(A=division_7, B=进一法)  # disabled
planesrf = PlaneSurface(Plane=yz_2, XSize=dom, YSize=subtraction_11)  # disabled
Z_13 = UnitZ(Factor=subtraction_12)  # disabled
Y_13 = UnitY(Factor=multiplication_69)  # disabled
Z_14 = UnitZ(Factor=multiplication_70)  # disabled
subtraction_13 = Subtraction(A=division_6, B=进一法)  # disabled
Y_14 = UnitY(Factor=expr("-x", multiplication_69))  # disabled
Y_15 = UnitY(Factor=expr("-x", 1))  # disabled
Z_15 = UnitZ(Factor=subtraction_13)  # disabled
Y_16 = UnitY(Factor=1)  # disabled
move_50 = Move(Geometry=定位点, Motion=Y_14)  # -> Geometry, Transform; disabled
move_51 = Move(Geometry=move_50.Geometry, Motion=Y_13)  # -> Geometry, Transform; disabled
move_52 = Move(Geometry=move_51.Geometry, Motion=Z_14)  # -> Geometry, Transform; disabled
move_53 = Move(Geometry=move_52.Geometry, Motion=Z_13)  # -> Geometry, Transform; disabled
move_54 = Move(Geometry=move_50.Geometry, Motion=Z_15)  # -> Geometry, Transform; disabled
Y_17 = UnitY(Factor=expr("-x", 1))  # disabled
Y_18 = UnitY(Factor=1)  # disabled
yz_3 = YZPlane(Origin=move_53.Geometry)  # disabled
yz_4 = YZPlane(Origin=move_54.Geometry)  # disabled
line_3 = LineSDL(Start=move_52.Geometry, Direction=[Y_15, Y_16], Length=division_7)  # disabled
join = JoinCurves(Curves=line_3, Preserve=False)  # disabled
cir = Circle(Plane=yz_3, Radius=division_7)  # disabled
cir_2 = Circle(Plane=yz_4, Radius=division_6)  # disabled
line_4 = LineSDL(Start=move_50.Geometry, Direction=[Y_17, Y_18], Length=division_6)  # disabled
join_2 = JoinCurves(Curves=line_4, Preserve=False)  # disabled
srfsplit = SurfaceSplit(Surface=cir, Curves=join)  # disabled
srfsplit_2 = SurfaceSplit(Surface=cir_2, Curves=join_2)  # disabled
item_30 = ListItem(List=srfsplit_2, Index=1, Wrap=True)  # disabled
item_31 = ListItem(List=srfsplit, Index=1, Wrap=True)  # disabled
number_slider_5 = Slider(0.2, range=0..1)  # disabled
Z_16 = UnitZ(Factor=expr("-x", number_slider_5))  # disabled
move_55 = Move(Geometry=move_54.Geometry, Motion=Z_16)  # -> Geometry, Transform; disabled
ccx_18 = CurveCurve(CurveA=cir, CurveB=planesrf)  # -> Points, ParamsA, ParamsB; disabled
Y_19 = UnitY(Factor=division_6)  # disabled
number_slider_6 = Slider(0.45, range=0..1)  # disabled
item_32 = ListItem(List=ccx_18.Points, Index=0, Wrap=True)  # disabled
move_56 = Move(Geometry=move_55.Geometry, Motion=Y_19)  # -> Geometry, Transform; disabled
Z_17 = UnitZ(Factor=expr("-x", 1))  # disabled
Y_20 = UnitY(Factor=expr("-x", 1))  # disabled
Y_21 = UnitY(Factor=expr("-x", 1))  # disabled
biarc = BiArc(StartPoint=item_32, StartTangent=Y_20, EndPoint=move_56.Geometry, EndTangent=Z_17, Ratio=number_slider_6)  # -> FirstArc, SecondArc, BiArc; disabled
line_5 = LineSDL(Start=move_56.Geometry, Direction=Y_21, Length=division_6)  # disabled
srfsplit_3 = SurfaceSplit(Surface=planesrf, Curves=flatten([biarc.BiArc, line_5]))  # disabled
item_33 = ListItem(List=srfsplit_3, Index=0, Wrap=True)  # disabled
srfsplit_4 = SurfaceSplit(Surface=item_33, Curves=[item_31, item_30])  # disabled
item_34 = ListItem(List=srfsplit_4, Index=2, Wrap=True)  # disabled

# ---- group: 正心枋刻口
division_8 = Division(A=addition_3, B=2)  # disabled
dom_2 = ConstructDomain(DomainStart=expr("-x", division_8), DomainEnd=division_8)  # disabled
planesrf_2 = PlaneSurface(Plane=yz_2, XSize=dom_2, YSize=division_2)  # disabled

# ----
division_9 = Division(A=multiplication_64, B=2)  # disabled
addition_4 = Addition(A=multiplication_64, B=division_9)  # disabled
Y_22 = UnitY(Factor=expr("-x", addition_4))  # disabled
Y_23 = UnitY(Factor=multiplication_64)  # disabled
subtraction_14 = Subtraction(A=multiplication_70, B=division_2)  # disabled
X_8 = UnitX(Factor=expr("-x", division_3))  # disabled
sdiff = SolidDifference(BrepsA=item_34, BrepsB=planesrf_2)  # disabled
move_57 = Move(Geometry=定位点, Motion=Y_23)  # -> Geometry, Transform; disabled
move_58 = Move(Geometry=定位点, Motion=Y_22)  # -> Geometry, Transform; disabled
division_10 = Division(A=addition_3, B=2)  # disabled
subtraction_15 = Subtraction(A=multiplication_66, B=division_4)  # disabled
move_59 = Move(Geometry=sdiff, Motion=X_8)  # -> Geometry, Transform; disabled
X_9 = UnitX(Factor=multiplication_66)  # disabled

# ---- group: 下榫眼
multiplication_72 = Multiplication(A=斗口尺寸, B=0.2)  # disabled
division_11 = Division(A=multiplication_72, B=2)  # disabled
dom_3 = ConstructDomain(DomainStart=expr("-x", division_11), DomainEnd=division_11)  # disabled
planesrf_3 = PlaneSurface(Plane=flatten([move_58.Geometry, move_57.Geometry]), XSize=dom_3, YSize=dom_3)  # disabled
Z_18 = UnitZ(Factor=multiplication_72)  # disabled
extr = Extrude(Base=planesrf_3, Direction=Z_18)  # disabled

# ----
dom_4 = ConstructDomain(DomainStart=expr("-x", division_10), DomainEnd=division_10)  # disabled
yz_5 = YZPlane(Origin=move_52.Geometry)  # disabled
extr_2 = Extrude(Base=move_59.Geometry, Direction=X_9)  # disabled
X_10 = UnitX(Factor=division_4)  # disabled

# ---- group: 正心枋包掩
dom_5 = ConstructDomain(DomainStart=expr("-x", subtraction_14), DomainEnd=0)  # disabled
division_12 = Division(A=division_4, B=2)  # disabled
planesrf_4 = PlaneSurface(Plane=yz_5, XSize=dom_4, YSize=dom_5)  # disabled
division_13 = Division(A=subtraction_15, B=2)  # disabled
X_11 = UnitX(Factor=expr("-x", division_13))  # disabled
X_12 = UnitX(Factor=division_13)  # disabled

# ----
X_13 = UnitX(Factor=expr("-x", division_12))  # disabled

# ---- group: 正心枋包掩 (continued)
move_60 = Move(Geometry=planesrf_4, Motion=X_13)  # -> Geometry, Transform; disabled
extr_3 = Extrude(Base=move_60.Geometry, Direction=X_10)  # disabled
move_61 = Move(Geometry=extr_3, Motion=[X_11, X_12])  # -> Geometry, Transform; disabled

# ----
sdiff_2 = SolidDifference(BrepsA=extr_2, BrepsB=flatten([move_61.Geometry, extr]))  # disabled
R = Result(sdiff_2)  # disabled

# ==== cluster 大斗
正心拱宽 = ClusterInput()
定位点 = ClusterInput()
翘宽 = ClusterInput()
长 = ClusterInput()
宽 = ClusterInput()
高 = ClusterInput()
长_2 = Number(长)
宽_2 = Number(宽)
高_2 = Number(高)
正心拱宽_2 = Number(正心拱宽)
翘宽_2 = Number(翘宽)
定位点_2 = Point(定位点)
expression = Expression(x=高_2, Expression="x*2/5")
panel = Panel("""斗耳高度
斗底高度""")
制作体块 = 制作体块(定位点=定位点_2, 横向竖向=True, 长=长_2, 宽=宽_2, 高=高_2)
panel_2 = Panel("斗高")
panel_3 = Panel("斗宽")
制作切割形状 = Number(高_2)
subtraction = Subtraction(A=宽_2, B=正心拱宽_2)
宽_3 = Number(宽_2)
division = Division(A=expression, B=2)
division_2 = Division(A=subtraction, B=2)
panel_4 = Panel("斗底收进长度")
expression_2 = Expression(x=制作切割形状, Expression="x*2/5")
expression_3 = Expression(x=制作切割形状, Expression="x*1/5")
panel_5 = Panel("斗底高度")
debrep = DeconstructBrep(Brep=制作体块)  # -> Faces, Edges, Vertices
subtraction_2 = Subtraction(A=division_2, B=division)
num = Number(expression_2)
num_2 = Number(expression_3)
addition = Addition(A="5", B=4)
item = ListItem(List=debrep.Edges, Index=0, Wrap=True)  # -> Item, Item1
item_2 = ListItem(List=debrep.Edges, Index=7, Wrap=True)
item_3 = ListItem(List=debrep.Edges, Index="5", Wrap=True)
item_4 = ListItem(List=debrep.Edges, Index=addition, Wrap=True)
end = EndPoints(Curve=item.Item)  # -> Start, End
end_2 = EndPoints(Curve=item.Item1)  # -> Start, End
curvepoint = PointOnCurve(item_2, parameter=0.5)
curvepoint_2 = PointOnCurve(item_3, parameter=0.5)
curvepoint_3 = PointOnCurve(item_4, parameter=0.5)
vec = Vector(item.Item1)
vec_2 = Vector(item.Item)
X = UnitX(Factor=1)
Y = UnitY(Factor=1)
Z = UnitZ(Factor=expr("-x", 1))
Z_2 = UnitZ(Factor=expr("-x", 1))
X_2 = UnitX(Factor=1)
Y_2 = UnitY(Factor=1)
制作三角 = 制作三角(起始点=end_2.End, 起始方向=expr("-x", vec), 斗底收进=num_2, 斗底高度=num)
制作三角_2 = 制作三角(起始点=end_2.Start, 起始方向=vec, 斗底收进=num_2, 斗底高度=num)
制作三角_3 = 制作三角(起始点=end.End, 起始方向=expr("-x", vec_2), 斗底收进=num_2, 斗底高度=num)
制作三角_4 = 制作三角(起始点=end.Start, 起始方向=vec_2, 斗底收进=num_2, 斗底高度=num)
panel_6 = Panel("step3：翘位置（刻半）")
panel_7 = Panel("step2:翘位置(深一半)")
panel_8 = Panel("step1:正心拱位置")
切掉 = 切掉(起点=curvepoint_2, 宽度方向=X_2, 截面宽=翘宽_2, 长度方向=Z, 截面长=division, 深度=长_2, 颠倒深度=invert(False))
切掉_2 = 切掉(起点=curvepoint, 宽度方向=Y_2, 截面宽=正心拱宽_2, 长度方向=Z_2, 截面长=expression, 深度=宽_2, 颠倒深度=invert(False))
切掉_3 = 切掉(起点=curvepoint_3, 宽度方向=X, 截面宽=翘宽_2, 长度方向=expr("-x", Y), 截面长=subtraction_2, 深度=expression, 颠倒深度=invert(False))
切掉_4 = 切掉(起点=curvepoint_2, 宽度方向=X, 截面宽=翘宽_2, 长度方向=Y, 截面长=subtraction_2, 深度=expression, 颠倒深度=False)
panel_9 = Panel("step4：斗底")
切掉_5 = 切掉(宽度方向=Vector(0, 0, 1), 长度方向=Vector(0, 0, 1), 输入截面=制作三角_2, 深度=宽_3, 颠倒深度=invert(False))
切掉_6 = 切掉(宽度方向=Vector(0, 0, 1), 长度方向=Vector(0, 0, 1), 输入截面=制作三角_4, 深度=宽_3, 颠倒深度=invert(False))
切掉_7 = 切掉(宽度方向=Vector(0, 0, 1), 长度方向=Vector(0, 0, 1), 输入截面=制作三角, 深度=宽_3, 颠倒深度=False)
切掉_8 = 切掉(宽度方向=Vector(0, 0, 1), 长度方向=Vector(0, 0, 1), 输入截面=制作三角_3, 深度=宽_3, 颠倒深度=False)
merge = Merge(Data1=切掉_4, Data2=切掉_3)
merge_2 = Merge(Data1=切掉_6, Data2=切掉_8, Data3=切掉_5, Data4=切掉_7)
merge_3 = Merge(Data1=切掉_2, Data2=切掉, Data3=merge, Data4=merge_2)  # -> flatten(Result)
sdiff = SolidDifference(BrepsA=制作体块, BrepsB=merge_3)
fmerge = MergeFaces(Brep=sdiff)  # -> Breps, Before, After
B = ClusterOutput(fmerge.Breps)

# ==== cluster 拱
万三_瓜四_厢五 = ClusterInput()
中槽宽 = ClusterInput()
斗口 = ClusterInput()
高 = ClusterInput()
拱瓣长 = ClusterInput()
定位点 = ClusterInput()
长 = ClusterInput()
槽升高 = ClusterInput()
槽升长 = ClusterInput()
宽 = ClusterInput()
panel = Panel("包掩")
槽升高_2 = Number(槽升高)
斗口_2 = Number(斗口)
中槽宽_2 = Number(中槽宽)
定位点_2 = Point(定位点)
长_2 = Number(长)
宽_2 = Number(宽)
高_2 = Number(高)
万三_瓜四_厢五_2 = Integer(万三_瓜四_厢五)
拱瓣长_2 = Number(拱瓣长)
槽升长_2 = Number(槽升长)
panel_2 = Panel("""斗底收进长度
斗腰高""")
panel_3 = Panel("斗底高")
panel_4 = Panel("槽升底长")
expression = Expression(x=槽升高_2, Expression="x*1/5")
expression_2 = Expression(x=槽升高_2, Expression="x*2/5")
division = Division(A=高_2, B=2)
multiplication = Multiplication(A=斗口_2, B=Slider(0.1, range=0..0.1))
panel_5 = Panel("正心拱宽")
panel_6 = Panel("""斗口
拱瓣高""")
panel_7 = Panel("拱瓣长")
panel_9 = Panel("槽升位高度")
panel_10 = Panel("槽升底收进")
panel_11 = Panel("槽升腰高")
制作体块 = 制作体块(定位点=定位点_2, 横向竖向=True, 长=长_2, 宽=宽_2, 高=高_2)
multiplication_2 = Multiplication(A=multiplication, B=2)
拱瓣长_3 = Number(拱瓣长_2)
斗口_3 = Number(斗口)
宽_3 = Number(宽)
包掩 = Number(multiplication)
槽升腰高 = Number(expression)
槽升底收进 = Number(expression)
subtraction = Subtraction(A=中槽宽_2, B=multiplication_2)
multiplication_3 = Multiplication(A=expression, B=2)
subtraction_2 = Subtraction(A=槽升长_2, B=multiplication_3)
槽升底长 = Number(subtraction_2)
addition = Addition(A=expression, B=expression_2)
槽升位高度 = Number(addition)
multiplication_4 = Multiplication(A=斗口_3, B=拱瓣长_3)
debrep = DeconstructBrep(Brep=制作体块)  # -> Faces, Edges, Vertices
item = ListItem(List=debrep.Edges, Index=0, Wrap=True)
end = EndPoints(Curve=item)  # -> Start, End
item_2 = ListItem(List=debrep.Edges, Index=5, Wrap=True)
item_3 = ListItem(List=debrep.Edges, Index=7, Wrap=True)
item_4 = ListItem(List=debrep.Edges, Index=11, Wrap=True)
end_2 = EndPoints(Curve=item_3)  # -> Start, End
end_3 = EndPoints(Curve=item_4)  # -> Start, End
curvepoint = PointOnCurve(item_3, parameter=0.5)
X = UnitX(Factor=expr("-x", 1))
curvepoint_2 = PointOnCurve(item_4, parameter=0.5)
curvepoint_3 = PointOnCurve(item_2, parameter=0.5)
X_2 = UnitX(Factor=1)
vec = Vector(expr("-x", item))
vec_2 = Vector(item)
Z = UnitZ(Factor=expr("-x", 1))
X_3 = UnitX(Factor=1)
制作拱瓣 = 制作拱瓣(起始点=end.Start, 起始方向=vec_2, 拱瓣高=斗口_3, 拱瓣长=multiplication_4, 万三_瓜四_厢五=万三_瓜四_厢五_2)
Z_2 = UnitZ(Factor=expr("-x", 1))
Y = UnitY(Factor=expr("-x", 1))
制作拱瓣_2 = 制作拱瓣(起始点=end.End, 起始方向=vec, 拱瓣高=斗口_3, 拱瓣长=multiplication_4, 万三_瓜四_厢五=万三_瓜四_厢五_2)
制作槽升榫形状 = 制作槽升榫形状(起始点=end_2.End, 起始方向=X, 槽升底长=槽升底长, 槽升底收进=槽升底收进, 槽升腰高=槽升腰高, 槽升位高度=槽升位高度)
制作槽升榫形状_2 = 制作槽升榫形状(起始点=end_2.Start, 起始方向=X, 槽升底长=槽升底长, 槽升底收进=槽升底收进, 槽升腰高=槽升腰高, 槽升位高度=槽升位高度)
制作槽升榫形状_3 = 制作槽升榫形状(起始点=end_3.End, 起始方向=X_2, 槽升底长=槽升底长, 槽升底收进=槽升底收进, 槽升腰高=槽升腰高, 槽升位高度=槽升位高度)
制作槽升榫形状_4 = 制作槽升榫形状(起始点=end_3.Start, 起始方向=X_2, 槽升底长=槽升底长, 槽升底收进=槽升底收进, 槽升腰高=槽升腰高, 槽升位高度=槽升位高度)
panel_13 = Panel("step2：槽升位置（留榫位置）")
panel_14 = Panel("step3：槽升位置（槽升榫）")
panel_15 = Panel("step1：翘位置")
切掉 = 切掉(起点=curvepoint_3, 宽度方向=X_3, 截面宽=subtraction, 长度方向=Z, 截面长=division, 深度=宽_2, 颠倒深度=invert(False))
panel_16 = Panel("step4:拱瓣")
切掉_2 = 切掉(起点=curvepoint_2, 宽度方向=expr("-x", Y), 截面宽=宽_2, 长度方向=Z_2, 截面长=addition, 深度=subtraction_2, 颠倒深度=False)
切掉_3 = 切掉(起点=curvepoint, 宽度方向=Y, 截面宽=宽_2, 长度方向=Z_2, 截面长=addition, 深度=subtraction_2, 颠倒深度=False)
切掉_4 = 切掉(宽度方向=Vector(0, 0, 1), 长度方向=Vector(0, 0, 1), 输入截面=制作槽升榫形状, 深度=包掩, 颠倒深度=False)
切掉_5 = 切掉(宽度方向=Vector(0, 0, 1), 长度方向=Vector(0, 0, 1), 输入截面=制作槽升榫形状_2, 深度=包掩, 颠倒深度=invert(False))
切掉_6 = 切掉(宽度方向=Vector(0, 0, 1), 长度方向=Vector(0, 0, 1), 输入截面=制作槽升榫形状_4, 深度=包掩, 颠倒深度=invert(False))
切掉_7 = 切掉(宽度方向=Vector(0, 0, 1), 长度方向=Vector(0, 0, 1), 输入截面=制作槽升榫形状_3, 深度=包掩, 颠倒深度=False)
切掉_8 = 切掉(宽度方向=Vector(0, 0, 1), 长度方向=Vector(0, 0, 1), 输入截面=制作拱瓣, 深度=宽_3, 颠倒深度=invert(False))
切掉_9 = 切掉(宽度方向=Vector(0, 0, 1), 长度方向=Vector(0, 0, 1), 输入截面=制作拱瓣_2, 深度=宽_3, 颠倒深度=False)
merge = Merge(Data1=切掉_3, Data2=切掉_2)
merge_2 = Merge(Data1=切掉_8, Data2=切掉_9)
merge_3 = Merge(Data1=切掉_4, Data2=切掉_6, Data3=切掉_7, Data4=切掉_5)
merge_4 = Merge(Data1=切掉, Data2=merge, Data3=merge_3, Data4=merge_2)  # -> flatten(Result)
sdiff = SolidDifference(BrepsA=制作体块, BrepsB=merge_4)
R = ClusterOutput(sdiff)

# ==== cluster 翘
大斗高 = ClusterInput()
正心拱宽 = ClusterInput()
高 = ClusterInput()
十八斗高 = ClusterInput()
定位点 = ClusterInput()
斗口 = ClusterInput()
长 = ClusterInput()
宽 = ClusterInput()
十八斗宽 = ClusterInput()
大斗高_2 = Number(大斗高)
十八斗高_2 = Number(十八斗高)
正心拱宽_2 = Number(正心拱宽)
定位点_2 = Point(定位点)
长_2 = Number(长)
宽_2 = Number(宽)
高_2 = Number(高)
panel = Panel("包掩")
expression = Expression(x=大斗高_2, Expression="x*2/5")
panel_2 = Panel("大斗斗耳高")
十八斗宽_2 = Number(十八斗宽)
斗口_2 = Number(斗口)
panel_3 = Panel("拱瓣长")
panel_4 = Panel("""斗口
拱瓣高""")
panel_5 = Panel("翘宽")
panel_6 = Panel("""十八斗底收进长度，
十八斗腰高""")
panel_8 = Panel("斗底高")
panel_9 = Panel("斗底收进长度，斗腰高")
panel_10 = Panel("十八斗底宽")
panel_11 = Panel("十八斗底高")
expression_2 = Expression(x=十八斗高_2, Expression="x*1/5")
expression_3 = Expression(x=十八斗高_2, Expression="x*2/5")
division = Division(A=高_2, B=2)
斗口_3 = Number(斗口)
宽_3 = Number(宽_2)
num = Number(expression_2)
num_2 = Number(expression_3)
multiplication = Multiplication(A=斗口_2, B=Slider(0.1, range=0..0.1))
num_3 = Number(multiplication)
division_2 = Division(A=expression, B=2)
制作体块 = 制作体块(定位点=定位点_2, 横向竖向=True, 长=长_2, 宽=宽_2, 高=高_2)
multiplication_2 = Multiplication(A=division_2, B=2)
addition = Addition(A=expression_2, B=expression_3)
multiplication_3 = Multiplication(A=expression_2, B=2)
subtraction = Subtraction(A=十八斗宽_2, B=multiplication_3)
num_4 = Number(subtraction)
addition_2 = Addition(A=num, B=num_2)
addition_3 = Addition(A=正心拱宽_2, B=multiplication_2)
debrep = DeconstructBrep(Brep=制作体块)  # -> Faces, Edges, Vertices
item = ListItem(List=debrep.Edges, Index=9, Wrap=True)
item_2 = ListItem(List=debrep.Edges, Index=5, Wrap=True)
item_3 = ListItem(List=debrep.Edges, Index=0, Wrap=True)
item_4 = ListItem(List=debrep.Edges, Index=0, Wrap=True)
item_5 = ListItem(List=debrep.Edges, Index=0, Wrap=True)
item_6 = ListItem(List=debrep.Edges, Index=2, Wrap=True)
item_7 = ListItem(List=debrep.Edges, Index=7, Wrap=True)
item_8 = ListItem(List=debrep.Edges, Index=11, Wrap=True)
end = EndPoints(Curve=item_2)  # -> Start, End
curvepoint = PointOnCurve(item_4, parameter=0.5)
curvepoint_2 = PointOnCurve(item_6, parameter=0.5)
curvepoint_3 = PointOnCurve(item_5, parameter=0.5)
curvepoint_4 = PointOnCurve(item_7, parameter=0.5)
curvepoint_5 = PointOnCurve(item_8, parameter=0.5)
end_2 = EndPoints(Curve=item)  # -> Start, End
end_3 = EndPoints(Curve=item_3)  # -> Start, End
vec = Vector(expr("-x", item_3))
Z = UnitZ(Factor=1)
pt = Point(end_3.End)
pt_2 = Point(end_3.Start)
vec_2 = Vector(item_3)
Z_2 = UnitZ(Factor=expr("-x", 1))
pt_3 = Point(end.Start)
vec_3 = Vector(item_2)
pt_4 = Point(end.End)
pt_5 = Point(end_2.Start)
vec_4 = Vector(item_2)
vec_5 = Vector(item)
Z_3 = UnitZ(Factor=1)
pt_6 = Point(end_2.End)
vec_6 = Vector(item)
panel_13 = Panel("step4：十八斗位置（十八斗榫）")
制作拱瓣 = 制作拱瓣(起始点=pt, 起始方向=vec, 拱瓣高=斗口_3, 拱瓣长="1.1", 万三_瓜四_厢五=4)
panel_14 = Panel("step3:十八斗位置（留榫位置）")
制作拱瓣_2 = 制作拱瓣(起始点=pt_2, 起始方向=vec_2, 拱瓣高=斗口_3, 拱瓣长="1.1", 万三_瓜四_厢五=4)
制作槽升榫形状 = 制作槽升榫形状(起始点=pt_3, 起始方向=vec_3, 槽升底长=num_4, 槽升底收进=num, 槽升腰高=num, 槽升位高度=addition_2)
制作槽升榫形状_2 = 制作槽升榫形状(起始点=pt_4, 起始方向=expr("-x", vec_4), 槽升底长=num_4, 槽升底收进=num, 槽升腰高=num, 槽升位高度=addition_2)
panel_15 = Panel("step2:正心拱位置（包掩）")
制作槽升榫形状_3 = 制作槽升榫形状(起始点=pt_5, 起始方向=vec_5, 槽升底长=num_4, 槽升底收进=num, 槽升腰高=num, 槽升位高度=addition_2)
制作槽升榫形状_4 = 制作槽升榫形状(起始点=pt_6, 起始方向=expr("-x", vec_6), 槽升底长=num_4, 槽升底收进=num, 槽升腰高=num, 槽升位高度=addition_2)
panel_16 = Panel("step1:正心拱位置")
panel_17 = Panel("step5：拱瓣")
切掉 = 切掉(起点=curvepoint, 宽度方向=item_4, 截面宽=正心拱宽_2, 长度方向=Z, 截面长=division, 深度=宽_2, 颠倒深度=invert(False))
切掉_2 = 切掉(起点=curvepoint, 宽度方向=item_4, 截面宽=addition_3, 长度方向=Z, 截面长=division_2, 深度=宽_2, 颠倒深度=invert(False))
切掉_3 = 切掉(起点=curvepoint_3, 宽度方向=item_5, 截面宽=正心拱宽_2, 长度方向=Z_3, 截面长=高_2, 深度=multiplication, 颠倒深度=invert(False))
切掉_4 = 切掉(起点=curvepoint_2, 宽度方向=item_6, 截面宽=正心拱宽_2, 长度方向=Z_3, 截面长=高_2, 深度=multiplication, 颠倒深度=invert(False))
切掉_5 = 切掉(起点=curvepoint_4, 宽度方向=item_7, 截面宽=宽_2, 长度方向=Z_2, 截面长=addition, 深度=subtraction, 颠倒深度=False)
切掉_6 = 切掉(起点=curvepoint_5, 宽度方向=item_8, 截面宽=宽_2, 长度方向=Z_2, 截面长=addition, 深度=subtraction, 颠倒深度=False)
切掉_7 = 切掉(起点=pt_3, 宽度方向=Vector(0, 0, 1), 长度方向=Vector(0, 0, 1), 输入截面=制作槽升榫形状, 深度=num_3, 颠倒深度=False)
切掉_8 = 切掉(起点=pt_4, 宽度方向=Vector(0, 0, 1), 长度方向=Vector(0, 0, 1), 输入截面=制作槽升榫形状_2, 深度=num_3, 颠倒深度=invert(False))
切掉_9 = 切掉(起点=pt_5, 宽度方向=Vector(0, 0, 1), 长度方向=Vector(0, 0, 1), 输入截面=制作槽升榫形状_3, 深度=num_3, 颠倒深度=False)
切掉_10 = 切掉(起点=pt_6, 宽度方向=Vector(0, 0, 1), 长度方向=Vector(0, 0, 1), 输入截面=制作槽升榫形状_4, 深度=num_3, 颠倒深度=invert(False))
merge = Merge(Data1=切掉_7, Data2=切掉_8, Data3=切掉_9, Data4=切掉_10)
切掉_11 = 切掉(宽度方向=Vector(0, 0, 1), 长度方向=Vector(0, 0, 1), 输入截面=制作拱瓣_2, 深度=宽_3, 颠倒深度=invert(False))
切掉_12 = 切掉(宽度方向=Vector(0, 0, 1), 长度方向=Vector(0, 0, 1), 输入截面=制作拱瓣, 深度=宽_3, 颠倒深度=False)
merge_2 = Merge(Data1=切掉_11, Data2=切掉_12)
merge_3 = Merge(Data1=切掉, Data2=切掉_2, Data3=切掉_3, Data4=切掉_4, Data5=切掉_5, Data6=切掉_6, Data7=merge, Data8=merge_2)  # -> flatten(Result)
sdiff = SolidDifference(BrepsA=制作体块, BrepsB=merge_3)
fmerge = MergeFaces(Brep=sdiff)  # -> Breps, Before, After
rotate = Rotate(Geometry=fmerge.Breps, Angle=1.570796327, Plane=定位点_2)  # -> Geometry, Transform
G = ClusterOutput(rotate.Geometry)

# ==== cluster 升
斗口 = ClusterInput()
拱榫位置 = ClusterInput()
拱宽 = ClusterInput()
定位点 = ClusterInput()
长 = ClusterInput()
宽 = ClusterInput()
高 = ClusterInput()
定位点_2 = Point(定位点)
长_2 = Number(长)
斗口_2 = Number(斗口)
宽_2 = Number(宽)
高_2 = Number(高)
拱宽_2 = Number(拱宽)
拱榫位置_2 = Integer(拱榫位置)
panel = Panel("包掩")
expression = Expression(x=高_2, Expression="x*2/5")
expression_2 = Expression(x=高_2, Expression="x*1/5")
制作体块 = 制作体块(定位点=定位点_2, 横向竖向=True, 长=长_2, 宽=宽_2, 高=高_2)
panel_2 = Panel("""斗耳高度
斗底高度""")
panel_3 = Panel("""斗腰高度
斗底收进""")
multiplication = Multiplication(A=斗口_2, B=Slider(0.1, range=0..0.1))
multiplication_2 = Multiplication(A=multiplication, B=2)
addition = Addition(A=expression, B=expression_2)
subtraction = Subtraction(A=拱宽_2, B=multiplication_2)
debrep = DeconstructBrep(Brep=制作体块)  # -> Faces, Edges, Vertices
panel_4 = Panel("斗高")
制作切割形状 = Number(高_2)
item = ListItem(List=debrep.Edges, Index=[0, 1, 2, 3], Wrap=True)
item_2 = ListItem(List=debrep.Edges, Index=11, Wrap=True)
item_3 = ListItem(List=debrep.Edges, Index=0, Wrap=True)  # -> Item, Item1
merge = Merge(Data1=flatten(item), Data2="null")
panel_5 = Panel("斗底收进长度")
expression_3 = Expression(x=制作切割形状, Expression="x*2/5")
expression_4 = Expression(x=制作切割形状, Expression="x*1/5")
panel_6 = Panel("斗底高度")
panel_7 = Panel("斗长")
panel_8 = Panel("斗宽")
curvepoint = PointOnCurve(item_2, parameter=0.5)
长_3 = Number(长)
宽_3 = Number(宽)
end = EndPoints(Curve=item_3.Item)  # -> Start, End
end_2 = EndPoints(Curve=item_3.Item1)  # -> Start, End
item_4 = ListItem(List=merge, Index=拱榫位置_2, Wrap=True)
curvepoint_2 = PointOnCurve(item_4, parameter=0.5)
Z = UnitZ(Factor=expr("-x", 1))
Z_2 = UnitZ(Factor=1)
vec = Vector(expr("-x", item_3.Item))
pt = Point(end.Start)
vec_2 = Vector(item_3.Item)
vec_3 = Vector(expr("-x", item_3.Item1))
pt_2 = Point(end.End)
pt_3 = Point(end_2.Start)
vec_4 = Vector(item_3.Item1)
pt_4 = Point(end_2.End)
panel_9 = Panel("step2：榫位置")
panel_10 = Panel("step1：正心拱位置")
切掉 = 切掉(起点=curvepoint_2, 宽度方向=item_4, 截面宽=subtraction, 长度方向=Z_2, 截面长=addition, 深度=expression_2, 颠倒深度=invert(False))
panel_11 = Panel("斗底")
制作三角 = 制作三角(起始点=pt, 起始方向=vec_2, 斗底收进=expression_4, 斗底高度=expression_3)
切掉_2 = 切掉(起点=curvepoint, 宽度方向=item_2, 截面宽=拱宽_2, 长度方向=Z, 截面长=expression, 深度=长_2, 颠倒深度=False)
制作三角_2 = 制作三角(起始点=pt_2, 起始方向=vec, 斗底收进=expression_4, 斗底高度=expression_3)
制作三角_3 = 制作三角(起始点=pt_3, 起始方向=vec_4, 斗底收进=expression_4, 斗底高度=expression_3)
制作三角_4 = 制作三角(起始点=pt_4, 起始方向=vec_3, 斗底收进=expression_4, 斗底高度=expression_3)
切掉_3 = 切掉(起点=pt, 宽度方向=Vector(0, 0, 1), 长度方向=Vector(0, 0, 1), 输入截面=制作三角, 深度=宽_3, 颠倒深度=invert(False))
切掉_4 = 切掉(起点=pt_3, 宽度方向=Vector(0, 0, 1), 长度方向=Vector(0, 0, 1), 输入截面=制作三角_3, 深度=长_3, 颠倒深度=invert(False))
切掉_5 = 切掉(起点=pt_2, 宽度方向=Vector(0, 0, 1), 长度方向=Vector(0, 0, 1), 输入截面=制作三角_2, 深度=宽_3, 颠倒深度=False)
切掉_6 = 切掉(起点=pt_4, 宽度方向=Vector(0, 0, 1), 长度方向=Vector(0, 0, 1), 输入截面=制作三角_4, 深度=长_3, 颠倒深度=False)
merge_2 = Merge(Data1=切掉_3, Data2=切掉_5, Data3=切掉_4, Data4=切掉_6)
merge_3 = Merge(Data1=切掉_2, Data2=切掉, Data3=merge_2)  # -> flatten(Result)
sdiff = SolidDifference(BrepsA=制作体块, BrepsB=merge_3)
fmerge = MergeFaces(Brep=sdiff)  # -> Breps, Before, After
B = ClusterOutput(fmerge.Breps)

# ==== cluster 昂
panel = Panel("""十八斗底收进长度，
十八斗腰高""")
panel_2 = Panel("包掩")
panel_3 = Panel("十八斗底宽")
panel_4 = Panel("十八斗底高")
panel_5 = Panel("一拽架")
panel_6 = Panel("中高")
panel_7 = Panel("前高")
panel_9 = Panel("斗口")
panel_10 = Panel("十八斗宽")
panel_14 = Panel("昂宽")
正心拱宽 = ClusterInput()
panel_16 = Panel("昂前出0.3斗口")
中高 = ClusterInput()
中高_2 = Number(中高)
中高_3 = Number(中高)
十八斗高 = ClusterInput()
前高 = ClusterInput()
前高_2 = Number(前高)
十八斗宽 = ClusterInput()
十八斗宽_2 = Number(十八斗宽)
定位点 = ClusterInput()
长 = ClusterInput()
宽 = ClusterInput()
宽_2 = Number(宽)
单才拱高 = ClusterInput()
单才拱宽 = ClusterInput()
斗口 = ClusterInput()
斗口_2 = Number(斗口)
斗口_3 = Number(斗口)
division = Division(A=十八斗宽_2, B=2)
multiplication = Multiplication(A=斗口_2, B=0.2)
multiplication_2 = Multiplication(A=斗口_2, B=0.3)
subtraction = Subtraction(A=前高_2, B=中高_2)
multiplication_3 = Multiplication(A=斗口_3, B=2)
正心拱宽_2 = Number(正心拱宽)
十八斗高_2 = Number(十八斗高)
定位点_2 = Point(定位点)
长_2 = Number(长)
宽_3 = Number(宽)
前高_3 = Number(前高)
中高_4 = Number(中高)
十八斗宽_3 = Number(十八斗宽)
单才拱宽_2 = Number(单才拱宽)
斗口_4 = Number(斗口)
单才拱高_2 = Number(单才拱高)
multiplication_4 = Multiplication(A="0.3", B=斗口_4)
panel_19 = Panel("""斗底高
斗耳高""")
panel_20 = Panel("斗底收进长度，斗腰高")
expression = Expression(x=十八斗高_2, Expression="x*1/5")
num = Number(expression)
num_2 = Number(expression)
expression_2 = Expression(x=十八斗高_2, Expression="x*2/5")
num_3 = Number(expression_2)
num_4 = Number(expression_2)
addition = Addition(A=num, B=num_3)
addition_2 = Addition(A=num_2, B=num_4)
subtraction_2 = Subtraction(A=中高_3, B=addition_2)
division_2 = Division(A=单才拱高_2, B=2)
division_3 = Division(A=中高_4, B=2)
subtraction_3 = Subtraction(A=前高_3, B=中高_4)
multiplication_5 = Multiplication(A=斗口_4, B=3)
num_5 = Number(multiplication_5)
num_6 = Number(multiplication_5)
multiplication_6 = Multiplication(A=num_5, B=2)
multiplication_7 = Multiplication(A=num_6, B=3)
addition_3 = Addition(A=multiplication_7, B=division, C=multiplication)
expression_3 = Expression(x=长_2, y=multiplication_5, Expression="x/2-y*2")
multiplication_8 = Multiplication(A=斗口_4, B=Slider(0.1, range=0..0.1))
num_7 = Number(multiplication_8)
宽_4 = Number(宽)
num_8 = Number(multiplication_5)
addition_4 = Addition(A=multiplication_4, B=multiplication_5)
subtraction_4 = Subtraction(A=长_2, B=addition_4)
subtraction_5 = Subtraction(A=长_2, B=addition_4)
num_9 = Number(expression)
addition_5 = Addition(A=subtraction_3, B=division_3)
num_10 = Number(expression_2)
addition_6 = Addition(A=division_3, B=expression_2)
制作体块 = 制作体块(定位点=定位点_2, 横向竖向=True, 长=长_2, 宽=宽_3, 高=前高_3)
斗口_5 = Number(斗口)
division_4 = Division(A=subtraction_4, B=2)
division_5 = Division(A=subtraction_5, B=2)
addition_7 = Addition(A=subtraction_3, B=单才拱高_2)
addition_8 = Addition(A=subtraction_3, B=division_2)
Z = UnitZ(Factor=expr("-x", subtraction_3))
multiplication_9 = Multiplication(A=expression, B=2)
subtraction_6 = Subtraction(A=十八斗宽_3, B=multiplication_9)
num_11 = Number(subtraction_6)
division_6 = Division(A=num_11, B=2)
addition_9 = Addition(A=multiplication_6, B=division_6)
num_12 = Number(subtraction_6)
division_7 = Division(A=num_12, B=2)
X = UnitX(Factor=expr("-x", division_4))
X_2 = UnitX(Factor=expr("-x", division_5))
X_3 = UnitX(Factor=expr("-x", expression_3))
addition_10 = Addition(A=num_9, B=num_10)
rad = Radians(Degrees=30)
subtraction_7 = Subtraction(A=num_8, B=division_7)
X_4 = UnitX(Factor=expr("-x", addition_9))
move = Move(Geometry=制作体块, Motion=Z)  # -> Geometry, Transform
subtraction_8 = Subtraction(A=长_2, B=addition_4)
subtraction_9 = Subtraction(A=长_2, B=addition_4)
subtraction_10 = Subtraction(A=长_2, B=addition_4)
subtraction_11 = Subtraction(A=长_2, B=addition_4)
multiplication_10 = Multiplication(A=斗口_5, B=0.8)
subtraction_12 = Subtraction(A=长_2, B=addition_4)
Z_2 = UnitZ(Factor=expr("-x", 中高_3))
subtraction_13 = Subtraction(A=长_2, B=addition_4)
move_2 = Move(Geometry=move.Geometry, Motion=X_3)  # -> Geometry, Transform
X_5 = UnitX(Factor=expr("-x", multiplication_3))
Z_3 = UnitZ(Factor=subtraction_2)
sin = Sine(Value=rad)
cos = Cosine(Value=rad)
subtraction_14 = Subtraction(A=长_2, B=addition_4)
multiplication_11 = Multiplication(A=斗口_5, B=0.2)
subtraction_15 = Subtraction(A=长_2, B=addition_4)
subtraction_16 = Subtraction(A=长_2, B=addition_4)
subtraction_17 = Subtraction(A=长_2, B=addition_4)
division_8 = Division(A=subtraction_8, B=2)
Z_4 = UnitZ(Factor=subtraction)
X_6 = UnitX(Factor=expr("-x", addition_3))
X_7 = UnitX(Factor=multiplication_2)
Z_5 = UnitZ(Factor=multiplication)
division_9 = Division(A=subtraction_9, B=2)
division_10 = Division(A=subtraction_10, B=2)
division_11 = Division(A=subtraction_11, B=2)
multiplication_12 = Multiplication(A=multiplication_10, B=sin)
multiplication_13 = Multiplication(A=斗口_5, B=0.2)
division_12 = Division(A=subtraction_12, B=2)
division_13 = Division(A=subtraction_13, B=2)
division_14 = Division(A=subtraction_14, B=2)
debrep = DeconstructBrep(Brep=move_2.Geometry)  # -> Faces, Edges, Vertices
item = ListItem(List=debrep.Edges, Index=9, Wrap=True)
item_2 = ListItem(List=debrep.Edges, Index=5, Wrap=True)
flip = FlipCurve(Curve=item)  # -> Curve, Flag
end = EndPoints(Curve=item_2)  # -> Start, End
end_2 = EndPoints(Curve=flip.Curve)  # -> Start, End
item_3 = ListItem(List=debrep.Edges, Index=0, Wrap=True)
move_3 = Move(Geometry=end.Start, Motion=X)  # -> Geometry, Transform
move_4 = Move(Geometry=end_2.Start, Motion=X_2)  # -> Geometry, Transform
item_4 = ListItem(List=debrep.Edges, Index=2, Wrap=True)
item_5 = ListItem(List=debrep.Edges, Index=2, Wrap=True)
end_3 = EndPoints(Curve=item_3)  # -> Start, End
flip_2 = FlipCurve(Curve=item_4)  # -> Curve, Flag
item_6 = ListItem(List=debrep.Edges, Index=0, Wrap=True)
item_7 = ListItem(List=debrep.Edges, Index=5, Wrap=True)
item_8 = ListItem(List=debrep.Edges, Index=2, Wrap=True)
flip_3 = FlipCurve(Curve=item_5)  # -> Curve, Flag
move_5 = Move(Geometry=move_4.Geometry, Motion=X_4)  # -> Geometry, Transform
item_9 = ListItem(List=debrep.Edges, Index=0, Wrap=True)
move_6 = Move(Geometry=move_3.Geometry, Motion=X_4)  # -> Geometry, Transform
item_10 = ListItem(List=debrep.Edges, Index=0, Wrap=True)
item_11 = ListItem(List=debrep.Edges, Index=0, Wrap=True)
item_12 = ListItem(List=debrep.Edges, Index=0, Wrap=True)
division_15 = Division(A=subtraction_15, B=2)
X_8 = UnitX(Factor=expr("-x", division_8))
division_16 = Division(A=subtraction_16, B=2)
division_17 = Division(A=subtraction_17, B=2)
move_7 = Move(Geometry=end_3.Start, Motion=Z_4)  # -> Geometry, Transform
move_8 = Move(Geometry=end_3.End, Motion=X_7)  # -> Geometry, Transform
X_9 = UnitX(Factor=expr("-x", division_9))
move_9 = Move(Geometry=move_7.Geometry, Motion=X_6)  # -> Geometry, Transform
X_10 = UnitX(Factor=expr("-x", division_10))
move_10 = Move(Geometry=end_3.End, Motion=Z_5)  # -> Geometry, Transform
X_11 = UnitX(Factor=expr("-x", division_11))
pt = Point(end_3.Start)
Z_6 = UnitZ(Factor=expr("-x", multiplication_12))
X_12 = UnitX(Factor=expr("-x", division_12))
pt_2 = Point(end_3.End)
end_4 = EndPoints(Curve=flip_2.Curve)  # -> Start, End
Z_7 = UnitZ(Factor=multiplication_13)
item_13 = ListItem(List=debrep.Edges, Index=0, Wrap=True)
multiplication_14 = Multiplication(A=multiplication_10, B=cos)
item_14 = ListItem(List=debrep.Edges, Index=0, Wrap=True)
X_13 = UnitX(Factor=expr("-x", division_13))
flip_4 = FlipCurve(Curve=item_8)  # -> Curve, Flag
end_5 = EndPoints(Curve=flip_3.Curve)  # -> Start, End
end_6 = EndPoints(Curve=item_7)  # -> Start, End
X_14 = UnitX(Factor=expr("-x", multiplication_5))
X_15 = UnitX(Factor=multiplication_5)
end_7 = EndPoints(Curve=item_6)  # -> Start, End
X_16 = UnitX(Factor=expr("-x", division_14))
end_8 = EndPoints(Curve=item_9)  # -> Start, End
end_9 = EndPoints(Curve=item_10)  # -> Start, End
X_17 = UnitX(Factor=expr("-x", multiplication_5))
pt_3 = Point(move_5.Geometry)
vec = Vector(item)
pt_4 = Point(move_6.Geometry)
vec_2 = Vector(item_2)
X_18 = UnitX(Factor=multiplication_5)
end_10 = EndPoints(Curve=item_11)  # -> Start, End
X_19 = UnitX(Factor=expr("-x", multiplication_5))
end_11 = EndPoints(Curve=item_12)  # -> Start, End
X_20 = UnitX(Factor=expr("-x", division_15))
X_21 = UnitX(Factor=expr("-x", division_16))
X_22 = UnitX(Factor=expr("-x", division_17))
item_15 = ListItem(List=debrep.Edges, Index=5, Wrap=True)
X_23 = UnitX(Factor=multiplication_5)
move_11 = Move(Geometry=end_4.Start, Motion=X_8)  # -> Geometry, Transform
move_12 = Move(Geometry=end_6.Start, Motion=X_9)  # -> Geometry, Transform
move_13 = Move(Geometry=end_5.Start, Motion=X_10)  # -> Geometry, Transform
end_12 = EndPoints(Curve=item_13)  # -> Start, End
X_24 = UnitX(Factor=expr("-x", num_12))
制作槽升榫形状 = 制作槽升榫形状(起始点=pt_4, 起始方向=expr("-x", vec_2), 槽升底长=num_11, 槽升底收进=num, 槽升腰高=num, 槽升位高度=addition)
X_25 = UnitX(Factor=expr("-x", subtraction_7))
merge = Merge(Data1=move_8.Geometry, Data2=pt_2, Data3=move_10.Geometry)
end_13 = EndPoints(Curve=item_14)  # -> Start, End
move_14 = Move(Geometry=end_8.Start, Motion=X_11)  # -> Geometry, Transform
Z_8 = UnitZ(Factor=expr("-x", addition_10))
end_14 = EndPoints(Curve=flip_4.Curve)  # -> Start, End
X_26 = UnitX(Factor=expr("-x", num_8))
move_15 = Move(Geometry=end_9.Start, Motion=X_12)  # -> Geometry, Transform
merge_2 = Merge(Data1=pt, Data2=move_7.Geometry, Data3=move_9.Geometry, Data4=move_8.Geometry)
制作槽升榫形状_2 = 制作槽升榫形状(起始点=pt_3, 起始方向=vec, 槽升底长=num_11, 槽升底收进=num, 槽升腰高=num, 槽升位高度=addition)
move_16 = Move(Geometry=move_11.Geometry, Motion=X_15)  # -> Geometry, Transform
X_27 = UnitX(Factor=expr("-x", multiplication_14))
move_17 = Move(Geometry=end_10.Start, Motion=X_13)  # -> Geometry, Transform
move_18 = Move(Geometry=move_13.Geometry, Motion=X_14)  # -> Geometry, Transform
move_19 = Move(Geometry=end_11.Start, Motion=X_16)  # -> Geometry, Transform
move_20 = Move(Geometry=move_14.Geometry, Motion=X_18)  # -> Geometry, Transform
move_21 = Move(Geometry=move_15.Geometry, Motion=X_17)  # -> Geometry, Transform
move_22 = Move(Geometry=move_17.Geometry, Motion=X_19)  # -> Geometry, Transform
panel_29 = Panel("step7：昂轮廓")
move_23 = Move(Geometry=move_19.Geometry, Motion=X_23)  # -> Geometry, Transform
move_24 = Move(Geometry=end_12.Start, Motion=X_20)  # -> Geometry, Transform
end_15 = EndPoints(Curve=item_15)  # -> Start, End
move_25 = Move(Geometry=end_15.Start, Motion=Z_2)  # -> Geometry, Transform
move_26 = Move(Geometry=move_25.Geometry, Motion=X_5)  # -> Geometry, Transform
move_27 = Move(Geometry=move_25.Geometry, Motion=Z_3)  # -> Geometry, Transform
ln = Line(StartPoint=move_26.Geometry, EndPoint=move_27.Geometry)
ln_2 = Line(StartPoint=move_26.Geometry, EndPoint=move_25.Geometry)
xz = XZPlane(Origin=move_27.Geometry)
xz_2 = XZPlane(Origin=move_27.Geometry)
xz_3 = XZPlane(Origin=move_26.Geometry)
move_28 = Move(Geometry=end_13.Start, Motion=X_21)  # -> Geometry, Transform
divide = DivideCurve(Curve=ln, Count=6, Kinks=False)  # -> Points, Tangents, Parameters
move_29 = Move(Geometry=end_14.Start, Motion=X_22)  # -> Geometry, Transform
Z_9 = UnitZ(Factor=1)
panel_30 = Panel("step7：菊花头")
Z_10 = UnitZ(Factor=1)
rotate = Rotate(Geometry=ln, Angle=1.570796327, Plane=xz_2)  # -> Geometry, Transform
angle = Angle(VectorA=ln_2, VectorB=ln)  # -> Angle, Reflex
Z_11 = UnitZ(Factor=1)
pline = PolyLine(Vertices=merge, Closed=invert(False))
pline_2 = PolyLine(Vertices=merge_2, Closed=invert(False))
Z_12 = UnitZ(Factor=1)
Z_13 = UnitZ(Factor=1)
panel_31 = Panel("step5:十八斗位置（留榫位置）")
Z_14 = UnitZ(Factor=1)
move_30 = Move(Geometry=move_12.Geometry, Motion=X_26)  # -> Geometry, Transform
panel_32 = Panel("step4:拽拱位置（包掩）")
move_31 = Move(Geometry=move_30.Geometry, Motion=X_25)  # -> Geometry, Transform
move_32 = Move(Geometry=move_31.Geometry, Motion=Z_8)  # -> Geometry, Transform
move_33 = Move(Geometry=move_32.Geometry, Motion=X_24)  # -> Geometry, Transform
move_34 = Move(Geometry=move_33.Geometry, Motion=Z_6)  # -> Geometry, Transform
move_35 = Move(Geometry=move_34.Geometry, Motion=X_27)  # -> Geometry, Transform
move_36 = Move(Geometry=end_7.End, Motion=Z_7)  # -> Geometry, Transform
ln_3 = Line(StartPoint=move_35.Geometry, EndPoint=move_36.Geometry)
curvepoint = PointOnCurve(ln_3, parameter=0.5)
xz_4 = XZPlane(Origin=curvepoint)
line = LineSDL(Start=curvepoint, Direction=ln_3, Length=multiplication_11)
rotate_2 = Rotate(Geometry=line, Angle=1.570796327, Plane=xz_4)  # -> Geometry, Transform
end_16 = EndPoints(Curve=rotate_2.Geometry)  # -> Start, End
pt_5 = Point(end_6.End)
pt_6 = Point(end_16.End)
panel_33 = Panel("step6：十八斗位置（十八斗榫）")
division_18 = Division(A=angle.Angle, B=2)
line_2 = LineSDL(Start=divide.Points, Direction=expr("-x", rotate.Geometry), Length=斗口_3)
panel_34 = Panel("step2:正心拱位置（包掩）")
boundary = BoundarySurfaces(Edges=pline)
panel_35 = Panel("step3:拽拱位置")  # disabled
切掉 = 切掉(起点=move_22.Geometry, 宽度方向=item_11, 截面宽=单才拱宽_2, 长度方向=Z_9, 截面长=addition_8, 深度=宽_3, 颠倒深度=invert(False))
切掉_2 = 切掉(起点=move_22.Geometry, 宽度方向=item_11, 截面宽=十八斗宽_3, 长度方向=Z_9, 截面长=addition_6, 深度=宽_3, 颠倒深度=invert(False))
boundary_2 = BoundarySurfaces(Edges=pline_2)
切掉_3 = 切掉(起点=move_20.Geometry, 宽度方向=item_9, 截面宽=单才拱宽_2, 长度方向=Z_11, 截面长=addition_7, 深度=multiplication_8, 颠倒深度=invert(False))
切掉_4 = 切掉(起点=move_16.Geometry, 宽度方向=flip_2.Curve, 截面宽=单才拱宽_2, 长度方向=Z_11, 截面长=addition_7, 深度=multiplication_8, 颠倒深度=False)
切掉_5 = 切掉(宽度方向=Vector(0, 0, 1), 长度方向=Vector(0, 0, 1), 输入截面=制作槽升榫形状, 深度=num_7, 颠倒深度=invert(False))
切掉_6 = 切掉(起点=move_23.Geometry, 宽度方向=item_12, 截面宽=单才拱宽_2, 长度方向=Z_10, 截面长=addition_8, 深度=宽_3, 颠倒深度=invert(False))
切掉_7 = 切掉(起点=move_23.Geometry, 宽度方向=item_12, 截面宽=十八斗宽_3, 长度方向=Z_10, 截面长=addition_6, 深度=宽_3, 颠倒深度=invert(False))
panel_36 = Panel("step1:正心拱位置")
切掉_8 = 切掉(起点=move_21.Geometry, 宽度方向=item_10, 截面宽=单才拱宽_2, 长度方向=Z_12, 截面长=addition_7, 深度=multiplication_8, 颠倒深度=invert(False))
切掉_9 = 切掉(起点=move_18.Geometry, 宽度方向=flip_3.Curve, 截面宽=单才拱宽_2, 长度方向=Z_12, 截面长=addition_7, 深度=multiplication_8, 颠倒深度=False)
切掉_10 = 切掉(宽度方向=Vector(0, 0, 1), 长度方向=Vector(0, 0, 1), 输入截面=制作槽升榫形状_2, 深度=num_7, 颠倒深度=False)
切掉_11 = 切掉(起点=move_28.Geometry, 宽度方向=item_14, 截面宽=正心拱宽_2, 长度方向=Z_14, 截面长=addition_5, 深度=宽_3, 颠倒深度=invert(False))
切掉_12 = 切掉(起点=move_24.Geometry, 宽度方向=item_13, 截面宽=正心拱宽_2, 长度方向=Z_13, 截面长=前高_3, 深度=multiplication_8, 颠倒深度=invert(False))
切掉_13 = 切掉(起点=move_29.Geometry, 宽度方向=flip_4.Curve, 截面宽=正心拱宽_2, 长度方向=Z_13, 截面长=前高_3, 深度=multiplication_8, 颠倒深度=False)
merge_3 = Merge(Data1=切掉_5, Data2=切掉_10)
rotate_3 = Rotate(Geometry=ln, Angle=expr("-x", division_18), Plane=xz_3)  # -> Geometry, Transform
item_16 = ListItem(List=line_2, Index=1, Wrap=True)  # -> Item, Item1, Item2, Item3, Item4
rotate_4 = Rotate(Geometry=ln, Angle=division_18, Plane=xz)  # -> Geometry, Transform
切掉_14 = 切掉(宽度方向=Vector(0, 0, 1), 长度方向=Vector(0, 0, 1), 输入截面=boundary, 深度=宽_2, 颠倒深度=invert(False))
切掉_15 = 切掉(宽度方向=Vector(0, 0, 1), 长度方向=Vector(0, 0, 1), 输入截面=boundary_2, 深度=宽_2, 颠倒深度=False)
merge_4 = Merge(
    Data1=move_36.Geometry,
    Data2=pt_5,
    Data3=move_31.Geometry,
    Data4=move_32.Geometry,
    Data5=move_33.Geometry,
    Data6=move_35.Geometry)
merge_5 = Merge(Data1=item_16.Item1, Data2=item_16.Item)
merge_6 = Merge(Data1=item_16.Item4, Data2=item_16.Item3)
pline_3 = PolyLine(Vertices=merge_4, Closed=False)
arc = Arc3Pt(PointA=move_35.Geometry, PointB=pt_6, PointC=move_36.Geometry)  # -> Arc, Plane, Radius
clx = CurveLine(Curve=rotate_4.Geometry, Line=merge_6)  # -> flatten(Points), Params, Count
clx_2 = CurveLine(Curve=rotate_3.Geometry, Line=merge_5)  # -> flatten(Points), Params, Count
pt_7 = Point(move_27.Geometry)
pt_8 = Point(move_26.Geometry)
multiplication_15 = Multiplication(A=斗口_3, B=Slider(10, range=0..10))
join = JoinCurves(Curves=[pline_3, arc.Arc], Preserve=False)
item_17 = ListItem(List=clx.Points, Index=0, Wrap=True)  # -> Item, Item1
item_18 = ListItem(List=clx_2.Points, Index=0, Wrap=True)  # -> Item, Item1
vec_3 = Vector(rotate.Geometry)
boundary_3 = BoundarySurfaces(Edges=join)
切掉_16 = 切掉(宽度方向=Vector(0, 0, 1), 长度方向=Vector(0, 0, 1), 输入截面=boundary_3, 深度=宽_4, 颠倒深度=invert(False))
X_28 = UnitX(Factor=expr("-x", Slider(3, range=0..10)))
biarc = BiArc(StartPoint=item_18.Item, StartTangent=expr("-x", vec_3), EndPoint=item_18.Item1, EndTangent=vec_3, Ratio=0)  # -> FirstArc, SecondArc, BiArc
biarc_2 = BiArc(StartPoint=item_18.Item1, StartTangent=vec_3, EndPoint=pt_8, EndTangent=expr("-x", vec_3), Ratio=multiplication_15)  # -> FirstArc, SecondArc, BiArc
biarc_3 = BiArc(
    StartPoint=item_17.Item,
    StartTangent=expr("-x", vec_3),
    EndPoint=item_17.Item1,
    EndTangent=vec_3,
    Ratio=multiplication_15)  # -> FirstArc, SecondArc, BiArc
biarc_4 = BiArc(StartPoint=pt_7, StartTangent=vec_3, EndPoint=item_17.Item, EndTangent=expr("-x", vec_3), Ratio=0)  # -> FirstArc, SecondArc, BiArc
X_29 = UnitX(Factor=expr("-x", Slider(3, range=0..10)))
arc_2 = ArcSED(Start=item_17.Item1, End=item_18.Item, Direction=expr("-x", vec_3))  # -> Arc, Plane, Radius
ln_4 = Line(StartPoint=move_25.Geometry, EndPoint=move_27.Geometry)
crv = Curve(ln_2)
move_37 = Move(Geometry=move_30.Geometry, Motion=X_28)  # -> Geometry, Transform
X_30 = UnitX(Factor=expr("-x", Slider(0.3, range=0..10)))
move_38 = Move(Geometry=move_37.Geometry, Motion=X_29)  # -> Geometry, Transform
move_39 = Move(Geometry=move_38.Geometry, Motion=X_30)  # -> Geometry, Transform
merge_7 = Merge(Data1=biarc_4.BiArc, Data2=biarc_3.BiArc, Data3=arc_2.Arc, Data4=biarc.BiArc, Data5=biarc_2.BiArc, Data6=crv, Data7=ln_4)  # -> flatten(Result)
join_2 = JoinCurves(Curves=merge_7, Preserve=False)
boundary_4 = BoundarySurfaces(Edges=join_2)
切掉_17 = 切掉(宽度方向=Vector(0, 0, 1), 长度方向=Vector(0, 0, 1), 输入截面=boundary_4, 深度=宽_2, 颠倒深度=False)
merge_8 = Merge(
    Data1=切掉_11,
    Data2=切掉_12,
    Data3=切掉_13,
    Data4=切掉_6,
    Data5=切掉_7,
    Data6=切掉,
    Data7=切掉_2,
    Data8=切掉_3,
    Data9=切掉_4,
    Data10=切掉_8,
    Data11=切掉_9,
    Data12=切掉_16,
    Data13=merge_3,
    Data14=切掉_15,
    Data15=切掉_14,
    Data16=切掉_17)  # -> flatten(Result)
sdiff = SolidDifference(BrepsA=move_2.Geometry, BrepsB=merge_8)
fmerge = MergeFaces(Brep=sdiff)  # -> Breps, Before, After
rotate_5 = Rotate(Geometry=fmerge.Breps, Angle=1.570796327, Plane=定位点_2)  # -> Geometry, Transform
G = ClusterOutput(rotate_5.Geometry)

# ==== cluster 麻叶云
panel = Panel("长")
panel_2 = Panel("高")
panel_3 = Panel("宽")
panel_4 = Panel("定位点")
panel_5 = Panel("斗口")
肚子大小 = Slider(0.85, range=0..2)
底位置 = Slider(1.77, range=0..4)
顶位置 = Slider(1.77, range=0..2)
右肩高 = Slider(0.25, range=0..2)
右肩宽 = Slider(0.35, range=0..2)
顶宽 = Slider(0.65, range=0..2)
顶左高 = Slider(0.35, range=0..2)
顶右高 = Slider(0.35, range=0..2)
panel_6 = Panel("单才拱高")
panel_7 = Panel("中槽宽")
单才拱高 = ClusterInput()
中槽宽 = ClusterInput()
斗口 = ClusterInput()
高 = ClusterInput()
定位点 = ClusterInput()
长 = ClusterInput()
宽 = ClusterInput()
panel_8 = Panel("包掩")
斗口_2 = Number(斗口)
num = Number(斗口_2)
multiplication = Multiplication(A=num, B=顶右高)
multiplication_2 = Multiplication(A=num, B=右肩高)
multiplication_3 = Multiplication(A=num, B=右肩宽)
multiplication_4 = Multiplication(A=num, B=顶左高)
multiplication_5 = Multiplication(A=num, B=顶宽)
multiplication_6 = Multiplication(A=num, B=肚子大小)
multiplication_7 = Multiplication(A=num, B=底位置)
multiplication_8 = Multiplication(A=num, B=顶位置)
中槽宽_2 = Number(中槽宽)
num_2 = Number(中槽宽_2)
division = Division(A=num_2, B=2)
定位点_2 = Point(定位点)
长_2 = Number(长)
长_3 = Number(长_2)
division_2 = Division(A=长_3, B=2)
dom = ConstructDomain(DomainStart=expr("-x", division_2), DomainEnd=division_2)
division_3 = Division(A=长_3, B=2)
宽_2 = Number(宽)
num_3 = Number(宽_2)
division_4 = Division(A=num_3, B=2)
高_2 = Number(高)
高_3 = Number(高_2)
dom_2 = ConstructDomain(DomainStart=0, DomainEnd=高_3)
单才拱高_2 = Number(单才拱高)
num_4 = Number(单才拱高_2)
multiplication_9 = Multiplication(A=num, B=num_4)
Z = UnitZ(Factor=expr("-x", multiplication_4))
Z_2 = UnitZ(Factor=expr("-x", multiplication))
Z_3 = UnitZ(Factor=expr("-x", multiplication_2))
X = UnitX(Factor=multiplication_3)
X_2 = UnitX(Factor=expr("-x", multiplication_5))
X_3 = UnitX(Factor=division_3)
division_5 = Division(A=单才拱高_2, B=2)
Z_4 = UnitZ(Factor=multiplication_9)
Z_5 = UnitZ(Factor=multiplication_6)
X_4 = UnitX(Factor=division)
X_5 = UnitX(Factor=multiplication_5)
Z_6 = UnitZ(Factor=高_3)
X_6 = UnitX(Factor=multiplication_7)
X_7 = UnitX(Factor=multiplication_8)
multiplication_10 = Multiplication(A=斗口_2, B=Slider(0.1, range=0..0.1))
subtraction = Subtraction(A=高_2, B=division_5)
multiplication_11 = Multiplication(A=multiplication_10, B=2)
制作体块 = 制作体块(定位点=定位点_2, 横向竖向=True, 长=长_2, 宽=宽_2, 高=高_2)
subtraction_2 = Subtraction(A=中槽宽_2, B=multiplication_11)
debrep = DeconstructBrep(Brep=制作体块)  # -> Faces, Edges, Vertices
item = ListItem(List=debrep.Edges, Index=0, Wrap=True)
curvepoint = PointOnCurve(item, parameter=0.5)
定位点_3 = Point(curvepoint)
yz = YZPlane(Origin=定位点_3)
xz = XZPlane(Origin=定位点_3)
planesrf = PlaneSurface(Plane=xz, XSize=dom, YSize=dom_2)
move = Move(Geometry=定位点_3, Motion=X_3)  # -> Geometry, Transform
move_2 = Move(Geometry=move.Geometry, Motion=Z_5)  # -> Geometry, Transform
move_3 = Move(Geometry=定位点_3, Motion=X_6)  # -> Geometry, Transform
move_4 = Move(Geometry=定位点_3, Motion=Z_4)  # -> Geometry, Transform
move_5 = Move(Geometry=move_4.Geometry, Motion=X_4)  # -> Geometry, Transform
move_6 = Move(Geometry=定位点_3, Motion=Z_6)  # -> Geometry, Transform
move_7 = Move(Geometry=move_6.Geometry, Motion=X_7)  # -> Geometry, Transform
move_8 = Move(Geometry=move_7.Geometry, Motion=Z)  # -> Geometry, Transform
move_9 = Move(Geometry=move_7.Geometry, Motion=Z_2)  # -> Geometry, Transform
move_10 = Move(Geometry=move_9.Geometry, Motion=X_5)  # -> Geometry, Transform
move_11 = Move(Geometry=move_10.Geometry, Motion=X)  # -> Geometry, Transform
move_12 = Move(Geometry=move_11.Geometry, Motion=Z_3)  # -> Geometry, Transform
move_13 = Move(Geometry=move_8.Geometry, Motion=X_2)  # -> Geometry, Transform
pt = Point(move_5.Geometry)
xy = XYPlane(Origin=move_2.Geometry)
mirror = Mirror(Geometry=move_10.Geometry, Plane=xy)  # -> Geometry, Transform
ln = Line(StartPoint=move_4.Geometry, EndPoint=pt)
item_2 = ListItem(List=debrep.Edges, Index=5, Wrap=True)
Y = UnitY(Factor=division_4)
Y_2 = UnitY(Factor=num_3)
item_3 = ListItem(List=debrep.Edges, Index=0, Wrap=True)
curvepoint_2 = PointOnCurve(item_2, parameter=0.5)
panel_9 = Panel("内圈")
panel_10 = Panel("外圈")
curvepoint_3 = PointOnCurve(item_3, parameter=0.5)
Z_7 = UnitZ(Factor=expr("-x", 1))
rad = Radians(Degrees=Slider(55, range=0..360))
Z_8 = UnitZ(Factor=1)
Y_3 = UnitY(Factor=1)
rad_2 = Radians(Degrees=Slider(35, range=0..360))
Z_9 = UnitZ(Factor=1)
Y_4 = UnitY(Factor=1)
panel_11 = Panel("step2：得到云轮廓")
panel_12 = Panel("step3：切内圈")
panel_13 = Panel("step1：昂位置")
切掉 = 切掉(起点=curvepoint_2, 宽度方向=item_2, 截面宽=subtraction_2, 长度方向=Z_7, 截面长=subtraction, 深度=宽_2, 颠倒深度=False)
vrot = Rotate(Vector=Z_8, Axis=Y_3, Angle=rad)
vrot_2 = Rotate(Vector=Z_9, Axis=Y_4, Angle=rad_2)
arc = ArcSED(Start=pt, End=move_13.Geometry, Direction=vrot_2)  # -> Arc, Plane, Radius
arc_2 = Arc3Pt(PointA=move_10.Geometry, PointB=move_7.Geometry, PointC=move_13.Geometry)  # -> Arc, Plane, Radius
ln_2 = Line(StartPoint=move_3.Geometry, EndPoint=定位点_3)
X_8 = UnitX(Factor=1)
Z_10 = UnitZ(Factor=1)
multiplication_12 = Multiplication(A=num, B=Slider(0.2, range=0..1))
Z_11 = UnitZ(Factor=1)
Y_5 = UnitY(Factor=1)
vrot_3 = Rotate(Vector=Z_11, Axis=Y_5, Angle=degrees(Slider(335, range=0..360)))
X_9 = UnitX(Factor=1)
arc_3 = ArcSED(Start=move_12.Geometry, End=move_10.Geometry, Direction=vrot_3)  # -> Arc, Plane, Radius
Z_12 = UnitZ(Factor=1)
biarc = BiArc(StartPoint=move_3.Geometry, StartTangent=X_9, EndPoint=mirror.Geometry, EndTangent=Z_12, Ratio=Slider(1, range=0..1))  # -> FirstArc, SecondArc, BiArc
crv = Curve(biarc.BiArc)
Z_13 = UnitZ(Factor=expr("-x", 1))
X_10 = UnitX(Factor=1)
mirror_2 = Mirror(Geometry=arc_3.Arc, Plane=xy)  # -> Geometry, Transform
biarc_2 = BiArc(
    StartPoint=move_12.Geometry,
    StartTangent=X_10,
    EndPoint=move_2.Geometry,
    EndTangent=Z_13,
    Ratio=Slider(0.55, range=0..1))  # -> FirstArc, SecondArc, BiArc
crv_2 = Curve(biarc_2.BiArc)
mirror_3 = Mirror(Geometry=crv_2, Plane=xy)  # -> Geometry, Transform
join = JoinCurves(Curves=[arc_2.Arc, arc_3.Arc, crv_2, mirror_3.Geometry, mirror_2.Geometry], Preserve=False)
offset = Offset(Curve=join, Distance=expr("-x", multiplication_12), Plane=PlaneXY(0, 0, 0), Corners=1)
end = EndPoints(Curve=offset)  # -> Start, End
arc_4 = ArcSED(Start=pt, End=end.End, Direction=vrot)  # -> Arc, Plane, Radius
biarc_3 = BiArc(StartPoint=move_3.Geometry, StartTangent=X_8, EndPoint=end.Start, EndTangent=Z_10, Ratio=Slider(1, range=0..1))  # -> FirstArc, SecondArc, BiArc
crv_3 = Curve(biarc_3.BiArc)
merge = Merge(Data1=arc_4.Arc, Data2=offset, Data3=crv_3)
join_2 = JoinCurves(Curves=merge, Preserve=False)
crv_4 = Curve(join_2)
move_14 = Move(Geometry=crv_4, Motion=Y_2)  # -> Geometry, Transform
merge_2 = Merge(
    Data1=ln,
    Data2=arc.Arc,
    Data3=arc_2.Arc,
    Data4=arc_3.Arc,
    Data5=crv_2,
    Data6=mirror_3.Geometry,
    Data7=mirror_2.Geometry,
    Data8=crv,
    Data9=ln_2)  # -> flatten(Result)
merge_3 = Merge(
    Data1=arc.Arc,
    Data2=arc_2.Arc,
    Data3=arc_3.Arc,
    Data4=crv_2,
    Data5=mirror_3.Geometry,
    Data6=mirror_2.Geometry,
    Data7=crv)  # -> flatten(Result)
join_3 = JoinCurves(Curves=merge_2, Preserve=False)
join_4 = JoinCurves(Curves=merge_3, Preserve=False)
crv_5 = Curve(join_4)
move_15 = Move(Geometry=crv_5, Motion=Y)  # -> Geometry, Transform
merge_4 = Merge(Data1=flatten(crv_4), Data2=flatten(move_15.Geometry), Data3=flatten(move_14.Geometry))
loft = Loft(Curves=merge_4, Options={Adjust=False, Closed=False, LoftEnds=0, LoftSimp=0, LoftType=3, Rebuild=10, Refit=0.01})
mirror_4 = Mirror(Geometry=loft, Plane=yz)  # -> Geometry, Transform
crv_6 = Curve(join_3)
mirror_5 = Mirror(Geometry=crv_6, Plane=yz)  # -> Geometry, Transform
panel_14 = Panel("外轮廓")
join_5 = JoinCurves(Curves=flatten([crv_6, mirror_5.Geometry]), Preserve=False)
srfsplit = SurfaceSplit(Surface=planesrf, Curves=join_5)
item_4 = ListItem(List=srfsplit, Index=0, Wrap=True)  # -> Item, Item1, Item2, Item3, Item4
切掉_2 = 切掉(起点=curvepoint_3, 宽度方向=Vector(0, 0, 1), 长度方向=Vector(0, 0, 1), 输入截面=item_4.Item, 深度=宽_2, 颠倒深度=False)
切掉_3 = 切掉(起点=curvepoint_3, 宽度方向=Vector(0, 0, 1), 长度方向=Vector(0, 0, 1), 输入截面=item_4.Item1, 深度=宽_2, 颠倒深度=False)
切掉_4 = 切掉(起点=curvepoint_3, 宽度方向=Vector(0, 0, 1), 长度方向=Vector(0, 0, 1), 输入截面=item_4.Item2, 深度=宽_2, 颠倒深度=False)
切掉_5 = 切掉(起点=curvepoint_3, 宽度方向=Vector(0, 0, 1), 长度方向=Vector(0, 0, 1), 输入截面=item_4.Item3, 深度=宽_2, 颠倒深度=False)
切掉_6 = 切掉(起点=curvepoint_3, 宽度方向=Vector(0, 0, 1), 长度方向=Vector(0, 0, 1), 输入截面=item_4.Item4, 深度=宽_2, 颠倒深度=False)
merge_5 = Merge(Data1=切掉, Data2=切掉_2, Data3=切掉_3, Data4=切掉_4, Data5=切掉_5, Data6=切掉_6)  # -> flatten(Result)
sdiff = SolidDifference(BrepsA=制作体块, BrepsB=merge_5)
brep = Brep(sdiff)
split = SplitBrep(Brep=brep, Cutter=loft)
item_5 = ListItem(List=split, Index=1, Wrap=True)
split_2 = SplitBrep(Brep=item_5, Cutter=mirror_4.Geometry)
item_6 = ListItem(List=split_2, Index=0, Wrap=True)
merge_6 = Merge(Data1=item_6, Data2=loft, Data3=mirror_4.Geometry)  # -> flatten(Result)
sunion = SolidUnion(Breps=merge_6)
R = ClusterOutput(sunion)

# ==== cluster 枋
燕尾榫 = ClusterInput()
燕尾榫位置 = ClusterInput()
中槽宽 = ClusterInput()
斗口 = ClusterInput()
高 = ClusterInput()
定位点 = ClusterInput()
长 = ClusterInput()
宽 = ClusterInput()
panel = Panel("包掩")
燕尾榫_2 = Number(燕尾榫)
燕尾榫位置_2 = Integer(燕尾榫位置)
斗口_2 = Number(斗口)
中槽宽_2 = Number(中槽宽)
定位点_2 = Point(定位点)
长_2 = Number(长)
宽_2 = Number(宽)
高_2 = Number(高)
division = Division(A=高_2, B=2)
multiplication = Multiplication(A=斗口_2, B=Slider(0.1, range=0..0.1))
制作体块 = 制作体块(定位点=定位点_2, 横向竖向=True, 长=长_2, 宽=宽_2, 高=高_2)
multiplication_2 = Multiplication(A=multiplication, B=2)
subtraction = Subtraction(A=中槽宽_2, B=multiplication_2)
debrep = DeconstructBrep(Brep=制作体块)  # -> Faces, Edges, Vertices
division_2 = Division(A=燕尾榫_2, B="3")
item = ListItem(List=debrep.Edges, Index=燕尾榫位置_2, Wrap=True)
item_2 = ListItem(List=debrep.Edges, Index=5, Wrap=True)
curvepoint = PointOnCurve(item, parameter=0.5)
vec2pt = Vector2Pt(PointA=curvepoint, PointB=定位点_2, Unitize=invert(False))  # -> Vector, Length
curvepoint_2 = PointOnCurve(item_2, parameter=0.5)
multiplication_3 = Multiplication(A=division_2, B=vec2pt.Vector)
Z = UnitZ(Factor=expr("-x", 1))
move = Move(Geometry=curvepoint, Motion=multiplication_3)  # -> Geometry, Transform
xz = XZPlane(Origin=Point(0, 0, 0))
燕尾榫_3 = 燕尾榫(定位点=move.Geometry, 宽度方向=item, 长度方向=vec2pt.Vector, 连接长度=燕尾榫_2, 取几份="3", 收分=0.9)
panel_2 = Panel("step1：翘位置")
panel_3 = Panel("step1：燕尾榫")
切掉 = 切掉(起点=curvepoint_2, 宽度方向=item_2, 截面宽=subtraction, 长度方向=Z, 截面长=division, 深度=宽_2, 颠倒深度=False)
切掉_2 = 切掉(宽度方向=Vector(0, 0, 1), 长度方向=Vector(0, 0, 1), 输入截面=燕尾榫_3, 深度=高_2, 颠倒深度=False)
merge = Merge(Data1=切掉, Data2=切掉_2)  # -> flatten(Result)
sdiff = SolidDifference(BrepsA=制作体块, BrepsB=merge)
R = ClusterOutput(sdiff)

# ==== cluster 蚂蚱头
正心枋宽 = ClusterInput()
高 = ClusterInput()
十八斗高 = ClusterInput()
定位点 = ClusterInput()
斗口 = ClusterInput()
长 = ClusterInput()
宽 = ClusterInput()
十八斗宽 = ClusterInput()
单才拱高 = ClusterInput()
panel = Panel("""十八斗底收进长度，
十八斗腰高""")
十八斗高_2 = Number(十八斗高)
正心枋宽_2 = Number(正心枋宽)
定位点_2 = Point(定位点)
长_2 = Number(长)
宽_2 = Number(宽)
高_2 = Number(高)
panel_2 = Panel("包掩")
panel_4 = Panel("一拽架")
十八斗宽_2 = Number(十八斗宽)
panel_5 = Panel("十八斗底宽")
panel_6 = Panel("十八斗底高")
panel_7 = Panel("斗口")
斗口_2 = Number(斗口)
panel_8 = Panel("十八斗腰高")
单才拱高_2 = Number(单才拱高)
multiplication = Multiplication(A=斗口_2, B=3)
panel_9 = Panel("蚂蚱头宽")
panel_11 = Panel("十八斗耳高")
panel_12 = Panel("""斗底高
斗耳高""")
panel_13 = Panel("斗底收进长度，斗腰高")
division = Division(A=长_2, B=2)
斗口_3 = Number(斗口)
expression = Expression(x=十八斗高_2, Expression="x*1/5")
num = Number(expression)
expression_2 = Expression(x=十八斗高_2, Expression="x*2/5")
num_2 = Number(expression_2)
division_2 = Division(A=高_2, B=2)
斗口_4 = Number(斗口)
宽_3 = Number(宽)
division_3 = Division(A=单才拱高_2, B=2)
expression_3 = Expression(x=multiplication, y=斗口_2, Expression="x*2+y")
宽_4 = Number(宽)
num_3 = Number(expression)
num_4 = Number(expression_2)
斗口_5 = Number(斗口)
multiplication_2 = Multiplication(A=斗口_2, B=Slider(0.1, range=0..0.1))
num_5 = Number(multiplication_2)
宽_5 = Number(宽)
num_6 = Number(expression_2)
斗口_6 = Number(斗口)
addition = Addition(A="30", B=120)
subtraction = Subtraction(A=addition, B=30)
制作体块 = 制作体块(定位点=定位点_2, 横向竖向=True, 长=长_2, 宽=宽_2, 高=高_2)
addition_2 = Addition(A=num, B=num_2)
multiplication_3 = Multiplication(A=expression, B=2)
subtraction_2 = Subtraction(A=十八斗宽_2, B=multiplication_3)
num_7 = Number(subtraction_2)
expression_4 = Expression(x=num_7, y=斗口_3, Expression="y-x/2")
division_4 = Division(A=宽_5, B=2)
斗口_7 = Number(斗口)
宽_6 = Number(宽)
num_8 = Number(expression)
num_9 = Number(expression_2)
num_10 = Number(subtraction_2)
subtraction_3 = Subtraction(A=division, B=expression_3)
X = UnitX(Factor=expr("-x", subtraction_3))
expression_5 = Expression(x=multiplication, y=斗口_2, Expression="x*4+y")
expression_6 = Expression(x=multiplication, y=斗口_2, Expression="x*4+y")
expression_7 = Expression(x=multiplication, y=斗口_2, Expression="x*3+y")
expression_8 = Expression(x=multiplication, y=斗口_2, Expression="x+y")
expression_9 = Expression(x=multiplication, y=斗口_2, Expression="x*3+y")
expression_10 = Expression(x=multiplication, y=斗口_2, Expression="x+y")
expression_11 = Expression(x=num_10, y=斗口_7, Expression="x/2+y")
addition_3 = Addition(A=num_8, B=num_9)
expression_12 = Expression(x=multiplication, y=斗口_2, Expression="x*4+y")
expression_13 = Expression(x=multiplication, y=斗口_2, Expression="x*3+y")
expression_14 = Expression(x=multiplication, y=斗口_2, Expression="x+y")
move = Move(Geometry=制作体块, Motion=X)  # -> Geometry, Transform
debrep = DeconstructBrep(Brep=move.Geometry)  # -> Faces, Edges, Vertices
item = ListItem(List=debrep.Edges, Index=9, Wrap=True)
item_2 = ListItem(List=debrep.Edges, Index=5, Wrap=True)
item_3 = ListItem(List=debrep.Edges, Index=0, Wrap=True)
item_4 = ListItem(List=debrep.Edges, Index=5, Wrap=True)
item_5 = ListItem(List=debrep.Edges, Index=0, Wrap=True)
item_6 = ListItem(List=debrep.Edges, Index=2, Wrap=True)
item_7 = ListItem(List=debrep.Edges, Index=2, Wrap=True)
item_8 = ListItem(List=debrep.Edges, Index=0, Wrap=True)
X_2 = UnitX(Factor=expr("-x", expression_8))
X_3 = UnitX(Factor=expr("-x", expression_5))
item_9 = ListItem(List=debrep.Edges, Index=0, Wrap=True)
X_4 = UnitX(Factor=expr("-x", expression_10))
X_5 = UnitX(Factor=expr("-x", expression_6))
X_6 = UnitX(Factor=expr("-x", expression_4))
X_7 = UnitX(Factor=expr("-x", expression_7))
X_8 = UnitX(Factor=expr("-x", expression_4))
item_10 = ListItem(List=debrep.Edges, Index=5, Wrap=True)
X_9 = UnitX(Factor=expr("-x", expression_9))
end = EndPoints(Curve=item_2)  # -> Start, End
item_11 = ListItem(List=debrep.Edges, Index=0, Wrap=True)
end_2 = EndPoints(Curve=item_3)  # -> Start, End
end_3 = EndPoints(Curve=item)  # -> Start, End
item_12 = ListItem(List=debrep.Edges, Index=2, Wrap=True)
item_13 = ListItem(List=debrep.Edges, Index=0, Wrap=True)
X_10 = UnitX(Factor=expr("-x", expression_3))
item_14 = ListItem(List=debrep.Edges, Index=0, Wrap=True)
X_11 = UnitX(Factor=expr("-x", expression_3))
item_15 = ListItem(List=debrep.Edges, Index=0, Wrap=True)
X_12 = UnitX(Factor=expr("-x", expression_3))
item_16 = ListItem(List=debrep.Edges, Index=0, Wrap=True)
end_4 = EndPoints(Curve=item_5)  # -> Start, End
end_5 = EndPoints(Curve=item_6)  # -> Start, End
X_13 = UnitX(Factor=expr("-x", expression_14))
end_6 = EndPoints(Curve=item_7)  # -> Start, End
end_7 = EndPoints(Curve=item_8)  # -> Start, End
end_8 = EndPoints(Curve=item_4)  # -> Start, End
X_14 = UnitX(Factor=expr("-x", expression_12))
X_15 = UnitX(Factor=expr("-x", expression_13))
X_16 = UnitX(Factor=expr("-x", 斗口_4))
Z = UnitZ(Factor=num_6)
end_9 = EndPoints(Curve=item_11)  # -> Start, End
Z_2 = UnitZ(Factor=斗口_4)
end_10 = EndPoints(Curve=item_12)  # -> Start, End
end_11 = EndPoints(Curve=item_10)  # -> Start, End
end_12 = EndPoints(Curve=item_13)  # -> Start, End
move_2 = Move(Geometry=end.Start, Motion=X_6)  # -> Geometry, Transform
move_3 = Move(Geometry=end_3.End, Motion=X_8)  # -> Geometry, Transform
end_13 = EndPoints(Curve=item_15)  # -> Start, End
end_14 = EndPoints(Curve=item_16)  # -> Start, End
move_4 = Move(Geometry=end_4.Start, Motion=X_2)  # -> Geometry, Transform
move_5 = Move(Geometry=end_5.End, Motion=X_3)  # -> Geometry, Transform
move_6 = Move(Geometry=end_4.Start, Motion=X_7)  # -> Geometry, Transform
move_7 = Move(Geometry=end_6.End, Motion=X_4)  # -> Geometry, Transform
move_8 = Move(Geometry=end_7.Start, Motion=X_5)  # -> Geometry, Transform
end_15 = EndPoints(Curve=item_14)  # -> Start, End
move_9 = Move(Geometry=end_6.End, Motion=X_9)  # -> Geometry, Transform
Z_3 = UnitZ(Factor=num_4)
pt = Point(move_2.Geometry)
pt_2 = Point(move_3.Geometry)
vec = Vector(item_2)
vec_2 = Vector(item)
X_17 = UnitX(Factor=expr("-x", expression_11))
Z_4 = UnitZ(Factor=expr("-x", addition_3))
move_10 = Move(Geometry=end_9.Start, Motion=X_10)  # -> Geometry, Transform
move_11 = Move(Geometry=end_10.End, Motion=X_11)  # -> Geometry, Transform
move_12 = Move(Geometry=end_12.Start, Motion=X_12)  # -> Geometry, Transform
Z_5 = UnitZ(Factor=expr("-x", 斗口_7))
X_18 = UnitX(Factor=num_10)
move_13 = Move(Geometry=end_13.Start, Motion=X_13)  # -> Geometry, Transform
move_14 = Move(Geometry=end_14.Start, Motion=X_14)  # -> Geometry, Transform
move_15 = Move(Geometry=end_13.Start, Motion=X_15)  # -> Geometry, Transform
Z_6 = UnitZ(Factor=1)
制作槽升榫形状 = 制作槽升榫形状(起始点=pt_2, 起始方向=expr("-x", vec_2), 槽升底长=num_7, 槽升底收进=num, 槽升腰高=num, 槽升位高度=addition_2)
Z_7 = UnitZ(Factor=1)
move_16 = Move(Geometry=item_9, Motion=Z)  # -> Geometry, Transform
Z_8 = UnitZ(Factor=1)
制作槽升榫形状_2 = 制作槽升榫形状(起始点=pt, 起始方向=vec, 槽升底长=num_7, 槽升底收进=num, 槽升腰高=num, 槽升位高度=addition_2)
Z_9 = UnitZ(Factor=1)
pt_3 = Point(end_2.Start)
move_17 = Move(Geometry=pt_3, Motion=Z_2)  # -> Geometry, Transform
move_18 = Move(Geometry=pt_3, Motion=X_16)  # -> Geometry, Transform
Z_10 = UnitZ(Factor=1)
Z_11 = UnitZ(Factor=1)
Z_12 = UnitZ(Factor=1)
Z_13 = UnitZ(Factor=1)
move_19 = Move(Geometry=item_14, Motion=Z_3)  # -> Geometry, Transform
Z_14 = UnitZ(Factor=expr("-x", num_3))
panel_25 = Panel("step7:十八斗位置（留榫位置）")
pt_4 = Point(end_8.Start)
move_20 = Move(Geometry=pt_4, Motion=X_17)  # -> Geometry, Transform
move_21 = Move(Geometry=move_20.Geometry, Motion=Z_4)  # -> Geometry, Transform
move_22 = Move(Geometry=move_21.Geometry, Motion=X_18)  # -> Geometry, Transform
move_23 = Move(Geometry=pt_4, Motion=Z_5)  # -> Geometry, Transform
panel_26 = Panel("step4:拽拱位置（包掩）")
panel_27 = Panel("step2:正心枋位置（包掩）")
panel_28 = Panel("step6:厢拱位置（包掩）")
panel_29 = Panel("step8：十八斗位置（十八斗榫）")
panel_30 = Panel("step1:正心枋位置")
panel_31 = Panel("step3:拽拱位置")
panel_32 = Panel("step5:厢拱位置")
切掉 = 切掉(起点=move_10.Geometry, 宽度方向=item_11, 截面宽=正心枋宽_2, 长度方向=Z_6, 截面长=division_2, 深度=宽_2, 颠倒深度=invert(False))
panel_33 = Panel("step10：蚂蚱头轮廓")
切掉_2 = 切掉(起点=move_12.Geometry, 宽度方向=item_13, 截面宽=正心枋宽_2, 长度方向=Z_9, 截面长=高_2, 深度=multiplication_2, 颠倒深度=invert(False))
panel_34 = Panel("step9：六分头")
切掉_3 = 切掉(起点=move_11.Geometry, 宽度方向=item_12, 截面宽=正心枋宽_2, 长度方向=Z_9, 截面长=高_2, 深度=multiplication_2, 颠倒深度=invert(False))
切掉_4 = 切掉(起点=move_13.Geometry, 宽度方向=item_15, 截面宽=正心枋宽_2, 长度方向=Z_7, 截面长=division_3, 深度=宽_2, 颠倒深度=invert(False))
切掉_5 = 切掉(起点=move_15.Geometry, 宽度方向=item_15, 截面宽=正心枋宽_2, 长度方向=Z_7, 截面长=division_3, 深度=宽_2, 颠倒深度=invert(False))
切掉_6 = 切掉(起点=move_14.Geometry, 宽度方向=item_16, 截面宽=正心枋宽_2, 长度方向=Z_8, 截面长=division_3, 深度=宽_2, 颠倒深度=invert(False))
切掉_7 = 切掉(起点=move_4.Geometry, 宽度方向=item_5, 截面宽=正心枋宽_2, 长度方向=Z_10, 截面长=单才拱高_2, 深度=multiplication_2, 颠倒深度=invert(False))
切掉_8 = 切掉(起点=move_6.Geometry, 宽度方向=item_5, 截面宽=正心枋宽_2, 长度方向=Z_10, 截面长=单才拱高_2, 深度=multiplication_2, 颠倒深度=invert(False))
切掉_9 = 切掉(起点=move_14.Geometry, 宽度方向=item_16, 截面宽=十八斗宽_2, 长度方向=Z_8, 截面长=expression_2, 深度=宽_2, 颠倒深度=invert(False))
切掉_10 = 切掉(起点=move_5.Geometry, 宽度方向=item_6, 截面宽=正心枋宽_2, 长度方向=Z_11, 截面长=单才拱高_2, 深度=multiplication_2, 颠倒深度=invert(False))
merge = Merge(Data1=pt_3, Data2=move_18.Geometry, Data3=move_17.Geometry)
切掉_11 = 切掉(起点=move_7.Geometry, 宽度方向=item_7, 截面宽=正心枋宽_2, 长度方向=Z_12, 截面长=单才拱高_2, 深度=multiplication_2, 颠倒深度=invert(False))
切掉_12 = 切掉(起点=move_8.Geometry, 宽度方向=item_8, 截面宽=正心枋宽_2, 长度方向=Z_13, 截面长=单才拱高_2, 深度=multiplication_2, 颠倒深度=invert(False))
切掉_13 = 切掉(起点=move_9.Geometry, 宽度方向=item_7, 截面宽=正心枋宽_2, 长度方向=Z_12, 截面长=单才拱高_2, 深度=multiplication_2, 颠倒深度=invert(False))
pt_5 = Point(end_11.End)
move_24 = Move(Geometry=pt_5, Motion=Z_14)  # -> Geometry, Transform
line = LineSDL(Start=move_24.Geometry, Direction=Vector(0, 0, 1), Length=斗口_5)
xz = XZPlane(Origin=move_24.Geometry)
rotate = Rotate(Geometry=line, Angle=expr("-x", degrees(45)), Plane=xz)  # -> Geometry, Transform
ccx = CurveCurve(CurveA=item_10, CurveB=rotate.Geometry)  # -> Points, ParamsA, ParamsB
pt_6 = Point(ccx.Points)
line_2 = LineSDL(Start=pt_6, Direction=Vector(0, 0, 1), Length=expr("2*x", 斗口_6))
xz_2 = XZPlane(Origin=pt_6)
rotate_2 = Rotate(Geometry=line_2, Angle=expr("-x", degrees(150)), Plane=xz_2)  # -> Geometry, Transform
ccx_2 = CurveCurve(CurveA=rotate_2.Geometry, CurveB=move_16.Geometry)  # -> Points, ParamsA, ParamsB
xz_3 = XZPlane(Origin=ccx_2.Points)
line_3 = LineSDL(Start=ccx_2.Points, Direction=Vector(0, 0, 1), Length=斗口_6)
rotate_3 = Rotate(Geometry=line_3, Angle=expr("-x", degrees(120)), Plane=xz_3)  # -> Geometry, Transform
ccx_3 = CurveCurve(CurveA=item_14, CurveB=rotate_3.Geometry)  # -> Points, ParamsA, ParamsB
pt_7 = Point(move_24.Geometry)
line_4 = LineSDL(Start=pt_7, Direction=Vector(0, 0, 1), Length=expr("2*x", 斗口_5))
rotate_4 = Rotate(Geometry=line_4, Angle=expr("-x", degrees(addition)), Plane=xz)  # -> Geometry, Transform
ccx_4 = CurveCurve(CurveA=rotate_4.Geometry, CurveB=move_19.Geometry)  # -> Points, ParamsA, ParamsB
line_5 = LineSDL(Start=ccx_4.Points, Direction=Vector(0, 0, 1), Length=斗口_5)
xz_4 = XZPlane(Origin=ccx_4.Points)
rotate_5 = Rotate(Geometry=line_5, Angle=expr("-x", degrees(subtraction)), Plane=xz_4)  # -> Geometry, Transform
ccx_5 = CurveCurve(CurveA=item_14, CurveB=rotate_5.Geometry)  # -> Points, ParamsA, ParamsB
merge_2 = Merge(Data1=flatten(pt_7), Data2=flatten(ccx_4.Points), Data3=flatten(ccx_5.Points))
pt_8 = Point(end_15.End)
切掉_14 = 切掉(宽度方向=Vector(0, 0, 1), 长度方向=Vector(0, 0, 1), 输入截面=制作槽升榫形状, 深度=num_5, 颠倒深度=invert(False))
切掉_15 = 切掉(宽度方向=Vector(0, 0, 1), 长度方向=Vector(0, 0, 1), 输入截面=制作槽升榫形状_2, 深度=num_5, 颠倒深度=False)
merge_3 = Merge(Data1=切掉_15, Data2=切掉_14)
panel_35 = Panel("step11：蚂蚱头")
merge_4 = Merge(Data1=pt_4, Data2=move_20.Geometry, Data3=move_21.Geometry, Data4=move_22.Geometry, Data5=move_23.Geometry)
pline = PolyLine(Vertices=merge, Closed=invert(False))
Y = UnitY(Factor=宽_5)
pline_2 = PolyLine(Vertices=merge_2, Closed=False)
Y_2 = UnitY(Factor=division_4)
merge_5 = Merge(Data1=flatten(pt_6), Data2=flatten(ccx_2.Points), Data3=flatten(ccx_3.Points))
merge_6 = Merge(Data1=切掉_2, Data2=切掉_3)
pline_3 = PolyLine(Vertices=merge_4, Closed=invert(False))
merge_7 = Merge(Data1=切掉_4, Data2=切掉_5)
boundary = BoundarySurfaces(Edges=pline)
merge_8 = Merge(Data1=flatten(pt_7), Data2=flatten(ccx_4.Points), Data3=flatten(ccx_5.Points), Data4=flatten(pt_8))
merge_9 = Merge(Data1=切掉_6, Data2=切掉_9)
merge_10 = Merge(Data1=切掉_7, Data2=切掉_8, Data3=切掉_11, Data4=切掉_13)
merge_11 = Merge(Data1=flatten(pt_5), Data2=flatten(move_24.Geometry), Data3=flatten(ccx.Points))
merge_12 = Merge(Data1=切掉_12, Data2=切掉_10)
boundary_2 = BoundarySurfaces(Edges=pline_3)
切掉_16 = 切掉(宽度方向=Vector(0, 0, 1), 长度方向=Vector(0, 0, 1), 输入截面=boundary, 深度=宽_3, 颠倒深度=invert(False))
pline_4 = PolyLine(Vertices=merge_5, Closed=False)
move_25 = Move(Geometry=pline_4, Motion=Y)  # -> Geometry, Transform
pline_5 = PolyLine(Vertices=merge_8, Closed=invert(False))
move_26 = Move(Geometry=pline_2, Motion=Y_2)  # -> Geometry, Transform
pline_6 = PolyLine(Vertices=merge_11, Closed=invert(False))
切掉_17 = 切掉(宽度方向=Vector(0, 0, 1), 长度方向=Vector(0, 0, 1), 输入截面=boundary_2, 深度=宽_6, 颠倒深度=False)
merge_13 = Merge(Data1=pline_4, Data2=move_26.Geometry, Data3=move_25.Geometry)
boundary_3 = BoundarySurfaces(Edges=pline_5)
boundary_4 = BoundarySurfaces(Edges=pline_6)
切掉_18 = 切掉(宽度方向=Vector(0, 0, 1), 长度方向=Vector(0, 0, 1), 输入截面=boundary_3, 深度=宽_4, 颠倒深度=invert(False))
loft = Loft(Curves=merge_13, Options={Adjust=False, Closed=False, LoftEnds=0, LoftSimp=0, LoftType=3, Rebuild=10, Refit=0.01})
切掉_19 = 切掉(宽度方向=Vector(0, 0, 1), 长度方向=Vector(0, 0, 1), 输入截面=boundary_4, 深度=宽_4, 颠倒深度=False)
merge_14 = Merge(Data1=切掉_19, Data2=切掉_18)
merge_15 = Merge(
    Data1=切掉,
    Data2=merge_6,
    Data3=merge_7,
    Data4=merge_10,
    Data5=merge_9,
    Data6=merge_12,
    Data7=切掉_17,
    Data8=merge_3,
    Data9=切掉_16,
    Data10=merge_14)  # -> flatten(Result)
sdiff = SolidDifference(BrepsA=move.Geometry, BrepsB=merge_15)
split = SplitBrep(Brep=sdiff, Cutter=loft)
item_17 = ListItem(List=split, Index=0, Wrap=True)
sunion = SolidUnion(Breps=flatten([loft, item_17]))
fmerge = MergeFaces(Brep=sunion)  # -> Breps, Before, After
rotate_6 = Rotate(Geometry=fmerge.Breps, Angle=1.570796327, Plane=定位点_2)  # -> Geometry, Transform
G = ClusterOutput(rotate_6.Geometry)

# ==== cluster 撑头木
panel = Panel("定位点")
panel_2 = Panel("斗口")
panel_3 = Panel("麻叶头长")
panel_4 = Panel("高")
panel_5 = Panel("宽")
panel_6 = Panel("十八斗宽")
左定位 = Slider(0.2, range=0..2)
起点位置 = Slider(0.4, range=0..2)
底位置 = Slider(1.813, range=0..4)
顶位置 = Slider(2.115, range=0..3)
肚子大小 = Slider(0.9, range=0..2)
起点高 = Slider(0.15, range=0..2)
右肩高 = Slider(0.229, range=0..2)
右肩宽 = Slider(0.367, range=0..2)
顶宽 = Slider(0.466, range=0..2)
顶左高 = Slider(0.208, range=0..2)
顶右高 = Slider(0.29, range=0..2)
右下高 = Slider(0.175, range=0..2)
右下宽 = Slider(0.419, range=0..2)
Z = UnitZ(Factor=expr("-x", 起点高))
X = UnitX(Factor=起点位置)
正心枋宽 = ClusterInput()
高 = ClusterInput()
十八斗高 = ClusterInput()
定位点 = ClusterInput()
斗口 = ClusterInput()
长 = ClusterInput()
宽 = ClusterInput()
十八斗宽 = ClusterInput()
单才拱高 = ClusterInput()
十八斗高_2 = Number(十八斗高)
高_2 = Number(高)
高_3 = Number(高_2)
dom = ConstructDomain(DomainStart=0, DomainEnd=高_3)
Z_2 = UnitZ(Factor=高_3)
正心枋宽_2 = Number(正心枋宽)
定位点_2 = Point(定位点)
长_2 = Number(长)
宽_2 = Number(宽)
num = Number(宽_2)
division = Division(A=num, B=2)
panel_8 = Panel("包掩")
panel_9 = Panel("一拽架")
十八斗宽_2 = Number(十八斗宽)
num_2 = Number(十八斗宽_2)
addition = Addition(A=num_2, B=左定位)
division_2 = Division(A=addition, B=2)
X_2 = UnitX(Factor=division_2)
斗口_2 = Number(斗口)
num_3 = Number(斗口_2)
multiplication = Multiplication(A=num_3, B=顶右高)
multiplication_2 = Multiplication(A=num_3, B=高_3)
multiplication_3 = Multiplication(A=num_3, B=右肩高)
multiplication_4 = Multiplication(A=num_3, B=右肩宽)
multiplication_5 = Multiplication(A=num_3, B=顶左高)
multiplication_6 = Multiplication(A=num_3, B=顶宽)
multiplication_7 = Multiplication(A=num_3, B=右下高)
multiplication_8 = Multiplication(A=num_3, B=右下宽)
multiplication_9 = Multiplication(A=num_3, B=肚子大小)
multiplication_10 = Multiplication(A=num_3, B=底位置)
multiplication_11 = Multiplication(A=num_3, B=顶位置)
Z_3 = UnitZ(Factor=expr("-x", multiplication_5))
Z_4 = UnitZ(Factor=expr("-x", multiplication))
Z_5 = UnitZ(Factor=expr("-x", multiplication_3))
X_3 = UnitX(Factor=multiplication_4)
Z_6 = UnitZ(Factor=expr("-x", multiplication_7))
X_4 = UnitX(Factor=expr("-x", multiplication_6))
X_5 = UnitX(Factor=expr("-x", multiplication_8))
Z_7 = UnitZ(Factor=multiplication_2)
Z_8 = UnitZ(Factor=multiplication_9)
X_6 = UnitX(Factor=multiplication_6)
X_7 = UnitX(Factor=multiplication_10)
X_8 = UnitX(Factor=multiplication_11)
单才拱高_2 = Number(单才拱高)
multiplication_12 = Multiplication(A=斗口_2, B=3)
multiplication_13 = Multiplication(A=multiplication_12, B=4)
X_9 = UnitX(Factor=multiplication_13)
multiplication_14 = Multiplication(A=multiplication_12, B=4)
subtraction = Subtraction(A=长_2, B=multiplication_14)
num_4 = Number(subtraction)
dom_2 = ConstructDomain(DomainStart=expr("-x", 0), DomainEnd=num_4)
X_10 = UnitX(Factor=num_4)
panel_10 = Panel("斗耳高")
division_3 = Division(A=长_2, B=2)
division_4 = Division(A=高_2, B=2)
expression = Expression(x=十八斗高_2, Expression="x*2/5")
division_5 = Division(A=单才拱高_2, B=2)
multiplication_15 = Multiplication(A=multiplication_12, B=2)
multiplication_16 = Multiplication(A=斗口_2, B=Slider(0.1, range=0..0.1))
Z_9 = UnitZ(Factor=expr("-x", 1))
X_11 = UnitX(Factor=1)
制作体块 = 制作体块(定位点=定位点_2, 横向竖向=True, 长=长_2, 宽=宽_2, 高=高_2)
subtraction_2 = Subtraction(A=multiplication_15, B=division_3)
宽_3 = Number(宽_2)
高_4 = Number(高_2)
multiplication_17 = Multiplication(A=multiplication_12, B=3)
multiplication_18 = Multiplication(A=multiplication_12, B=1)
X_12 = UnitX(Factor=expr("-x", subtraction_2))
division_6 = Division(A=宽_3, B=2)
division_7 = Division(A=宽_3, B="3")
move = Move(Geometry=制作体块, Motion=X_12)  # -> Geometry, Transform
multiplication_19 = Multiplication(A=multiplication_12, B=4)
subtraction_3 = Subtraction(A=division_6, B=division_7)
multiplication_20 = Multiplication(A=multiplication_12, B=2)
multiplication_21 = Multiplication(A=multiplication_12, B=2)
multiplication_22 = Multiplication(A=multiplication_12, B=1)
multiplication_23 = Multiplication(A=multiplication_12, B=3)
multiplication_24 = Multiplication(A=multiplication_12, B=4)
addition_2 = Addition(A=division_7, B=subtraction_3)
debrep = DeconstructBrep(Brep=move.Geometry)  # -> Faces, Edges, Vertices
item = ListItem(List=debrep.Edges, Index=0, Wrap=True)
end = EndPoints(Curve=item)  # -> Start, End
move_2 = Move(Geometry=end.End, Motion=X_9)  # -> Geometry, Transform
定位点_3 = Point(move_2.Geometry)
xz = XZPlane(Origin=定位点_3)
planesrf = PlaneSurface(Plane=xz, XSize=dom_2, YSize=dom)
move_3 = Move(Geometry=定位点_3, Motion=X_10)  # -> Geometry, Transform
move_4 = Move(Geometry=move_3.Geometry, Motion=Z_8)  # -> Geometry, Transform
move_5 = Move(Geometry=定位点_3, Motion=X_7)  # -> Geometry, Transform
move_6 = Move(Geometry=定位点_3, Motion=Z_2)  # -> Geometry, Transform
move_7 = Move(Geometry=move_6.Geometry, Motion=X_8)  # -> Geometry, Transform
move_8 = Move(Geometry=move_7.Geometry, Motion=Z_3)  # -> Geometry, Transform
move_9 = Move(Geometry=move_7.Geometry, Motion=Z_4)  # -> Geometry, Transform
move_10 = Move(Geometry=move_9.Geometry, Motion=X_6)  # -> Geometry, Transform
move_11 = Move(Geometry=move_10.Geometry, Motion=X_3)  # -> Geometry, Transform
move_12 = Move(Geometry=move_11.Geometry, Motion=Z_5)  # -> Geometry, Transform
move_13 = Move(Geometry=move_8.Geometry, Motion=X_4)  # -> Geometry, Transform
move_14 = Move(Geometry=定位点_3, Motion=Z_7)  # -> Geometry, Transform
move_15 = Move(Geometry=move_14.Geometry, Motion=X_2)  # -> Geometry, Transform
move_16 = Move(Geometry=move_15.Geometry, Motion=Z)  # -> Geometry, Transform
move_17 = Move(Geometry=move_16.Geometry, Motion=X)  # -> Geometry, Transform
xy = XYPlane(Origin=move_4.Geometry)
ln = Line(StartPoint=move_14.Geometry, EndPoint=move_15.Geometry)
ln_2 = Line(StartPoint=move_5.Geometry, EndPoint=定位点_3)
biarc = BiArc(StartPoint=move_15.Geometry, StartTangent=X_11, EndPoint=move_17.Geometry, EndTangent=Z_9, Ratio=Slider(1, range=0..1))  # -> FirstArc, SecondArc, BiArc
item_2 = ListItem(List=debrep.Edges, Index=0, Wrap=True)
item_3 = ListItem(List=debrep.Edges, Index=2, Wrap=True)
item_4 = ListItem(List=debrep.Edges, Index=2, Wrap=True)
item_5 = ListItem(List=debrep.Edges, Index=0, Wrap=True)
item_6 = ListItem(List=debrep.Edges, Index=11, Wrap=True)
X_13 = UnitX(Factor=multiplication_18)
item_7 = ListItem(List=debrep.Edges, Index=0, Wrap=True)
X_14 = UnitX(Factor=multiplication_19)
X_15 = UnitX(Factor=multiplication_18)
X_16 = UnitX(Factor=multiplication_19)
X_17 = UnitX(Factor=multiplication_17)
item_8 = ListItem(List=debrep.Edges, Index=0, Wrap=True)
item_9 = ListItem(List=debrep.Edges, Index=2, Wrap=True)
X_18 = UnitX(Factor=multiplication_17)
X_19 = UnitX(Factor=multiplication_20)
item_10 = ListItem(List=debrep.Edges, Index=0, Wrap=True)
item_11 = ListItem(List=debrep.Edges, Index=0, Wrap=True)
end_2 = EndPoints(Curve=item_2)  # -> Start, End
X_20 = UnitX(Factor=multiplication_20)
X_21 = UnitX(Factor=multiplication_21)
end_3 = EndPoints(Curve=item_3)  # -> Start, End
end_4 = EndPoints(Curve=item_4)  # -> Start, End
end_5 = EndPoints(Curve=item_5)  # -> Start, End
X_22 = UnitX(Factor=multiplication_22)
X_23 = UnitX(Factor=multiplication_24)
end_6 = EndPoints(Curve=item_7)  # -> Start, End
X_24 = UnitX(Factor=multiplication_23)
curvepoint = PointOnCurve(item_6, parameter=0.5)
end_7 = EndPoints(Curve=item_8)  # -> Start, End
end_8 = EndPoints(Curve=item_9)  # -> Start, End
dom_3 = ConstructDomain(DomainStart=expr("-x", division_6), DomainEnd=division_6)
end_9 = EndPoints(Curve=item_10)  # -> Start, End
end_10 = EndPoints(Curve=item_11)  # -> Start, End
move_18 = Move(Geometry=end_2.End, Motion=X_13)  # -> Geometry, Transform
dom_4 = ConstructDomain(DomainStart=0, DomainEnd=addition_2)
move_19 = Move(Geometry=end_3.Start, Motion=X_14)  # -> Geometry, Transform
rad = Radians(Degrees=Slider(53.721, range=0..360))
move_20 = Move(Geometry=end_2.End, Motion=X_17)  # -> Geometry, Transform
Z_10 = UnitZ(Factor=1)
Y = UnitY(Factor=1)
move_21 = Move(Geometry=end_4.Start, Motion=X_15)  # -> Geometry, Transform
move_22 = Move(Geometry=end_5.End, Motion=X_16)  # -> Geometry, Transform
move_23 = Move(Geometry=end_4.Start, Motion=X_18)  # -> Geometry, Transform
move_24 = Move(Geometry=end_6.End, Motion=X_19)  # -> Geometry, Transform
move_25 = Move(Geometry=end_7.End, Motion=X_21)  # -> Geometry, Transform
move_26 = Move(Geometry=end_8.Start, Motion=X_20)  # -> Geometry, Transform
move_27 = Move(Geometry=end_9.End, Motion=X_22)  # -> Geometry, Transform
move_28 = Move(Geometry=end_10.End, Motion=X_23)  # -> Geometry, Transform
move_29 = Move(Geometry=end_9.End, Motion=X_24)  # -> Geometry, Transform
X_25 = UnitX(Factor=expr("-x", 1))
Z_11 = UnitZ(Factor=1)
Z_12 = UnitZ(Factor=1)
Z_13 = UnitZ(Factor=1)
Z_14 = UnitZ(Factor=1)
vrot = Rotate(Vector=Z_10, Axis=Y, Angle=rad)
Z_15 = UnitZ(Factor=1)
Z_16 = UnitZ(Factor=1)
Z_17 = UnitZ(Factor=1)
Z_18 = UnitZ(Factor=1)
planesrf_2 = PlaneSurface(Plane=curvepoint, XSize=dom_4, YSize=dom_3)
panel_13 = Panel("step4:拽枋位置（包掩）")
panel_14 = Panel("step2:正心枋位置（包掩）")
panel_15 = Panel("step7:燕尾榫")
panel_16 = Panel("step6:厢拱位置（包掩）")
燕尾榫 = 燕尾榫(定位点=curvepoint, 宽度方向=item_6, 长度方向=X_25, 连接长度=宽_3, 取几份="3", 收分=0.9)
arc = ArcSED(Start=move_17.Geometry, End=move_13.Geometry, Direction=vrot)  # -> Arc, Plane, Radius
panel_17 = Panel("step8:麻叶头")
panel_18 = Panel("step1:正心枋位置")
panel_19 = Panel("step3:拽枋位置")
panel_20 = Panel("step5:厢拱位置")
切掉 = 切掉(起点=move_25.Geometry, 宽度方向=item_8, 截面宽=正心枋宽_2, 长度方向=Z_11, 截面长=division_4, 深度=宽_2, 颠倒深度=invert(False))
切掉_2 = 切掉(起点=move_24.Geometry, 宽度方向=item_7, 截面宽=正心枋宽_2, 长度方向=Z_14, 截面长=高_2, 深度=multiplication_16, 颠倒深度=invert(False))
切掉_3 = 切掉(起点=move_26.Geometry, 宽度方向=item_9, 截面宽=正心枋宽_2, 长度方向=Z_14, 截面长=高_2, 深度=multiplication_16, 颠倒深度=invert(False))
切掉_4 = 切掉(起点=move_27.Geometry, 宽度方向=item_10, 截面宽=正心枋宽_2, 长度方向=Z_12, 截面长=division_4, 深度=宽_2, 颠倒深度=invert(False))
切掉_5 = 切掉(起点=move_29.Geometry, 宽度方向=item_10, 截面宽=正心枋宽_2, 长度方向=Z_12, 截面长=division_4, 深度=宽_2, 颠倒深度=invert(False))
切掉_6 = 切掉(起点=move_28.Geometry, 宽度方向=item_11, 截面宽=正心枋宽_2, 长度方向=Z_13, 截面长=division_5, 深度=宽_2, 颠倒深度=invert(False))
切掉_7 = 切掉(起点=move_18.Geometry, 宽度方向=item_2, 截面宽=正心枋宽_2, 长度方向=Z_15, 截面长=高_2, 深度=multiplication_16, 颠倒深度=invert(False))
切掉_8 = 切掉(起点=move_20.Geometry, 宽度方向=item_2, 截面宽=正心枋宽_2, 长度方向=Z_15, 截面长=高_2, 深度=multiplication_16, 颠倒深度=invert(False))
切掉_9 = 切掉(起点=move_28.Geometry, 宽度方向=item_11, 截面宽=十八斗宽_2, 长度方向=Z_13, 截面长=expression, 深度=宽_2, 颠倒深度=invert(False))
切掉_10 = 切掉(起点=move_19.Geometry, 宽度方向=item_3, 截面宽=正心枋宽_2, 长度方向=Z_16, 截面长=单才拱高_2, 深度=multiplication_16, 颠倒深度=invert(False))
切掉_11 = 切掉(起点=move_21.Geometry, 宽度方向=item_4, 截面宽=正心枋宽_2, 长度方向=Z_17, 截面长=高_2, 深度=multiplication_16, 颠倒深度=invert(False))
切掉_12 = 切掉(起点=move_22.Geometry, 宽度方向=item_5, 截面宽=正心枋宽_2, 长度方向=Z_18, 截面长=单才拱高_2, 深度=multiplication_16, 颠倒深度=invert(False))
X_26 = UnitX(Factor=subtraction_3)
切掉_13 = 切掉(起点=move_23.Geometry, 宽度方向=item_4, 截面宽=正心枋宽_2, 长度方向=Z_17, 截面长=高_2, 深度=multiplication_16, 颠倒深度=invert(False))
move_30 = Move(Geometry=燕尾榫, Motion=X_26)  # -> Geometry, Transform
sdiff = SolidDifference(BrepsA=planesrf_2, BrepsB=move_30.Geometry)
arc_2 = Arc3Pt(PointA=move_10.Geometry, PointB=move_7.Geometry, PointC=move_13.Geometry)  # -> Arc, Plane, Radius
merge = Merge(Data1=切掉_2, Data2=切掉_3)
merge_2 = Merge(Data1=切掉_4, Data2=切掉_5)
X_27 = UnitX(Factor=1)
Z_19 = UnitZ(Factor=1)
item_12 = ListItem(List=sdiff, Index=0, Wrap=True)  # -> Item, Item1
merge_3 = Merge(Data1=切掉_6, Data2=切掉_9)
merge_4 = Merge(Data1=切掉_7, Data2=切掉_8, Data3=切掉_11, Data4=切掉_13)
merge_5 = Merge(Data1=切掉_12, Data2=切掉_10)
Z_20 = UnitZ(Factor=1)
Y_2 = UnitY(Factor=1)
切掉_14 = 切掉(宽度方向=Vector(0, 0, 1), 长度方向=Vector(0, 0, 1), 输入截面=item_12.Item, 深度=高_4, 颠倒深度=False)
切掉_15 = 切掉(宽度方向=Vector(0, 0, 1), 长度方向=Vector(0, 0, 1), 输入截面=item_12.Item1, 深度=高_4, 颠倒深度=False)
vrot_2 = Rotate(Vector=Z_20, Axis=Y_2, Angle=degrees(Slider(360, range=0..360)))
arc_3 = ArcSED(Start=move_12.Geometry, End=move_10.Geometry, Direction=vrot_2)  # -> Arc, Plane, Radius
merge_6 = Merge(Data1=切掉_14, Data2=切掉_15)
Z_21 = UnitZ(Factor=1)
Y_3 = UnitY(Factor=1)
vrot_3 = Rotate(Vector=Z_21, Axis=Y_3, Angle=degrees(Slider(211.331, range=0..360)))
Z_22 = UnitZ(Factor=expr("-x", 1))
X_28 = UnitX(Factor=1)
biarc_2 = BiArc(
    StartPoint=move_12.Geometry,
    StartTangent=X_28,
    EndPoint=move_4.Geometry,
    EndTangent=Z_22,
    Ratio=Slider(0.527, range=0..1))  # -> FirstArc, SecondArc, BiArc
crv = Curve(biarc_2.BiArc)
mirror = Mirror(Geometry=crv, Plane=xy)  # -> Geometry, Transform
end_11 = EndPoints(Curve=mirror.Geometry)  # -> Start, End
pt = Point(end_11.Start)
move_31 = Move(Geometry=pt, Motion=Z_6)  # -> Geometry, Transform
move_32 = Move(Geometry=move_31.Geometry, Motion=X_5)  # -> Geometry, Transform
biarc_3 = BiArc(StartPoint=move_5.Geometry, StartTangent=X_27, EndPoint=move_32.Geometry, EndTangent=Z_19, Ratio=Slider(1, range=0..1))  # -> FirstArc, SecondArc, BiArc
crv_2 = Curve(biarc_3.BiArc)
arc_4 = ArcSED(Start=end_11.Start, End=move_32.Geometry, Direction=vrot_3)  # -> Arc, Plane, Radius
merge_7 = Merge(
    Data1=ln,
    Data2=biarc.BiArc,
    Data3=arc.Arc,
    Data4=arc_2.Arc,
    Data5=arc_3.Arc,
    Data6=crv,
    Data7=mirror.Geometry,
    Data8=arc_4.Arc,
    Data9=crv_2,
    Data10=ln_2)  # -> flatten(Result)
join = JoinCurves(Curves=merge_7, Preserve=False)
srfsplit = SurfaceSplit(Surface=planesrf, Curves=join)
item_13 = ListItem(List=srfsplit, Index=0, Wrap=True)  # -> Item, Item1, Item2
切掉_16 = 切掉(宽度方向=Vector(0, 0, 1), 长度方向=Vector(0, 0, 1), 输入截面=item_13.Item, 深度=num, 颠倒深度=False)
切掉_17 = 切掉(宽度方向=Vector(0, 0, 1), 长度方向=Vector(0, 0, 1), 输入截面=item_13.Item1, 深度=num, 颠倒深度=False)
切掉_18 = 切掉(宽度方向=Vector(0, 0, 1), 长度方向=Vector(0, 0, 1), 输入截面=item_13.Item2, 深度=num, 颠倒深度=False)
merge_8 = Merge(Data1=切掉_16, Data2=切掉_17, Data3=切掉_18)
merge_9 = Merge(Data1=切掉, Data2=merge, Data3=merge_2, Data4=merge_4, Data5=merge_3, Data6=merge_5, Data7=merge_6, Data8=merge_8)  # -> flatten(Result)
sdiff_2 = SolidDifference(BrepsA=move.Geometry, BrepsB=merge_9)
fmerge = MergeFaces(Brep=sdiff_2)  # -> Breps, Before, After
rotate = Rotate(Geometry=fmerge.Breps, Angle=1.570796327, Plane=定位点_2)  # -> Geometry, Transform
G = ClusterOutput(rotate.Geometry)

# ==== cluster 进一法
保留位数 = ClusterInput()
num = ClusterInput()
保留位数_2 = Number(保留位数)
num_2 = Number(num)
_10º = PowerOf10(Value=保留位数_2)
multiplication = Multiplication(A=num_2, B=_10º)
int = Integer(multiplication)
subtraction = Subtraction(A=multiplication, B=int)
larger = LargerThan(FirstNumber=subtraction, SecondNumber=0)  # -> LargerThan, OrEqualTo
dispatch = Dispatch(List=int, DispatchPattern=larger.LargerThan)  # -> ListA, ListB
addition = Addition(A=dispatch.ListA, B=1)
addition_2 = Addition(A=dispatch.ListB, B=0)
max = Maximum(A=addition, B=addition_2)
division = Division(A=max, B=_10º)
R = ClusterOutput(division)

# ==== cluster 桁椀
大斗高 = ClusterInput()
正心枋宽 = ClusterInput()
高 = ClusterInput()
定位点 = ClusterInput()
斗口 = ClusterInput()
长 = ClusterInput()
宽 = ClusterInput()
大斗高_2 = Number(大斗高)
正心枋宽_2 = Number(正心枋宽)
定位点_2 = Point(定位点)
长_2 = Number(长)
宽_2 = Number(宽)
高_2 = Number(高)
panel = Panel("包掩")
expression = Expression(x=大斗高_2, Expression="x*2/5")
panel_2 = Panel("大斗斗耳高")
斗口_2 = Number(斗口)
division = Division(A=高_2, B=2)
multiplication = Multiplication(A=斗口_2, B=Slider(0.1, range=0..0.1))
division_2 = Division(A=expression, B=2)
制作体块 = 制作体块(定位点=定位点_2, 横向竖向=True, 长=长_2, 宽=宽_2, 高=高_2)
multiplication_2 = Multiplication(A=division_2, B=2)
addition = Addition(A=正心枋宽_2, B=multiplication_2)
debrep = DeconstructBrep(Brep=制作体块)  # -> Faces, Edges, Vertices
item = ListItem(List=debrep.Edges, Index=0, Wrap=True)
item_2 = ListItem(List=debrep.Edges, Index=0, Wrap=True)
item_3 = ListItem(List=debrep.Edges, Index=2, Wrap=True)
curvepoint = PointOnCurve(item, parameter=0.5)
curvepoint_2 = PointOnCurve(item_3, parameter=0.5)
curvepoint_3 = PointOnCurve(item_2, parameter=0.5)
Z = UnitZ(Factor=1)
Z_2 = UnitZ(Factor=1)
panel_3 = Panel("step2:正心拱位置（包掩）")
panel_4 = Panel("step1:正心拱位置")
切掉 = 切掉(起点=curvepoint, 宽度方向=item, 截面宽=正心枋宽_2, 长度方向=Z_2, 截面长=division, 深度=宽_2, 颠倒深度=invert(False))
切掉_2 = 切掉(起点=curvepoint_3, 宽度方向=item_2, 截面宽=正心枋宽_2, 长度方向=Z, 截面长=高_2, 深度=multiplication, 颠倒深度=invert(False))
切掉_3 = 切掉(起点=curvepoint_2, 宽度方向=item_3, 截面宽=正心枋宽_2, 长度方向=Z, 截面长=高_2, 深度=multiplication, 颠倒深度=invert(False))
merge = Merge(Data1=切掉, Data3=切掉_2, Data4=切掉_3)  # -> flatten(Result)
sdiff = SolidDifference(BrepsA=制作体块, BrepsB=merge)
fmerge = MergeFaces(Brep=sdiff)  # -> Breps, Before, After
rotate = Rotate(Geometry=fmerge.Breps, Angle=1.570796327, Plane=定位点_2)  # -> Geometry, Transform
G = ClusterOutput(rotate.Geometry)

# ==== cluster 制作体块
横向竖向 = ClusterInput()
横向竖向_2 = Boolean(横向竖向)
定位点 = ClusterInput()
merge = Merge(Data1=横向竖向_2, Data2=Toggle(True))
长 = ClusterInput()
宽 = ClusterInput()
高 = ClusterInput()
panel = Panel("""0
1""")
定位点_2 = Point(定位点)
长_2 = Number(长)
宽_2 = Number(宽)
高_2 = Number(高)
cull = CullPattern(List=panel, CullPattern=merge)
division = Division(A=宽_2, B=2)
division_2 = Division(A=长_2, B=2)
xz = XZPlane(Origin=定位点_2)
xy = XYPlane(Origin=定位点_2)
item = ListItem(List=cull, Index=0, Wrap=True)
dom = ConstructDomain(DomainStart=expr("-x", division), DomainEnd=division)
dom_2 = ConstructDomain(DomainStart=expr("-x", division_2), DomainEnd=division_2)
merge_2 = Merge(Data1=xy, Data2=xz)
item_2 = ListItem(List=merge_2, Index=item, Wrap=True)
Z = UnitZ(Factor=高_2)
planesrf = PlaneSurface(Plane=item_2, XSize=dom_2, YSize=dom)
extr = Extrude(Base=planesrf, Direction=Z)
体块 = ClusterOutput(extr)

# ==== cluster 制作三角
起始点 = ClusterInput()
起始方向 = ClusterInput()
斗底收进 = ClusterInput()
斗底高度 = ClusterInput()
起始方向_2 = Vector(起始方向)
斗底收进_2 = Number(斗底收进)
斗底高度_2 = Number(斗底高度)
起始点_2 = Point(起始点)
Z = UnitZ(Factor=斗底高度_2)  # -> graft(UnitVector)
multiplication = Multiplication(A=斗底收进_2, B=起始方向_2)
move = Move(Geometry=起始点_2, Motion=multiplication)  # -> Geometry, Transform
move_2 = Move(Geometry=起始点_2, Motion=Z)  # -> Geometry, Transform
merge = Merge(Data1=起始点_2, Data2=move.Geometry, Data3=move_2.Geometry)
pline = PolyLine(Vertices=merge, Closed=invert(False))
boundary = BoundarySurfaces(Edges=pline)
形状 = ClusterOutput(boundary)

# ==== cluster 切掉
宽度方向 = ClusterInput()
输入截面 = ClusterInput()
颠倒深度 = ClusterInput()
起点 = ClusterInput()
截面宽 = ClusterInput()
长度方向 = ClusterInput()
截面长 = ClusterInput()
深度 = ClusterInput()
截面宽_2 = Number(截面宽)
长度方向_2 = Vector(长度方向)
起点_2 = Point(起点)
截面长_2 = Number(截面长)
宽度方向_2 = Vector(宽度方向)
颠倒深度_2 = Boolean(颠倒深度)
输入截面_2 = Surface(输入截面)
深度_2 = Number(深度)
merge = Merge(Data1=颠倒深度_2, Data2=Toggle(True))
panel = Panel("""1
-1""")
multiplication = Multiplication(A=长度方向_2, B=截面长_2)
cull = CullPattern(List=panel, CullPattern=merge)
division = Division(A=截面宽_2, B=2)
item = ListItem(List=cull, Index=0, Wrap=True)
multiplication_2 = Multiplication(A=深度_2, B=item)
multiplication_3 = Multiplication(A=division, B=宽度方向_2)
move = Move(Geometry=起点_2, Motion=expr("-x", multiplication_3))  # -> Geometry, Transform
move_2 = Move(Geometry=起点_2, Motion=multiplication_3)  # -> Geometry, Transform
ln = Line(StartPoint=move_2.Geometry, EndPoint=move.Geometry)
extr = Extrude(Base=ln, Direction=multiplication)
merge_2 = Merge(Data1=flatten(输入截面_2), Data2=flatten(extr))
item_2 = ListItem(List=merge_2, Index=0, Wrap=True)
facen = FaceNormals(Mesh=item_2)  # -> Centers, Normals
item_3 = ListItem(List=facen.Normals, Index=0, Wrap=True)
multiplication_4 = Multiplication(A=item_3, B=multiplication_2)
extr_2 = Extrude(Base=item_2, Direction=multiplication_4)
切掉 = ClusterOutput(extr_2)

# ==== cluster 制作槽升榫形状
起始点 = ClusterInput()
起始方向 = ClusterInput()
槽升底长 = ClusterInput()
槽升底收进 = ClusterInput()
槽升腰高 = ClusterInput()
槽升位高度 = ClusterInput()
起始点_2 = Point(起始点)
槽升腰高_2 = Number(槽升腰高)
槽升位高度_2 = Number(槽升位高度)
槽升底长_2 = Number(槽升底长)
起始方向_2 = Vector(起始方向)
槽升底收进_2 = Number(槽升底收进)
multiplication = Multiplication(A=槽升底长_2, B=起始方向_2)
Z = UnitZ(Factor=expr("-x", 1))
Z_2 = UnitZ(Factor=expr("-x", 1))
move = Move(Geometry=起始点_2, Motion=multiplication)  # -> Geometry, Transform
multiplication_2 = Multiplication(A=槽升底收进_2, B=起始方向_2)
multiplication_3 = Multiplication(A=槽升位高度_2, B=Z_2)
multiplication_4 = Multiplication(A=槽升腰高_2, B=Z)
起始点_3 = Point(move.Geometry)
move_2 = Move(Geometry=起始点_3, Motion=multiplication_2)  # -> Geometry, Transform
move_3 = Move(Geometry=起始点_3, Motion=multiplication_3)  # -> Geometry, Transform
move_4 = Move(Geometry=move_2.Geometry, Motion=multiplication_4)  # -> Geometry, Transform
merge = Merge(Data1=起始点_3, Data2=move_2.Geometry, Data3=move_4.Geometry, Data4=move_3.Geometry)
pline = PolyLine(Vertices=merge, Closed=invert(False))
boundary = BoundarySurfaces(Edges=pline)
形状 = ClusterOutput(boundary)

# ==== cluster 制作拱瓣
起始点 = ClusterInput()
起始方向 = ClusterInput()
拱瓣高 = ClusterInput()
拱瓣长 = ClusterInput()
万三_瓜四_厢五 = ClusterInput()
万三_瓜四_厢五_2 = Number(万三_瓜四_厢五)
拱瓣长_2 = Number(拱瓣长)
拱瓣高_2 = Number(拱瓣高)
起始点_2 = Point(起始点)
起始方向_2 = Vector(起始方向)
Z = UnitZ(Factor=1)
multiplication = Multiplication(A=拱瓣高_2, B=Z)
multiplication_2 = Multiplication(A=拱瓣长_2, B=起始方向_2)
move = Move(Geometry=起始点_2, Motion=multiplication)  # -> Geometry, Transform
move_2 = Move(Geometry=起始点_2, Motion=multiplication_2)  # -> Geometry, Transform

# ---- group: 拱瓣卷杀
vec2pt = Vector2Pt(PointA=起始点_2, PointB=move_2.Geometry, Unitize=True)  # -> Vector, Length
vec2pt_2 = Vector2Pt(PointA=move.Geometry, PointB=起始点_2, Unitize=False)  # -> Vector, Length
biarc = BiArc(StartPoint=move.Geometry, StartTangent=vec2pt_2.Vector, EndPoint=move_2.Geometry, EndTangent=vec2pt.Vector, Ratio=0)  # -> FirstArc, SecondArc, BiArc
ln = Line(StartPoint=move.Geometry, EndPoint=move_2.Geometry)
divide = DivideCurve(Curve=ln, Count=万三_瓜四_厢五_2, Kinks=False)  # -> reverse(Points), Tangents, Parameters
xz = XZPlane(Origin=divide.Points)
rotate = Rotate(Geometry=ln, Angle=1.570796327, Plane=xz)  # -> Geometry, Transform
ccx = CurveCurve(CurveA=biarc.BiArc, CurveB=rotate.Geometry)  # -> Points, ParamsA, ParamsB
pline = PolyLine(Vertices=flatten([起始点_2, ccx.Points]), Closed=True)
boundary = BoundarySurfaces(Edges=pline)

# ----
拱瓣 = ClusterOutput(boundary)

# ==== cluster 燕尾榫
宽度方向 = ClusterInput()
长度方向 = ClusterInput()
连接长度 = ClusterInput()
收分 = ClusterInput()
取几份 = ClusterInput()
定位点 = ClusterInput()
定位点_2 = Point(定位点)
宽度方向_2 = Vector(宽度方向)
取几份_2 = Number(取几份)
长度方向_2 = Vector(长度方向)
连接长度_2 = Number(连接长度)
收分_2 = Number(收分)
division = Division(A=连接长度_2, B=取几份_2)
division_2 = Division(A=division, B=2)
multiplication = Multiplication(A=长度方向_2, B=division)
multiplication_2 = Multiplication(A=division_2, B=收分_2)
vec = Vector(expr("-x", 宽度方向_2))
vec_2 = Vector(宽度方向_2)
pt = Point(定位点_2)
move = Move(Geometry=pt, Motion=expr("-x", multiplication))  # -> Geometry, Transform
multiplication_3 = Multiplication(A=vec_2, B=division_2)
multiplication_4 = Multiplication(A=vec, B=division_2)
multiplication_5 = Multiplication(A=vec_2, B=multiplication_2)
multiplication_6 = Multiplication(A=vec, B=multiplication_2)
move_2 = Move(Geometry=pt, Motion=[multiplication_3, multiplication_4])  # -> Geometry, Transform
move_3 = Move(Geometry=move.Geometry, Motion=[multiplication_5, multiplication_6])  # -> reverse(Geometry), Transform
pline = PolyLine(Vertices=[move_2.Geometry, move_3.Geometry], Closed=invert(False))
boundary = BoundarySurfaces(Edges=pline)
燕尾榫 = ClusterOutput(boundary)
